# Grasshopper definition 2520_LCA_v11_jac_Pil_English.gh (Grasshopper 1.0.8)
# plug-ins: Pufferfish, Human, LunchBox, LadybugGrasshopper, MetaHopper, eleFront5, Sasquatch, HDTTreeUtils

# ----
# README!
# The goal of the template is to provide a flexible framework for structuring new Grasshopper files. The template suggests a methodology for colour-coding groupings of components according to their respective functionality in the script.
# 
# As a general rule of thumb, another team member should be able to take over your file with a minimal amount of input as to how it is organized. Two templates are outlined below with differing input/output methods.
# 
# Please note, if you receive a warning upon opening an existing Grasshopper script that specific components/plugins are missing DO NOT SAVE THE SCRIPT. Saving the script in this state, will remove the missing components completely and break the script. You will need to download the specific Grasshopper plugins mentioned in the pop-up warning, install them, and then reopen the script.
# 
# TEMPLATE – DYNAMIC GEOMETRY PIPELINE
# This template is designed to work in tandem with the CEBRA Rhino template. It makes use of a dynamic geometry pipeline to automate the input/output functionality of the script to specific layers. Any geometry created on the specified input layer of the Rhino template, will automatically be loaded into the Grasshopper script. Similarly, at the output end of the script the dynamic geometry pipeline is used to bake to the specified output layer using a Boolean toggle.
# This functionality requires the installation of the Human Grasshopper Plugin, which can be found here:
# http://www.food4rhino.com/app/human
# 
# TEMPLATE – DIRECT INPUT/OUTPUT
# This template suggests how the "old-fashioned" method of direct input/output should be structured in new Grasshopper scripts.
# COLOUR PALETTE
panel = Panel("INPUT")

# ----
# 0. SCENARIO SELECTION
layer_name = Panel("""A
B
C""")
list = ValueList({"A": 0, "B": 1, "C": 2}, selected="B")
item = ListItem(List=layer_name, Index=list, Wrap=True)
concat = Concatenate(FragmentA="LCAPLAN", FragmentB="::", FragmentE="Workshop 1", FragmentF="::", FragmentC=item, FragmentD="::")

# ---- group: PUSH TO GENERATE KEYS/VALUES FOR NEW GEOMETRY
generate_default_attributes_to_new_geome = Button()  # "Generate default attributes to new geometry"

# ---- group: PUSH TO GENERATE/RESET KEYS/VALUES
# 1. GENERATE/RESET ATTRIBUTES
# WARNING!
# Rhino and Grasshopper will crash if these buttons are pushed, while the analysis (step 2) is running.
generate_reset_to_default_attributes = Button()

# ----
panel_2 = Panel("ADJUSTABLE VARIABLES")

keys = Panel("""OperationYear
Ambition
PreservationStrategy
StructuralMaterial
EnergySupplyType
ElevatorOverride""")
panel_3 = Panel("""1_NEDRIVNING::*
2_BEBYGGELSE::*""")
concat_2 = Concatenate(FragmentA=concat, FragmentB=panel_3)
standard_values = Panel("""2025
0.5
0
0
0
-1""")
dpipeline = DynamicGeometryPipeline(
    LayerFilter=concat_2,
    TypeFilter=["Brep", "Extrusion"],
    NameFilter="*",
    GroupByLayer=False,
    GroupByType=False,
    IncludeHidden=True,
    IncludeLocked=True,
    enableFullPath=True,
    listenToAttributes=True)  # -> flatten(GeometryOut)
getkv = GetAllKeysValues(AttributesOrAttributedGeometry=dpipeline)  # -> Keys, simplify(Values), BakeName
null = NullItem(Item=getkv.Values)  # -> NullFlags, InvalidFlags, Description
item_2 = ListItem(List=null.NullFlags, Index=0, Wrap=True)
dispatch = Dispatch(List=dpipeline, DispatchPattern=flatten(item_2))  # -> ListA, ListB
brep = Brep(dispatch.ListA)
brep_2 = Brep(dispatch.ListB)
list_2 = ValueList({"Layer", "Object", "Parent"}, selected="Layer")
# AMBITION LEVEL READ-ME: 0.9 = bottom 10% (very unambitious)
# ...
# 0.5 = 50% (default)
# ...
# 0.1 = top 10% (very ambitious)
# PRESERVATION STRATEGY READ-ME: New Build      = 0
# Transformation = 1
# Renovation     = 2
# Refurbished    = 3
# Preserved      = 4
# Demolished     = 5
rhatt = GetRhinoAttributes(Geometry=dpipeline, fullpath=False)  # -> Name, Layer, Color, MaterialName, SourceFile
rhatt_2 = GetRhinoAttributes(Geometry=brep, fullpath=False)  # -> Name, Layer, Color, MaterialName, SourceFile
ef_att = EleFrontAttributes(
    Keys=keys,
    Values=standard_values,
    Name=rhatt_2.Name,
    Layer=rhatt_2.Layer,
    ColourSource=list_2,
    MaterialSource=list_2,
    maintainBakeName=False)  # -> Attributes, Keys, Values, Name, Layer, ColourSource, DisplayColour, MaterialSource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
# STRUCTURAL MATERIAL READ-ME: Non-defined          = 0
# ConcreteBearingWalls = 1
# ConcreteBeamsColumns = 2
# Hybrid               = 3
# WoodBearingWalls     = 4
# WoodBEamsColumns     = 5
# ENERGY SUPPLY READ-ME: Fjernvarme = 0
# El         = 1
# Uopvarmet  = 2
ef_att_2 = EleFrontAttributes(
    Keys=keys,
    Values=standard_values,
    Name=rhatt.Name,
    Layer=rhatt.Layer,
    ColourSource=list_2,
    MaterialSource=list_2,
    maintainBakeName=False)  # -> Attributes, Keys, Values, Name, Layer, ColourSource, DisplayColour, MaterialSource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
modratt = ModifyRhinoObjectAttributes(ReferencedObject=dpipeline, Attributes=ef_att_2.Attributes, Activate=generate_reset_to_default_attributes)
modratt_2 = ModifyRhinoObjectAttributes(ReferencedObject=brep, Attributes=ef_att.Attributes, Activate=generate_default_attributes_to_new_geome)

panel_4 = Panel("MACHINE ROOM")

panel_5 = Panel("""DIAGNOSTICS/
DATA""")

# ---- group: 2.1 - TOGGLE TO RUN QUANTITY ANALYSIS
# 2. ANALYSIS
falsestart = LBFalseStartToggle(True)

# ---- group: TOLERANCER
tolerance_overhang_above_terrain = Panel("1.25")
equality_tolerance_for_z_prod_calculatio = Panel(".01")  # "EQUALITY TOLERANCE FOR Z-PROD CALCULATIONS"
max_incline_for_pitched_roof = Panel(".95")
min_incline_for_pitched_roof = Panel(".1")
generic_floor_slab_thickness = Panel(".5")
elevator_i_bygninger_over_x_antal_etager = Panel("3")
max_deviation_from_core_center = Slider(4, range=0..10)
kerne_i_bygninger_over_x_antal_etager = Panel("1")
# TYPOLOGIES: Enfamiliehus    = "Enfamiliehus"
# Rækkehus        = "Rækkehus"
# Etagebolig      = "Etagebolig"
# Kontor          = "Kontor"
# Undervisning    = "Undervisning"
# Dagsinstitution = "Dagsinstitution"
# Butik           = "Butik"
# Parkering       = "Parkering"
# Industri        = "Industri"
# Transport       = "Transport"
# Hotel           = "Hotel"
# Sundhedshuse    = "Sundhedshuse"
trapper_i_bygninger_over_x_antal_etager = Panel("1")

# ----
panel_6 = Panel("OUTPUT")

# ---- group: 2.2 - TOGGLE TO RUN LCA ANALYSIS
filepath_excel_lcakeys = FilePath("C:\Users\au384078\OneDrive - Aarhus universitet\Dokumenter\RESEARCH\CEBRA - Urban LCA\LCA Plan\LCAVolume_Keys.xlsx")
falsestart_2 = LBFalseStartToggle(True)

# ---- group: QUANTITY VIEWS
# 3. PREVIEW MODES
preview_quantities = ValueList({"Roof": 0, "Facades": 1, "Floor slabs": 2, "Ground floor slabs": 3, "Basement floor slab": 4, "Terrain": 5}, selected=[])

# ---- group: STRATEGY VIEWS
strategies_info_overlay = ValueList({"Strategy dots": 0, "Strategy legend": 1}, selected=[])
preview_strategies = ValueList({"Ambition": 0, "Preservation strategy": 1, "Structural material": 2, "Energy supply": 3}, selected=[])

# ---- group: RESULT VIEWS
lca_result_info_overlay = ValueList({"LCA result dots": 0, "LCA result legend": 1}, selected=["LCA result dots", "LCA result legend"])
preview_lca_estimate = ValueList({"LCA per floor": 0, "LCA per grouping": 1, "LCA per site boundary": 2}, selected="LCA per floor")

# ----
wiredisplay = ControlWireDisplay(WireDisplay=1, AllObjects_Object=[preview_13, swatch_3, swatch_5, preview_12, concat_14, panel_25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])
# DATA IMPORT/EXTRACTION
# SITE BOUNDARY
concat_3 = Concatenate(
    FragmentA="LCAPLAN",
    FragmentB="::",
    FragmentE="Workshop 1",
    FragmentF="::",
    FragmentC=item,
    FragmentD="::",
    FragmentG="0_SITE_BOUNDARY")
concat_4 = Concatenate(FragmentA=concat, FragmentB="2_BEBYGGELSE*")
# BUILDING GEOMETRY
panel_7 = Panel("Surface")
# DEMOLITION GEOMETRY
concat_5 = Concatenate(FragmentA=concat, FragmentB="1_NEDRIVNING*")
# SITE TERRAIN
concat_6 = Concatenate(FragmentA=concat, FragmentB="0_SITE_TERRAIN")
panel_8 = Panel("""Brep
Extrusion""")
panel_9 = Panel("""Brep
Extrusion""")
dpipeline_2 = DynamicGeometryPipeline(
    LayerFilter=concat_6,
    TypeFilter=["Brep", "Extrusion", panel_7],
    NameFilter="*",
    GroupByLayer=False,
    GroupByType=False,
    IncludeHidden=True,
    IncludeLocked=True,
    enableFullPath=True,
    listenToAttributes=True)
reflay = ReferenceByLayer(LayerName=concat_3, lightweight=False)
reflay_2 = ReferenceByLayer(LayerName=concat_4, lightweight=False, DisableAutoUpdate=False)
reflay_3 = ReferenceByLayer(LayerName=concat_5, lightweight=False, DisableAutoUpdate=False)
expblock = ExplodeBlock(Block=reflay, recursive=False)  # -> Name, Transform, Geometry
filtertype = FilterByType(ObjectType=panel_8, Geometry=reflay_2, invertFilter=False, returnNulls=False)  # -> ExcludedGeometry, flatten(IncludedGeometry)
filtertype_2 = FilterByType(ObjectType=panel_9, Geometry=reflay_3, invertFilter=False, returnNulls=False)  # -> ExcludedGeometry, flatten(IncludedGeometry)
panel_10 = Panel(expblock.Name)
tsort = SortText(Keys=flatten(expblock.Name), Values=flatten(expblock.Geometry), Culture=127)  # -> simplify(graft(Keys)), graft(Values)
brep_buildings = Brep(filtertype.IncludedGeometry)
brep_demolition = Brep(filtertype_2.IncludedGeometry)
brep_terrain = Brep(dpipeline_2)
panel_11 = Panel(tsort.Keys)
crv_site_boundary = Curve(simplify(tsort.Values))

brep_areas = Area_extraction_from_brep(brep=brep_demolition)  # -> brep_3, int_2, pt_2, equality
plot_areas = Area_calc_per_plot(brep=brep_areas.brep_3, crv=crv_site_boundary, int=brep_areas.int_2, pt=brep_areas.pt_2)  # -> brep_5, int_7

# ----
# GROUP ACCORDING TO SITE
brep_areas_2 = Area_extraction_from_brep(brep=brep_buildings)  # -> brep_3, int_2, pt_2, equality
plot_areas_2 = Area_calc_per_plot(brep=brep_areas_2.brep_3, crv=crv_site_boundary, int=brep_areas_2.int_2, pt=brep_areas_2.pt_2)  # -> brep_5, int_7

brep_3 = Brep(plot_areas.brep_5)
# OBS!
# Opdeling i terrændæk/tag ved større stueetager = dobbeltterrændæk
viewer = ParamViewer(brep_3)
# HOW TO IMPLEMENT
area = Area(Geometry=brep_3)  # -> Area, Centroid
project = Project(Geometry=area.Centroid, Plane=PlaneXY(0, 0, 0))  # -> Geometry, Transform
pgroups = PointGroups(Points=project.Geometry, Distance=max_deviation_from_core_center)  # -> Groups, Indices
lng = ListLength(List=pgroups.Indices)
path_mapper = PathMapper(lng, source=["{A;B}", "{A}"], target=["{A}", "{A}"])
path_mapper_2 = PathMapper(pgroups.Indices, source=["{A;B}", "{A}"], target=["{A}", "{A}"])
tstat = TreeStatistics(Tree=brep_3)  # -> graft(Paths), graft(Length), Count
tree = CreateTree(Data=tstat.Length, Path=tstat.Paths)
cull_i = CullIndex(List=tree, Indices=0, Wrap=True)  # -> simplify(List)
merge = Merge(Data1=path_mapper_2, Data2=cull_i)  # -> simplify(Result)
item_3 = ListItem(List=brep_3, Index=merge, Wrap=True)  # -> simplify(Item)
partition = PartitionList(List=item_3, Size=path_mapper)
area_2 = Area(Geometry=partition)  # -> Area, Centroid
pdecon = Deconstruct(Point=area_2.Centroid)  # -> XComponent, YComponent, ZComponent
sort = SortList(Keys=pdecon.ZComponent, ValuesA=partition)  # -> Keys, ValuesA; disabled

# ----
# !DEBUG!
# READ ME: All Brep checks must be true. If there is a false value in one of the layers, bad/dity geometry exists that Grasshopper can't extract area data from.
debug_check = Panel("{0}: {1}")
txt_typologies_error = Text(brep_areas_2.equality)
txt_typologies = Text()
format = Format(Format=debug_check, Culture=127, Data0=txt_typologies, Data1=txt_typologies_error)  # -> flatten(Text)
all_must_be_true = Panel(format)

# ----
# GROUP ACCORDING TO STACKS
brep_4 = Brep(plot_areas_2.brep_5)
viewer_2 = ParamViewer(brep_4)
area_3 = Area(Geometry=brep_4)  # -> Area, Centroid
project_2 = Project(Geometry=area_3.Centroid, Plane=PlaneXY(0, 0, 0))  # -> Geometry, Transform
pgroups_2 = PointGroups(Points=project_2.Geometry, Distance=max_deviation_from_core_center)  # -> Groups, Indices
lng_2 = ListLength(List=pgroups_2.Indices)
path_mapper_3 = PathMapper(pgroups_2.Indices, source=["{A;B}", "{A}"], target=["{A}", "{A}"])
path_mapper_4 = PathMapper(lng_2, source=["{A;B}", "{A}"], target=["{A}", "{A}"])
tstat_2 = TreeStatistics(Tree=brep_4)  # -> graft(Paths), graft(Length), Count
tree_2 = CreateTree(Data=tstat_2.Length, Path=tstat_2.Paths)
cull_i_2 = CullIndex(List=tree_2, Indices=0, Wrap=True)  # -> simplify(List)
merge_2 = Merge(Data1=path_mapper_3, Data2=cull_i_2)  # -> simplify(Result)
item_4 = ListItem(List=brep_4, Index=merge_2, Wrap=True)  # -> simplify(Item)
partition_2 = PartitionList(List=item_4, Size=path_mapper_4)
area_4 = Area(Geometry=partition_2)  # -> Area, Centroid
pdecon_2 = Deconstruct(Point=area_4.Centroid)  # -> XComponent, YComponent, ZComponent
sort_2 = SortList(Keys=pdecon_2.ZComponent, ValuesA=partition_2)  # -> Keys, ValuesA

path_mapper_5 = PathMapper(sort.ValuesA, source="{A;B}", target="{A+100;B+100}")
panel_12 = Panel(path_mapper_5)
brep_stack_groupings = Brep([sort_2.ValuesA, path_mapper_5])

# ---- group: QA_groupings
concat_7 = Concatenate(FragmentA=Slider(2, range=1..8), FragmentC=":", FragmentB=Slider(11, range=0..100))
branch = TreeBranch(Tree=partition_2, Path=concat_7, MaintainPaths=True)
preview = CustomPreview(Geometry=branch, Material=ColourSwatch(SwatchColor=RGB(85, 145, 0)))

# ---- group: QA_tree_structure
brep_5 = Brep(brep_stack_groupings)
tstat_3 = TreeStatistics(Tree=brep_5)  # -> Paths, Length, Count
match = MatchTree(Tree=graft(tstat_3.Paths), Guide=brep_5)
area_5 = Area(Geometry=brep_5)  # -> Area, Centroid
dot = AnnotationDot(Location=area_5.Centroid, PrimaryText=match)  # -> AnnotationDot, Location, PrimaryText, TextHeight

# ---- group: QA_groupings
concat_8 = Concatenate(
    FragmentA=Slider(3, range=1..8),
    FragmentC=":",
    FragmentB=Slider(3, range=0..100),
    FragmentD=":",
    FragmentE=Slider(2, range=0..100))
branch_2 = TreeBranch(Tree=graft(brep_5), Path=concat_8, MaintainPaths=True)
preview_2 = CustomPreview(Geometry=branch_2, Material=ColourSwatch(SwatchColor=RGB(85, 145, 0)))

# ----
lng_3 = ListLength(List=brep_stack_groupings)
repeat = RepeatData(Data="0", Length=lng_3)  # -> simplify(Data)

# ---- group: BOOLEAN UNION OF BREP STACK GROUPINGS
fastsunion = FastSolidUnion(Breps=brep_stack_groupings, Tolerance=0.001, strictFastSolidUnion=True, trueIntFastSolidUnion=False)  # -> simplify(Result)
fmerge = MergeFaces(Brep=fastsunion)  # -> Breps, Before, After

# ----
item_5 = ListItem(List=dot.AnnotationDot, Index=0, Wrap=True)

# ---- group: QA_groupings_BOOLEAN_UNION
concat_9 = Concatenate(FragmentA=Slider(2, range=1..8), FragmentC=":", FragmentB=Slider(2, range=0..100))
branch_3 = TreeBranch(Tree=fmerge.Breps, Path=concat_9, MaintainPaths=True)
preview_3 = CustomPreview(Geometry=branch_3, Material=ColourSwatch(SwatchColor=RGB(255, 153, 0)))

# ---- group: SORT EXTERIOR/INTERIOR WALLS
# SORT SURFACES FROM SOLID UNION
# ISSUE!
# No saddle roofs ending in point
brep_fastsolidunion = Brep(fastsunion)
gate = StreamGate(Stream=brep_fastsolidunion, Gate=falsestart)  # -> Target0, Target1
path_mapper_6 = PathMapper(gate.Target1, source="{A;*}", target="{A}")
lng_4 = ListLength(List=path_mapper_6)
dup = DuplicateData(Data=path_mapper_6, Number=lng_4, Order=True)
partition_3 = PartitionList(List=dup, Size=lng_4)  # -> simplify(Chunks)
splitmul = SplitBrepMultiple(Brep=gate.Target1, Cutters=partition_3)  # -> simplify(Result)
area_6 = Area(Geometry=splitmul)  # -> Area, Centroid
sort_3 = SortList(Keys=area_6.Area, ValuesA=splitmul)  # -> Keys, reverse(ValuesA)
split = SplitList(List=sort_3.ValuesA, Index=1)  # -> ListA, simplify(ListB)

# ---- group: SORT OUTER WALLS FROM ROOFS
brep_exterior = Brep(split.ListA)
debrep = DeconstructBrep(Brep=brep_exterior)  # -> Faces, Edges, Vertices
evalsrf = EvaluateSurface(Surface=reparameterize(debrep.Faces), Point="0.5,0.5")  # -> Point, Normal, UDirection, VDirection, Frame
Z = UnitZ(Factor=1)
dprod = DotProduct(VectorA=evalsrf.Normal, VectorB=Z, Unitize=False)
equalst = EqualityWithinTolerance(FirstNumber=dprod, SecondNumber="0", Tolerance=equality_tolerance_for_z_prod_calculatio)  # -> Equality, Inequality
dispatch_2 = Dispatch(List=simplify(debrep.Faces), DispatchPattern=simplify(equalst.Equality))  # -> simplify(ListA), ListB

# ---- group: DECONSTRUCT BREPS TO SRFS AND EVALUATE NORMAL DIRECTION
srf_roofs_terrain_slabs_overhangs = Surface(simplify(dispatch_2.ListB))
evalsrf_2 = EvaluateSurface(Surface=reparameterize(srf_roofs_terrain_slabs_overhangs), Point="0.5,0.5")  # -> Point, Normal, UDirection, VDirection, Frame
Z_2 = UnitZ(Factor=1)
dprod_2 = DotProduct(VectorA=evalsrf_2.Normal, VectorB=Z_2, Unitize=False)

# ---- group: SORT INTERIOR WALLS FROM INTERIOR SLABS/OVERHANGS
brep_interior = Brep(split.ListB)
debrep_2 = DeconstructBrep(Brep=brep_interior)  # -> simplify(Faces), Edges, Vertices
evalsrf_3 = EvaluateSurface(Surface=reparameterize(debrep_2.Faces), Point="0.5,0.5")  # -> Point, Normal, UDirection, VDirection, Frame
Z_3 = UnitZ(Factor=1)
dprod_3 = DotProduct(VectorA=evalsrf_3.Normal, VectorB=Z_3, Unitize=False)
equalst_2 = EqualityWithinTolerance(FirstNumber=dprod_3, SecondNumber="0", Tolerance=equality_tolerance_for_z_prod_calculatio)  # -> Equality, Inequality
dispatch_3 = Dispatch(List=debrep_2.Faces, DispatchPattern=equalst_2.Equality)  # -> simplify(ListA), ListB

# ---- group: FIND PARTERRE BREPS AND SPLIT
# A. FIND & SORT
debrep_3 = DeconstructBrep(Brep=brep_stack_groupings)  # -> Faces, Edges, Vertices
evalsrf_4 = EvaluateSurface(Surface=reparameterize(debrep_3.Faces), Point="0.5,0.5")  # -> Point, Normal, UDirection, VDirection, Frame
Z_4 = UnitZ(Factor=1)
dprod_4 = DotProduct(VectorA=evalsrf_4.Normal, VectorB=Z_4, Unitize=False)
larger = LargerThan(FirstNumber=dprod_4, SecondNumber=min_incline_for_pitched_roof)  # -> LargerThan, OrEqualTo
dispatch_4 = Dispatch(List=debrep_3.Faces, DispatchPattern=larger.LargerThan)  # -> ListA, ListB
addition = Addition(A=generic_floor_slab_thickness, B=1.25)
Z_5 = UnitZ(Factor=addition)
srf = Surface(dispatch_4.ListA)
join = BrepJoin(Breps=srf)  # -> Breps, Closed
neg = Negative(Value=Z_5)
move = Move(Geometry=join.Breps, Motion=neg)  # -> simplify(Geometry), Transform
bbx = BrepBrep(BrepA=brep_terrain, BrepB=move.Geometry)  # -> simplify(Curves), Points
ext = ExtendCurve(Curve=bbx.Curves, Type=0, Start="1", End="1")
Z_6 = UnitZ(Factor="10")
extr = Extrude(Base=ext, Direction=Z_6)
move_2 = Move(Geometry=extr, Motion=expr("x*-.5", Z_6))  # -> Geometry, Transform
split_2 = SplitBrep(Brep=move.Geometry, Cutter=move_2.Geometry)  # -> simplify(Result)

# ---- group: FIND BASEMENT EXT WALL AREAS
# A. FIND & SORT
split_3 = SplitBrep(Brep=graft(dispatch_2.ListA), Cutter=brep_terrain)  # -> simplify(Result)
area_7 = Area(Geometry=split_3)  # -> Area, Centroid
Z_7 = UnitZ(Factor=1)
project_3 = ProjectPoint(Point=area_7.Centroid, Direction=Z_7, Geometry=brep_terrain)  # -> Point, Index
null_2 = NullItem(Item=project_3.Point)  # -> NullFlags, InvalidFlags, Description
dispatch_5 = Dispatch(List=split_3, DispatchPattern=null_2.NullFlags)  # -> ListA, ListB
path_mapper_7 = PathMapper(dispatch_5.ListB, source="{A;B;C}", target="{A;B}")
path_mapper_8 = PathMapper(dispatch_5.ListA, source="{A;B;C}", target="{A;B}")

# ---- group: FLOOR HEIGHT CALCULATION
# A. FIND & SORT
bbox = BoundingBox(Content=brep_stack_groupings, Plane=PlaneXY(0, 0, 0))  # -> Box, Box_2
debrep_4 = DeconstructBrep(Brep=bbox.Box)  # -> Faces, Edges, Vertices
evalsrf_5 = EvaluateSurface(Surface=reparameterize(debrep_4.Faces), Point="0.5,0.5")  # -> Point, Normal, UDirection, VDirection, Frame
Z_8 = UnitZ(Factor=1)
dprod_5 = DotProduct(VectorA=evalsrf_5.Normal, VectorB=Z_8, Unitize=False)
abs = Absolute(Value=dprod_5)
equals = Equality(FirstNumber=abs, SecondNumber="1")  # -> Equality, Inequality
dispatch_6 = Dispatch(List=evalsrf_5.Point, DispatchPattern=equals.Equality)  # -> simplify(ListA), ListB
pdecon_3 = Deconstruct(Point=dispatch_6.ListA)  # -> XComponent, YComponent, ZComponent
item_6 = ListItem(List=pdecon_3.ZComponent, Index=0, Wrap=True)  # -> Item, Item1
subtraction = Subtraction(A=item_6.Item1, B=item_6.Item)
path_mapper_9 = PathMapper(subtraction, source=["{A;B;C}", "{A;B}"], target=["{A;B}", "{A;B}"])
roundf = RoundToFactor(NumberX=path_mapper_9, Factor=".05", RoundType=0)  # -> Rounded, Difference, MultiplierR, MultiplierX

# ---- group: ATTRIBUTES PR GROUPING
# FLOOR RELATED DOCUMENT ATTRIBUTES
rhatt_3 = GetRhinoAttributes(Geometry=brep_stack_groupings, fullpath=False)  # -> Name, Layer, Color, MaterialName, SourceFile
split_4 = TextSplit(Text=rhatt_3.Layer, Separators="::")
item_7 = ListItem(List=split_4, Index=-1, Wrap=True)  # -> simplify(Item)
detatt = DetachAttributes(Geometry=brep_stack_groupings)  # -> Geometry, Attributes
getkv_2 = GetAllKeysValues(AttributesOrAttributedGeometry=detatt.Attributes)  # -> Keys, Values, BakeName
txt = Text(item_7)
ins = InsertItems(List=getkv_2.Keys, Item="Typology", Indices=0, Wrap=True)  # -> simplify(List)
ins_2 = InsertItems(List=getkv_2.Values, Item=txt, Indices=0, Wrap=True)  # -> simplify(List)
item_8 = ListItem(List=ins_2, Index=0, Wrap=True)  # -> Item, Item1, Item2, Item3, Item4, Item5, Item6
path_mapper_10 = PathMapper(item_8.Item6, source=["{A;B;C}", "{A;B}"], target=["{A;B}", "{A;B}"])
path_mapper_11 = PathMapper(item_8.Item, source=["{A;B;C}", "{A;B}"], target=["{A;B}", "{A;B}"])
path_mapper_12 = PathMapper(item_8.Item1, source=["{A;B;C}", "{A;B}"], target=["{A;B}", "{A;B}"])
path_mapper_13 = PathMapper(item_8.Item2, source=["{A;B;C}", "{A;B}"], target=["{A;B}", "{A;B}"])
path_mapper_14 = PathMapper(item_8.Item3, source=["{A;B;C}", "{A;B}"], target=["{A;B}", "{A;B}"])
path_mapper_15 = PathMapper(item_8.Item4, source=["{A;B;C}", "{A;B}"], target=["{A;B}", "{A;B}"])
path_mapper_16 = PathMapper(item_8.Item5, source=["{A;B;C}", "{A;B}"], target=["{A;B}", "{A;B}"])
preservation_strategy_pr_grouping = Number(path_mapper_14)
structural_material_pr_grouping = Number(path_mapper_15)
ambition_fractile_pr_grouping = Number(path_mapper_13)
energy_supply_pr_grouping = Number(path_mapper_16)
elevatoroverride_pr_grouping = Number(path_mapper_10)
build_year_pr_grouping = Text(path_mapper_12)
typology_pr_grouping = Text(path_mapper_11)

# ---- group: SORT INTERNAL FIREWALLS ACCORDING TO PROGRAM
# A. FIND & SORT
srf_inner_walls_fire_section_unsorted = Surface(dispatch_3.ListA)
path_mapper_17 = PathMapper(dispatch_3.ListA, source=["{A;B;C}", "{A;B}"], target=["{A;B}", "{A;B}"])
path_mapper_18 = PathMapper(srf_inner_walls_fire_section_unsorted, source=["{A;B;C}", "{A;B}"], target=["{A;B}", "{A;B}"])
area_8 = Area(Geometry=path_mapper_17)  # -> Area, Centroid
brepsinc = PointInBreps(Brep=brep_stack_groupings, Point=area_8.Centroid, Strict=False)  # -> Inside, Index
graftbydata = GraftByData(InputData=path_mapper_18, PathsToAssign=brepsinc.Index)

# ---- group: DECONSTRUCT BREPS TO SRFS AND EVALUATE NORMAL DIRECTION
debrep_5 = DeconstructBrep(Brep=fmerge.Breps)  # -> Faces, Edges, Vertices
evalsrf_6 = EvaluateSurface(Surface=reparameterize(debrep_5.Faces), Point="0.5,0.5")  # -> Point, Normal, UDirection, VDirection, Frame
Z_9 = UnitZ(Factor=1)
dprod_6 = DotProduct(VectorA=evalsrf_6.Normal, VectorB=Z_9, Unitize=False)

# ---- group: FIND FLOOR SLABS
# A. FIND & SORT
debrep_6 = DeconstructBrep(Brep=brep_stack_groupings)  # -> Faces, Edges, Vertices
path_mapper_19 = PathMapper(debrep_6.Faces, source="{A;B;*}", target="{A;B}")
evalsrf_7 = EvaluateSurface(Surface=reparameterize(path_mapper_19), Point="0.5,0.5")  # -> Point, Normal, UDirection, VDirection, Frame
Z_10 = UnitZ(Factor=1)
dprod_7 = DotProduct(VectorA=evalsrf_7.Normal, VectorB=Z_10, Unitize=False)
equalst_3 = EqualityWithinTolerance(FirstNumber=dprod_6, SecondNumber="0", Tolerance=equality_tolerance_for_z_prod_calculatio)  # -> Equality, Inequality
dispatch_7 = Dispatch(List=debrep_5.Faces, DispatchPattern=equalst_3.Equality)  # -> ListA, ListB
equalst_4 = EqualityWithinTolerance(FirstNumber=dprod_7, SecondNumber="1", Tolerance=equality_tolerance_for_z_prod_calculatio)  # -> Equality, Inequality
srf_2 = Surface(simplify(dispatch_7.ListA))
dispatch_8 = Dispatch(List=path_mapper_19, DispatchPattern=equalst_4.Equality)  # -> ListA, ListB
join_2 = BrepJoin(Breps=srf_2)  # -> Breps, Closed
srf_3 = Surface(dispatch_8.ListA)
split_5 = SplitBrep(Brep=srf_3, Cutter=join_2.Breps)
path_mapper_20 = PathMapper(split_5, source="{A;B;*}", target="{A;B}")
area_9 = Area(Geometry=path_mapper_20)  # -> Area, Centroid
Z_11 = UnitZ(Factor=1)
pt = Point(area_9.Centroid)
move_3 = Move(Geometry=pt, Motion=Z_11)  # -> Geometry, Transform
brepinc = PointInBrep(Brep=fmerge.Breps, Point=move_3.Geometry, Strict=True)
dispatch_9 = Dispatch(List=path_mapper_20, DispatchPattern=brepinc)  # -> ListA, ListB

# ---- group: SORT ADDITIONAL SLAB/ROOFS
path_mapper_21 = PathMapper(dispatch_3.ListB, source=["{A;B;C;D}", "{A;B;C}"], target=["{A;B}", "{A;B}"])
srf_4 = Surface(path_mapper_21)
area_10 = Area(Geometry=srf_4)  # -> Area, Centroid
larger_2 = LargerThan(FirstNumber=area_10.Area, SecondNumber="1")  # -> LargerThan, OrEqualTo
dispatch_10 = Dispatch(List=srf_4, DispatchPattern=larger_2.LargerThan)  # -> ListA, ListB
evalsrf_8 = EvaluateSurface(Surface=reparameterize(dispatch_10.ListA), Point="0.5,0.5")  # -> Point, Normal, UDirection, VDirection, Frame
Z_12 = UnitZ(Factor=1)
dprod_8 = DotProduct(VectorA=evalsrf_8.Normal, VectorB=Z_12, Unitize=False)
abs_2 = Absolute(Value=dprod_8)
equals_2 = Equality(FirstNumber=abs_2, SecondNumber="1")  # -> Equality, Inequality
dispatch_11 = Dispatch(List=dispatch_10.ListA, DispatchPattern=equals_2.Equality)  # -> ListA, ListB
srf_floor_slabs_additional = Surface(dispatch_11.ListA)
srf_roofs_additional = Surface(dispatch_11.ListB)

# ---- group: FIND FOUNDATION OUTLINES
item_9 = ListItem(List=brep_stack_groupings, Index=0, Wrap=True)
debrep_7 = DeconstructBrep(Brep=item_9)  # -> Faces, Edges, Vertices
evalsrf_9 = EvaluateSurface(Surface=reparameterize(debrep_7.Faces), Point="0.5,0.5")  # -> Point, Normal, UDirection, VDirection, Frame
Z_13 = UnitZ(Factor=1)
dprod_9 = DotProduct(VectorA=evalsrf_9.Normal, VectorB=Z_13, Unitize=False)
int = Integer(dprod_9)
equals_3 = Equality(FirstNumber=int, SecondNumber="-1")  # -> Equality, Inequality
dispatch_12 = Dispatch(List=debrep_7.Faces, DispatchPattern=equals_3.Equality)  # -> ListA, ListB
srf_5 = Surface(dispatch_12.ListA)
wires = BrepWireframe(Brep=srf_5, Density=-1)
join_3 = JoinCurves(Curves=wires, Preserve=False)  # -> simplify(Curves)

# ---- group: FIND ALL FLOOR SLABS
debrep_8 = DeconstructBrep(Brep=brep_stack_groupings)  # -> Faces, Edges, Vertices
evalsrf_10 = EvaluateSurface(Surface=reparameterize(debrep_8.Faces), Point="0.5,0.5")  # -> Point, Normal, UDirection, VDirection, Frame
Z_14 = UnitZ(Factor=1)
dprod_10 = DotProduct(VectorA=evalsrf_10.Normal, VectorB=Z_14, Unitize=False)
equalst_5 = EqualityWithinTolerance(FirstNumber=dprod_10, SecondNumber="-1", Tolerance=0.001)  # -> Equality, Inequality
dispatch_13 = Dispatch(List=debrep_8.Faces, DispatchPattern=equalst_5.Equality)  # -> ListA, ListB

# ---- group: REPLACE UNKNOWN TYPOLGIES
panel_13 = Panel("""Etagebolig
Rækkehus""")
mindex = MemberIndex(Set=typology_pr_grouping, Member="Boligdepot")  # -> simplify(Index), Count
mindex_2 = MemberIndex(Set=typology_pr_grouping, Member=panel_13)  # -> Index, Count
path_mapper_22 = PathMapper(mindex_2.Index, source="{A;B;C}", target="{A;B}")
item_10 = ListItem(List=path_mapper_22, Index=0, Wrap=True)
item_11 = ListItem(List=item_10, Index=mindex.Index, Wrap=True)
item_12 = ListItem(List=typology_pr_grouping, Index=item_11, Wrap=True)
replace = ReplaceItems(List=typology_pr_grouping, Item=item_12, Indices=mindex.Index, Wrap=False)

# ---- group: FIND ROOFS AND SORT INTO FLAT AND PITCHED
larger_3 = LargerThan(FirstNumber=dprod_2, SecondNumber=max_incline_for_pitched_roof)  # -> LargerThan, OrEqualTo
smaller = SmallerThan(FirstNumber=dprod_2, SecondNumber=max_incline_for_pitched_roof)  # -> SmallerThan, OrEqualTo
larger_4 = LargerThan(FirstNumber=dprod_2, SecondNumber=min_incline_for_pitched_roof)  # -> LargerThan, OrEqualTo
and = GateAnd(A=smaller.SmallerThan, B=larger_4.LargerThan)
dispatch_14 = Dispatch(List=srf_roofs_terrain_slabs_overhangs, DispatchPattern=and)  # -> ListA, ListB
dispatch_15 = Dispatch(List=srf_roofs_terrain_slabs_overhangs, DispatchPattern=larger_3.LargerThan)  # -> ListA, ListB

# ----
# B. SORTED GEOMETRY
larger_5 = LargerThan(FirstNumber=elevatoroverride_pr_grouping, SecondNumber=0)  # -> LargerThan, OrEqualTo
lng_5 = ListLength(List=roundf.Rounded)
dispatch_16 = Dispatch(List=elevatoroverride_pr_grouping, DispatchPattern=larger_5.OrEqualTo)  # -> ListA, ListB
larger_6 = LargerThan(FirstNumber=lng_5, SecondNumber=elevator_i_bygninger_over_x_antal_etager)  # -> LargerThan, OrEqualTo
dispatch_17 = Dispatch(List=roundf.Rounded, DispatchPattern=larger_6.LargerThan)  # -> ListA, ListB
lng_6 = ListLength(List=dispatch_17.ListB)
lng_7 = ListLength(List=dispatch_17.ListA)
series = Series(Start=0, Step=1, Count=lng_7)
series_2 = Series(Start=0, Step=1, Count=lng_6)
replace_2 = ReplaceItems(List=dispatch_17.ListA, Item=1, Indices=series, Wrap=False)  # -> simplify(List)
replace_3 = ReplaceItems(List=dispatch_17.ListB, Item=0, Indices=series_2, Wrap=False)  # -> simplify(List)
merge_3 = Merge(Data1=replace_2, Data2=replace_3)
merge_4 = Merge(Data1=dispatch_17.ListA, Data2=replace_3)
dispatch_18 = Dispatch(List=merge_3, DispatchPattern=larger_5.OrEqualTo)  # -> ListA, ListB
merge_5 = Merge(Data1=dispatch_16.ListA, Data2=dispatch_18.ListB)
multiplication = Multiplication(A=merge_4, B=merge_5)
roundf_2 = RoundToFactor(NumberX=multiplication, Factor="0.1", RoundType=0)  # -> Rounded, Difference, MultiplierR, MultiplierX

lng_8 = ListLength(List=roundf.Rounded)
larger_7 = LargerThan(FirstNumber=lng_8, SecondNumber=trapper_i_bygninger_over_x_antal_etager)  # -> LargerThan, OrEqualTo
dispatch_19 = Dispatch(List=roundf.Rounded, DispatchPattern=larger_7.LargerThan)  # -> ListA, ListB
lng_9 = ListLength(List=dispatch_19.ListB)
series_3 = Series(Start=0, Step=1, Count=lng_9)
replace_4 = ReplaceItems(List=dispatch_19.ListB, Item=0, Indices=series_3, Wrap=False)  # -> simplify(List)
merge_6 = Merge(Data1=dispatch_19.ListA, Data2=replace_4)
replace_5 = ReplaceItems(List=merge_6, Item=0, Indices=expr("x-1", lng_8), Wrap=False)  # -> simplify(List)
expression = Expression(x=replace_5, Expression="(x/0.175)*0.28")
roundf_3 = RoundToFactor(NumberX=expression, Factor="0.1", RoundType=0)  # -> Rounded, Difference, MultiplierR, MultiplierX

# ----
# C. CALCULATE QUANTITIES
lng_10 = ListLength(List=roundf.Rounded)
larger_8 = LargerThan(FirstNumber=lng_10, SecondNumber=kerne_i_bygninger_over_x_antal_etager)  # -> LargerThan, OrEqualTo
dispatch_20 = Dispatch(List=roundf.Rounded, DispatchPattern=larger_8.LargerThan)  # -> ListA, ListB
lng_11 = ListLength(List=dispatch_20.ListB)
series_4 = Series(Start=0, Step=1, Count=lng_11)
replace_6 = ReplaceItems(List=dispatch_20.ListB, Item=0, Indices=series_4, Wrap=False)  # -> simplify(List)
merge_7 = Merge(Data1=dispatch_20.ListA, Data2=replace_6)
roundf_4 = RoundToFactor(NumberX=merge_7, Factor="0.1", RoundType=0)  # -> Rounded, Difference, MultiplierR, MultiplierX

# ---- group: STAIRCASE COUNT PER BREP GROUPING
lng_12 = ListLength(List=brep_stack_groupings)
equals_4 = Equality(FirstNumber=lng_12, SecondNumber=1)  # -> Equality, Inequality
dispatch_21 = Dispatch(List=lng_12, DispatchPattern=equals_4.Equality)  # -> ListA, ListB
lng_13 = ListLength(List=dispatch_21.ListB)

# ----
# CORE RELATED QUANTITIES
numberofelevators = Integer(merge_5)
staircase_count = Integer(lng_13)
elevatormeters = Number(roundf_2.Rounded)
stairmeters = Number(roundf_3.Rounded)
# D. QUANTITIES
coremeters = Number(roundf_4.Rounded)

# ---- group: BUILDING ATTRIBUTES OVERRIDES
ambition_level_override = ValueList({"Very Ambitious (top 10 %)": 0.1, "Ambitious (Top 30%)": 0.3, "Mean (Top 50%)": 0.5, "Conventional (Top 70%)": 0.7, "Poor (Top 90%)": 0.9}, selected="Very Ambitious (top 10 %)")
calculation_basis = ValueList({"GLOBAL OVERRIDE": 0, "INDIVIDUAL GROUPINGS": 1}, selected="INDIVIDUAL GROUPINGS")
calculation_basis_2 = ValueList({"GLOBAL OVERRIDE": 0, "INDIVIDUAL GROUPINGS": 1}, selected="INDIVIDUAL GROUPINGS")
calculation_basis_3 = ValueList({"GLOBAL OVERRIDE": 0, "INDIVIDUAL GROUPINGS": 1}, selected="INDIVIDUAL GROUPINGS")
calculation_basis_4 = ValueList({"GLOBAL OVERRIDE": 0, "INDIVIDUAL GROUPINGS": 1}, selected="INDIVIDUAL GROUPINGS")
calculation_basis_5 = ValueList({"GLOBAL OVERRIDE": 0, "INDIVIDUAL GROUPINGS": 1}, selected="INDIVIDUAL GROUPINGS")
# @PIL
# Lige nu er taghældning et vægtet gennemsnit inkl. tagterrasser.
# Dvs. der er en skævvridning ift. en ren kalkulation baseret på den øverste etage alene.
calculation_basis_6 = ValueList({"GLOBAL OVERRIDE": 0, "INDIVIDUAL GROUPINGS": 1}, selected="INDIVIDUAL GROUPINGS")
structural_material = ValueList({"Non-defined": 0, "ConcreteBearingWalls": 1, "ConcreteBeamsColumns": 2, "Hybrid": 3, "WoodBearingWalls": 4, "WoodBEamsColumns": 5}, selected="ConcreteBearingWalls")
building_typology_override = ValueList({"Enfamiliehus", "Rækkehus", "Etagebolig", "Kontor", "Undervisning", "Dagsinstitution", "Butik", "Parkering", "Industri", "Transport", "Hotel", "Sundhedshuse"}, selected="Kontor")
# QA COMPELTE
heating_system = ValueList({"Fjernvarme": 0, "El": 1}, selected="Fjernvarme")
year_of_operation = Panel("2028")
list_3 = ValueList({"New Build": 0, "Transformation": 1, "Renovation": 2, "Refurbished": 3, "Preserved": 4, "Demolished": 5}, selected="New Build")
filter_typology = StreamFilter(Gate=calculation_basis, Stream0=building_typology_override, Stream1=replace)
filter_build_year = StreamFilter(Gate=calculation_basis_2, Stream0=year_of_operation, Stream1=build_year_pr_grouping)
filter_ambition = StreamFilter(Gate=calculation_basis_3, Stream0=ambition_level_override, Stream1=ambition_fractile_pr_grouping)
filter_preservation = StreamFilter(Gate=calculation_basis_4, Stream0=list_3, Stream1=preservation_strategy_pr_grouping)
filter_structure = StreamFilter(Gate=calculation_basis_5, Stream0=structural_material, Stream1=structural_material_pr_grouping)
filter_energy = StreamFilter(Gate=calculation_basis_6, Stream0=heating_system, Stream1=energy_supply_pr_grouping)

# ----
# @PIL
# Skæring ift. parterre
# @PIL
# Alle etager inkl. kælder
# QA COMPELTE
# @PIL
# Alle etager inkl. kælder
# QA COMPELTE
# @PIL
# Tjek hvor vinkel måles fra
# QA COMPELTE
lng_14 = ListLength(List=brep_stack_groupings)
dem_repath = Python3Script(T=simplify(filter_typology))  # -> out, R, Rewritten; inputs T: tree
# ---------- dem_repath: Python ----------
import Grasshopper as gh
from Grasshopper.Kernel.Data import GH_Path

# --- outputs ---
R = gh.DataTree[object]()
Rewritten = []  # list of rewritten path strings


# Helper: convert GH_Path → "{a;b}"
def path_to_str(path):
    return "{" + ";".join(str(path[i]) for i in range(path.Length)) + "}"


# --- Step 1: Find max B for all normal branches (A <= 99) ---
max_b = {}

for p in T.Paths:
    if p.Length < 2:
        continue

    A = p[0]
    B = p[1]

    if A <= 99:
        max_b[A] = max(B, max_b.get(A, -1))


# --- Step 2: Copy all normal branches unchanged ---
for p in T.Paths:
    if p.Length < 2:
        continue

    A = p[0]

    if A <= 99:
        R.AddRange(list(T.Branch(p)), p)


# --- Step 3: Collect high-A branches grouped by targetA ---
high_by_target = {}

for p in T.Paths:
    if p.Length < 2:
        continue

    A = p[0]
    B = p[1]

    if A > 99:
        targetA = A - 100
        high_by_target.setdefault(targetA, []).append((B, p))


# --- Step 4: Rewrite them sequentially ---
for targetA, entries in high_by_target.items():

    # sort by original B for stable numbering
    entries.sort(key=lambda x: x[0])

    next_b = max_b.get(targetA, -1) + 1

    for _, old_path in entries:

        new_path = GH_Path(targetA, next_b)

        # Add branch contents to new location
        R.AddRange(list(T.Branch(old_path)), new_path)

        # Store rewritten path string
        Rewritten.append(path_to_str(new_path))

        next_b += 1
# ---------- end dem_repath ----------
dem_repath_2 = Python3Script(T=simplify(filter_build_year))  # -> out, R; inputs T: tree
# ---------- dem_repath_2: Python ----------
"""
Grasshopper (Rhino 8) Python 3 script
Repath rule:
- If first path index A > 99: map to (A-100)
- Rewrite second index B so it continues after the current max B in the target (A-100) branch.
Example: {102;100} -> {2;14} if {2;0}..{2;13} already exist.

Input:
  T : DataTree (any type)
Output:
  R : DataTree (same type)
"""

import Grasshopper as gh
from Grasshopper.Kernel.Data import GH_Path

# --- output tree ---
R = gh.DataTree[object]()

# --- collect current max B per "normal" A (A <= 99) ---
max_b = {}  # {A: maxB}
for p in T.Paths:
    if p.Length < 2:
        continue
    A = p[0]
    B = p[1]
    if A <= 99:
        max_b[A] = max(B, max_b.get(A, -1))

# --- add all "normal" branches unchanged ---
for p in T.Paths:
    if p.Length < 2:
        # passthrough for odd paths
        R.AddRange(list(T.Branch(p)), p)
        continue

    A = p[0]
    if A <= 99:
        R.AddRange(list(T.Branch(p)), p)

# --- repath "high-A" branches, assigning new B sequentially per target A ---
# Group high paths by targetA, and sort by original B for predictable numbering
high_by_target = {}  # {targetA: [(origB, path), ...]}
for p in T.Paths:
    if p.Length < 2:
        continue
    A = p[0]
    B = p[1]
    if A > 99:
        targetA = A - 100
        high_by_target.setdefault(targetA, []).append((B, p))

for targetA, entries in high_by_target.items():
    entries.sort(key=lambda x: x[0])  # sort by original B

    next_b = max_b.get(targetA, -1) + 1
    for _, p in entries:
        new_path = GH_Path(targetA, next_b)
        R.AddRange(list(T.Branch(p)), new_path)
        next_b += 1

# done
# ---------- end dem_repath_2 ----------
dem_repath_3 = Python3Script(T=simplify(filter_ambition))  # -> out, R; inputs T: tree; same code as dem_repath_2
dem_repath_4 = Python3Script(T=simplify(filter_preservation))  # -> out, R; inputs T: tree; same code as dem_repath_2
dem_repath_5 = Python3Script(T=simplify(filter_structure))  # -> out, R; inputs T: tree; same code as dem_repath_2
dem_repath_6 = Python3Script(T=simplify(filter_energy))  # -> out, R; inputs T: tree; same code as dem_repath_2
# QA COMPELTE
dem_repath_7 = Python3Script(T=simplify(coremeters))  # -> out, R; inputs T: tree; same code as dem_repath_2
# QA COMPELTE
dem_repath_8 = Python3Script(T=simplify(stairmeters))  # -> out, R; inputs T: tree; same code as dem_repath_2
# @PIL
# Der udregnes ikke StairMeters for den øverste etage.
# QA COMPELTE
dem_repath_9 = Python3Script(T=simplify(elevatormeters))  # -> out, R; inputs T: tree; same code as dem_repath_2
dem_repath_10 = Python3Script(T=simplify(numberofelevators))  # -> out, R; inputs T: tree; same code as dem_repath_2
panel_14 = Panel(dem_repath.Rewritten)

# ----
# ATTRIBUTES
preservation_strategy = Number(dem_repath_4.R)
structural_material_2 = Number(dem_repath_5.R)
ambition_fractile = Number(dem_repath_3.R)
energy_supply = Number(dem_repath_6.R)
typology = Text(dem_repath.R)
build_year = Text(dem_repath_2.R)

# ---- group: DATA EXTRACT
typology_floor_grouping = Panel(typology_pr_grouping)
typology_floor_grouping_replaced = Panel(typology)
# QA COMPELTE
build_year_2 = Panel(build_year_pr_grouping)
ambition_level_att = Panel(ambition_fractile_pr_grouping)
preservation_strategy_att = Panel(preservation_strategy_pr_grouping)
structural_material_att = Panel(structural_material_pr_grouping)
energy_supply_type_att = Panel(energy_supply_pr_grouping)

# ----
ins_3 = InsertItems(List="AreaGroundSlabBasement", Item="BRANCH", Indices=0, Wrap=True)
ins_4 = InsertItems(List="NumberOfElevators", Item="BRANCH", Indices=0, Wrap=True)
brep_6 = Brep(graft(brep_stack_groupings))
panel_15 = Panel("""Branch: {0}
Test: {1}""")
tstat_4 = TreeStatistics(Tree=brep_6)  # -> Paths, Length, Count
area_11 = Area(Geometry=brep_6)  # -> Area, Centroid
panel_16 = Panel(filepath_excel_lcakeys)
match_2 = MatchTree(Tree=graft(tstat_4.Paths), Guide=brep_6)
ins_5 = InsertItems(List=ins, Item="BRANCH", Indices=0, Wrap=True)
ins_6 = InsertItems(List=ins_2, Item=match_2, Indices=0, Wrap=True)
excelread = ExcelReader(ReadExcelData=falsestart_2, WorkbookPath=filepath_excel_lcakeys, WorksheetName="KE_Structural", DataStruct=False)  # -> Exceptions, ColumnHeaderNames, ExcelData
excelread_2 = ExcelReader(
    ReadExcelData=falsestart_2,
    WorkbookPath=filepath_excel_lcakeys,
    WorksheetName="KQ_StructuralRegressionF",
    DataStruct=False)  # -> Exceptions, ColumnHeaderNames, ExcelData
excelread_3 = ExcelReader(
    ReadExcelData=falsestart_2,
    WorkbookPath=filepath_excel_lcakeys,
    WorksheetName="KQ_StructuralRegressionY",
    DataStruct=False)  # -> Exceptions, ColumnHeaderNames, ExcelData
excelread_4 = ExcelReader(ReadExcelData=falsestart_2, WorkbookPath=filepath_excel_lcakeys, WorksheetName="KQ_all", DataStruct=False)  # -> Exceptions, ColumnHeaderNames, ExcelData

format_2 = Format(Format="{0}: {1}", Culture=127, Data0=ins_5, Data1=ins_6)  # -> simplify(Text)
panel_17 = Panel(format_2)

excelread_5 = ExcelReader(ReadExcelData=falsestart_2, WorkbookPath=filepath_excel_lcakeys, WorksheetName="KE_all", DataStruct=False)  # -> Exceptions, ColumnHeaderNames, ExcelData
excelread_6 = ExcelReader(ReadExcelData=falsestart_2, WorkbookPath=filepath_excel_lcakeys, WorksheetName="KE_Energy", DataStruct=False)  # -> Exceptions, ColumnHeaderNames, ExcelData
excelread_7 = ExcelReader(ReadExcelData=falsestart_2, WorkbookPath=filepath_excel_lcakeys, WorksheetName="Preservation", DataStruct=False)  # -> Exceptions, ColumnHeaderNames, ExcelData
equals_5 = Equality()  # -> Equality, Inequality
# X. LCA CALCULATION
lca_consideration_period_year = Panel("50")
# TO DO
# Scenarier
# LCA - views
# - pr opgang?
# - pr matrikel?
panel_18 = Panel("nye emissionsfaktorer 2025")
buildingtypologytranslatehelper = CSharpScript(TypologyNamesInModel=typology)  # -> BuildingTypologiesForLCAVolume; inputs TypologyNamesInModel: String, SingleFamilyHouse: list of String, TerracedHouse: list of String, MultiStoreyResidential: list of String, Office: list of String, Education: list of String, Daycare: list of String, Shopping: list of String, Parking: list of String, Industrial: list of String, Transport: list of String, Hotel: list of String, Hospital: list of String
# ---------- buildingtypologytranslatehelper: C# ----------
//This script translates building typology strings into those applied by LCA Volume. 
//Developed by Pil Brix Purup.

// Grasshopper Script Instance
#region Usings
using System;
using System.Linq;
using System.Collections;
using System.Collections.Generic;
using System.Drawing;

using Rhino;
using Rhino.Geometry;

using Grasshopper;
using Grasshopper.Kernel;
using Grasshopper.Kernel.Data;
using Grasshopper.Kernel.Types;
#endregion

public class Script_Instance : GH_ScriptInstance
{
    #region Notes
    /* 
      Members:
        RhinoDoc RhinoDocument
        GH_Document GrasshopperDocument
        IGH_Component Component
        int Iteration

      Methods (Virtual & overridable):
        Print(string text)
        Print(string format, params object[] args)
        Reflect(object obj)
        Reflect(object obj, string method_name)
    */
    #endregion

    private void RunScript(
		string TypologyNamesInModel,
		List<string> SingleFamilyHouse,
		List<string> TerracedHouse,
		List<string> MultiStoreyResidential,
		List<string> Office,
		List<string> Education,
		List<string> Daycare,
		List<string> Shopping,
		List<string> Parking,
		List<string> Industrial,
		List<string> Transport,
		List<string> Hotel,
		List<string> Hospital,
		ref object BuildingTypologiesForLCAVolume)
    {       
               
        // Defining objects:
        string TranslatedList = "";
        string input=TypologyNamesInModel;

        //Defalut values in Danish:
        if(SingleFamilyHouse==null){SingleFamilyHouse = new List<string>(){"Enfamiliehus"};}
        if(TerracedHouse==null){TerracedHouse = new List<string>(){"Rækkehus"};}
        if(MultiStoreyResidential==null){MultiStoreyResidential = new List<string>(){"Etagebolig"};}
        if(Office==null){Office = new List<string>(){"Kontor"};}
        if(Education==null){Education = new List<string>(){"Undervisning"};}
        if(Daycare==null){Daycare = new List<string>(){"Daginstitution"};}
        if(Shopping==null){Shopping = new List<string>(){"Butik"};}
        if(Parking==null){Parking = new List<string>(){"Parkering"};}
        if(Industrial==null){Industrial = new List<string>(){"Industri"};}
        if(Transport==null){Transport = new List<string>(){"Transport"};}
        if(Hotel==null){Hotel = new List<string>(){"Hotel"};}
        if(Hospital==null){Hospital = new List<string>(){"Sundhedshuse"};}

        //Translating        
        if (SingleFamilyHouse.Contains(input)){TranslatedList="SingleFamilyHouse";}
        if (TerracedHouse.Contains(input)){TranslatedList="TerracedHouse";}
        if (MultiStoreyResidential.Contains(input)){TranslatedList="MultiStoreyResidential";}
        if (Office.Contains(input)){TranslatedList="Office";}
        if (Education.Contains(input)){TranslatedList="Education";}
        if (Daycare.Contains(input)){TranslatedList="Daycare";}
        if (Shopping.Contains(input)){TranslatedList="Shopping";}
        if (Parking.Contains(input)){TranslatedList="Parking";}
        if (Industrial.Contains(input)){TranslatedList="Industrial";}
        if (Transport.Contains(input)){TranslatedList="Transport";}
        if (Hotel.Contains(input)){TranslatedList="Hotel";}
        if (Hospital.Contains(input)){TranslatedList="Hospital";}

        
        BuildingTypologiesForLCAVolume=TranslatedList;


    }
}
# ---------- end buildingtypologytranslatehelper ----------
join_4 = TextJoin(Text=format_2)
brep_groupings = Brep(brep_stack_groupings)
dem_repath_11 = Python3Script(T=simplify(brep_groupings))  # -> out, R, Rewritten; inputs T: tree; same code as dem_repath
brep_7 = Brep(dem_repath_11.R)
tstat_5 = TreeStatistics(Tree=brep_7)  # -> Paths, Length, Count
area_12 = Area(Geometry=brep_7)  # -> Area, Centroid
item_13 = ListItem(List=area_12.Centroid, Index=0, Wrap=True)
match_3 = MatchTree(Tree=graft(tstat_5.Paths), Guide=brep_7)
volume = Volume(Geometry=dem_repath_11.R)  # -> Volume, Centroid
item_14 = ListItem(List=volume.Centroid, Index=0, Wrap=True)
split_6 = SplitTree(Data=dem_repath_11.R, Masks=flatten(dem_repath_11.Rewritten))  # -> Positive, Negative
brep_8 = Brep(split_6.Positive)
brep_9 = Brep(split_6.Negative)
path_mapper_23 = PathMapper(brep_9, source="{A;B}", target="{A}")
list_4 = ValueList({"Bygningsreglmentet BR18 (12,0 kgCO2/m²)": 12.0, "Bygningsreglmentet BR25 pejlemærke etagebolig, mm.(6,8 kgCO2/m²)": 6.8, "Bygningsreglmentet BR25 pejlemærke skoler, mm.(7,2 kgCO2/m²)": 7.2, "Reduction Roadmap 2025 (5,8 kgCO2/m²)": 5.8, "Reduction Roadmap 2026 (4,7 kgCO2/m²)": 4.7, "Reduction Roadmap 2027 (3,6 kgCO2/m²)": 3.6, "Reduction Roadmap 2028 (2,5 kgCO2/m²)": 2.5, "Reduction Roadmap 2029 (1,4 kgCO2/m²)": 1.4, "Reduction Roadmap 2030 (0,3 kgCO2/m²)": 0.3}, selected="Reduction Roadmap 2030 (0,3 kgCO2/m²)")
list_5 = ValueList({"Bygningsreglmentet BR18 (12,0 kgCO2/m²)": 12.0, "Bygningsreglmentet BR25 pejlemærke etagebolig, mm.(6,8 kgCO2/m²)": 6.8, "Bygningsreglmentet BR25 pejlemærke skoler, mm.(7,2 kgCO2/m²)": 7.2, "Reduction Roadmap 2025 (5,8 kgCO2/m²)": 5.8, "Reduction Roadmap 2026 (4,7 kgCO2/m²)": 4.7, "Reduction Roadmap 2027 (3,6 kgCO2/m²)": 3.6, "Reduction Roadmap 2028 (2,5 kgCO2/m²)": 2.5, "Reduction Roadmap 2029 (1,4 kgCO2/m²)": 1.4, "Reduction Roadmap 2030 (0,3 kgCO2/m²)": 0.3}, selected="Bygningsreglmentet BR18 (12,0 kgCO2/m²)")
dot_2 = AnnotationDot(Location=area_11.Centroid, PrimaryText=graft(join_4))  # -> AnnotationDot, Location, PrimaryText, TextHeight
panel_19 = Panel(join_4)
volume_2 = Volume(Geometry=brep_9)  # -> Volume, Centroid
volume_3 = Volume(Geometry=path_mapper_23)  # -> Volume, Centroid
group = Group(Geometry=flatten(dot_2.AnnotationDot))
avr = Average(Input=volume_3.Centroid)
avr_2 = Average(Input=volume_2.Centroid)
filter = StreamFilter(Gate=preview_lca_estimate, Stream0=volume_2.Centroid, Stream1=avr_2, Stream2=avr)
split_7 = SplitTree(Data=filter, Masks=flatten(dem_repath_11.Rewritten))  # -> Positive, Negative
split_8 = SplitTree(Data=energy_supply, Masks=flatten(dem_repath_11.Rewritten))  # -> Positive, Negative
split_9 = SplitTree(Data=structural_material_2, Masks=flatten(dem_repath_11.Rewritten))  # -> Positive, Negative
split_10 = SplitTree(Data=ambition_fractile, Masks=flatten(dem_repath_11.Rewritten))  # -> Positive, Negative
split_11 = SplitTree(Data=preservation_strategy, Masks=flatten(dem_repath_11.Rewritten))  # -> Positive, Negative
pt_dots_preview = Point(split_7.Negative)
ambition_level_read_me = Panel("""0.9 | laveste 10% (meget unambitiøs)
0.8 | laveste 20%
0.7 | laveste 30% (konventionel)
0.6 | laveste 40%
0.5 | 50% (default)
0.4 | top 40%
0.3 | top 30% (ambitiøs)
0.2 | top 20%
0.1 | top 10% (meget ambitiøs)""")
energy_supply_read_me = Panel("""0 | Fjernvarme
1 | Elvarme
2 | Uopvarmet""")
structural_material_read_me = Panel("""0 | Ikke-defineret (default)
1 | Bærende betonvægge
2 | Bærende betonsøjler
3 | Hybridkonstruktion
4 | Bærende trævægge
5 | Bærende træsøjler""")
preservation_strategy_read_me = Panel("""0 | New Build (default)
1 | Transformation
2 | Renovation
3 | Refurbishment
4 | Preservation
5 | Demolition""")
# VISUALIZE!!!
# SAMLET LCA/M2 PR OPGANG
# BRUGER INPUT FRAKTIL
panel_20 = Panel("{0:0.0} GWP")

# ---- group: PREVIEW TERRAIN
swatch = ColourSwatch(SwatchColor=RGBA(191, 191, 191, 80))
preview_4 = CustomPreview(Geometry=brep_terrain, Material=swatch)

# ---- group: ENERGY SUPPLY
energy_supply_colour_scheme = Energy_supply_colour_scheme(t=split_8.Negative)
preview_5 = CustomPreview(Geometry=brep_9, Material=energy_supply_colour_scheme)

# ---- group: AMBITION
# AMBITION PREVIEW
ambition_colour_scheme = Ambition_colour_scheme(t=split_10.Negative)
preview_6 = CustomPreview(Geometry=brep_9, Material=ambition_colour_scheme)

# ---- group: STRUCTURAL MATERIAL
strucutral_material_colour_scheme = Strucutral_material_colour_scheme(t=split_9.Negative)
preview_7 = CustomPreview(Geometry=brep_9, Material=strucutral_material_colour_scheme)

# ---- group: PRESERVATION STRATEGY
preservation_colour_scheme = Preservation_colour_scheme(t=split_11.Negative)
preview_8 = CustomPreview(Geometry=brep_9, Material=preservation_colour_scheme)

# ----
x_location = Slider(0.05, range=0..1)
y_location = Slider(0.1, range=0..1)
size_scale = Slider(24, range=0..100)
panel_21 = Panel("""9
6
6
3""")
preview_quantities_2 = Panel("""PREVIEW ROOFS
PREVIEW FACADES
PREVIEW FLOOR SLABS
PREVIEW GROUND FLOOR SLABS
PREVIEW BASEMENT GROUND FLOOR SLABS
PREVIEW TERRAIN""")
filter_2 = StreamFilter(
    Gate=preview_strategies,
    Stream0=split_10.Negative,
    Stream1=split_11.Negative,
    Stream2=split_9.Negative,
    Stream3=split_8.Negative)
item_15 = ListItem(List=panel_21, Index=preview_strategies, Wrap=True)

viewports = ViewportProperties(Update=Button(), AutoUpdate=True)  # -> ViewportNames, ActiveViewportIndex, ViewportBounds, ViewportDisplayMode, CameraLocation, CameraTarget, CameraPlane, CameraLensLength, CameraProjection, CameraUp
dim = Dimensions(Surface=viewports.ViewportBounds)  # -> UDimension, VDimension
item_16 = ListItem(List=dim.UDimension, Index=viewports.ActiveViewportIndex, Wrap=True)
multiplication_2 = Multiplication(A=size_scale, B=".85")
item_17 = ListItem(List=dim.VDimension, Index=viewports.ActiveViewportIndex, Wrap=True)
multiplication_3 = Multiplication(A=size_scale, B=".5")
num_legend_text_size = Number(multiplication_3)
num_title_text_size = Number(multiplication_2)
panel_22 = Panel(item_17)
panel_23 = Panel(item_16)
multiplication_4 = Multiplication(A=item_16, B=x_location)
multiplication_5 = Multiplication(A=num_title_text_size, B="2")
multiplication_6 = Multiplication(A=item_17, B=y_location)
addition_2 = Addition(A=multiplication_6, B=multiplication_5)
int_legend_y_coordinate_start = Integer(addition_2)
int_title_y_coordinate = Integer(multiplication_6)
int_title_x_coordinate = Integer(multiplication_4)
concat_10 = Concatenate(FragmentA=int_title_x_coordinate, FragmentB=", ", FragmentC=int_title_y_coordinate)

num_legend_bottom_value = Number(list_4)
num_legend_top_value = Number(list_5)
objbynn = GetObjectByNickname(NickName=preview_quantities_2)
num_legend_divisions = Number(item_15)
objfromgroup = GetObjectsInGroup(Group=objbynn)  # -> simplify(Objects)
series_5 = Series(Start="0", Step="1", Count=num_legend_divisions)
series_6 = Series(Start=".1", Step=".1", Count=num_legend_divisions)
series_7 = Series(Start="0", Step="1", Count=num_legend_divisions)
series_8 = Series(Start="0", Step="1", Count=num_legend_divisions)
sort_booleans_for_preview = SortBooleansForPreview(T=objfromgroup, P=preview_quantities, L=objfromgroup)
ambition_colour_scheme_2 = Ambition_colour_scheme(t=series_6)
strucutral_material_colour_scheme_2 = Strucutral_material_colour_scheme(t=series_7)
energy_supply_colour_scheme_2 = Energy_supply_colour_scheme(t=series_5)
preservation_colour_scheme_2 = Preservation_colour_scheme(t=series_8)
hideshow = HideShowObjectPreview(Objects=objfromgroup, Visible=sort_booleans_for_preview)

# ---- group: PREVIEW STRATEGY DOTS
dot_3 = AnnotationDot(Location=volume_2.Centroid, PrimaryText=filter_2)  # -> AnnotationDot, Location, PrimaryText, TextHeight

# ----
filter_values = StreamFilter(
    Gate=preview_strategies,
    Stream0=reverse(ambition_level_read_me),
    Stream1=preservation_strategy_read_me,
    Stream2=structural_material_read_me,
    Stream3=energy_supply_read_me)  # -> reverse(Stream)
filter_colors = StreamFilter(
    Gate=preview_strategies,
    Stream0=ambition_colour_scheme_2,
    Stream1=preservation_colour_scheme_2,
    Stream2=strucutral_material_colour_scheme_2,
    Stream3=energy_supply_colour_scheme_2)  # -> reverse(Stream)
int_legend_divisions = Integer(num_legend_divisions)
series_9 = Series(Start=0, Step="1", Count=num_legend_divisions)
addition_3 = Addition(A=int_title_x_coordinate, B=size_scale)
series_10 = Series(Start=int_legend_y_coordinate_start, Step=expr("x*1", size_scale), Count=int_legend_divisions)
addition_4 = Addition(A=int_title_x_coordinate, B=size_scale)
addition_5 = Addition(A=addition_3, B=num_legend_text_size)
addition_6 = Addition(A=addition_4, B=num_legend_text_size)
Y = UnitY(Factor=expr("x*-1", series_9))
int_legend_text_x_coordinate = Integer(addition_5)
int_legend_text_y_coordinates = Integer(series_10)
int_legend_text_x_coordinate_2 = Integer(addition_6)
concat_11 = Concatenate(FragmentA=int_title_x_coordinate, FragmentB=", ", FragmentC=int_legend_y_coordinate_start)
concat_12 = Concatenate(FragmentA=int_legend_text_x_coordinate_2, FragmentB=",", FragmentC=int_legend_text_y_coordinates)
concat_13 = Concatenate(FragmentA=int_title_x_coordinate, FragmentB=", ", FragmentC=int_legend_y_coordinate_start)
preview_quantities_3 = Panel("""AMBITION
PRESERVATION STRATEGY
STRUCTURAL MATERIAL
ENERGY SUPPLY""")
item_18 = ListItem(List=preview_quantities_3, Index=preview_strategies, Wrap=True)
preview_lca_result = Panel("""GWP PR FLOOR
GWP PR GROUPING
GWP PR SITE BOUNDARY""")
item_19 = ListItem(List=preview_lca_result, Index=preview_lca_estimate, Wrap=True)
preview_lca_res = Panel("""PREVIEW LCA RESULT DOTS
PREVIEW LCA RESULT LEGEND""")
preview_lca_res_2 = Panel("""PREVIEW STRATEGY DOTS
PREVIEW STRATEGY LEGEND""")
objbynn_2 = GetObjectByNickname(NickName=preview_quantities_3)  # -> simplify(Objects)
objbynn_3 = GetObjectByNickname(NickName=preview_lca_result)
objbynn_4 = GetObjectByNickname(NickName=preview_lca_res)
panel_24 = Panel(objbynn_2)
objbynn_5 = GetObjectByNickname(NickName=preview_lca_res_2)
objfromgroup_2 = GetObjectsInGroup(Group=objbynn_3)  # -> simplify(Objects)
objfromgroup_3 = GetObjectsInGroup(Group=objbynn_2)  # -> simplify(Objects)
objfromgroup_4 = GetObjectsInGroup(Group=objbynn_4)  # -> simplify(Objects)
objfromgroup_5 = GetObjectsInGroup(Group=objbynn_5)  # -> simplify(Objects)
sort_booleans_for_preview_2 = SortBooleansForPreview(T=objfromgroup_4, P=lca_result_info_overlay, L=objfromgroup_4)
sort_booleans_for_preview_3 = SortBooleansForPreview(T=objfromgroup_2, P=preview_lca_estimate, L=objfromgroup_2)
sort_booleans_for_preview_4 = SortBooleansForPreview(T=objfromgroup_5, P=strategies_info_overlay, L=objfromgroup_5)
sort_booleans_for_preview_5 = SortBooleansForPreview(T=objfromgroup_3, P=preview_strategies, L=objfromgroup_3)
hideshow_2 = HideShowObjectPreview(Objects=objfromgroup_4, Visible=sort_booleans_for_preview_2)
hideshow_3 = HideShowObjectPreview(Objects=objfromgroup_2, Visible=sort_booleans_for_preview_3)
hideshow_4 = HideShowObjectPreview(Objects=objfromgroup_5, Visible=sort_booleans_for_preview_4)
hideshow_5 = HideShowObjectPreview(Objects=objfromgroup_3, Visible=sort_booleans_for_preview_5)

# ---- group: SORT BREPS INTO ABOVE AND BELOW TERRAIN
lng_15 = ListLength(List=split_2)
larger_9 = LargerThan(FirstNumber=lng_15, SecondNumber="1")  # -> LargerThan, OrEqualTo
dispatch_22 = Dispatch(List=graft(brep_stack_groupings), DispatchPattern=larger_9.LargerThan)  # -> ListA, ListB
brep_10 = Brep(dispatch_22.ListA)
split_12 = SplitBrep(Brep=move_2.Geometry, Cutter=brep_10)  # -> simplify(Result)
item_20 = ListItem(List=split_12, Index=1, Wrap=True)
null_3 = NullItem(Item=item_20)  # -> NullFlags, InvalidFlags, Description
dispatch_23 = Dispatch(List=item_20, DispatchPattern=null_3.NullFlags)  # -> ListA, ListB
dup_2 = DuplicateData(Data=dispatch_23.ListB, Number=2, Order=True)  # -> simplify(Data)
volume_4 = Volume(Geometry=dispatch_22.ListB)  # -> Volume, Centroid
project_4 = ProjectPoint(Point=volume_4.Centroid, Direction=Vector(0, 0, -1), Geometry=brep_terrain)  # -> Point, Index
null_4 = NullItem(Item=project_4.Point)  # -> NullFlags, InvalidFlags, Description
brep_grouped_graftedprfloor = Brep(graft(brep_stack_groupings))

# ---- group: TEST AGAINST BASEMENT SLABS
split_13 = SplitBrep(Brep=brep_10, Cutter=move_2.Geometry)  # -> simplify(Result)

# ---- group: SORT BREPS INTO ABOVE AND BELOW TERRAIN (continued)
merge_8 = Merge(Data1=graft(dup_2), Data2=graft(split_13))
join_5 = BrepJoin(Breps=merge_8)  # -> Breps, Closed
path_mapper_24 = PathMapper(join_5.Breps, source="{A;B;C;D}", target="{A;B;C}")
volume_5 = Volume(Geometry=path_mapper_24)  # -> Volume, Centroid
project_5 = ProjectPoint(Point=volume_5.Centroid, Direction=Vector(0, 0, -1), Geometry=brep_terrain)  # -> Point, Index
null_5 = NullItem(Item=project_5.Point)  # -> NullFlags, InvalidFlags, Description
null_6 = NullItem(Item=split_13)  # -> NullFlags, InvalidFlags, Description
dispatch_24 = Dispatch(List=null_5.NullFlags, DispatchPattern=null_6.NullFlags)  # -> ListA, ListB
tstat_6 = TreeStatistics(Tree=dispatch_24.ListB)  # -> Paths, Length, Count
equals_6 = Equality(FirstNumber=tstat_6.Length, SecondNumber="0")  # -> Equality, Inequality
dispatch_25 = Dispatch(List=tstat_6.Paths, DispatchPattern=equals_6.Equality)  # -> ListA, ListB
split_14 = SplitTree(Data=brep_grouped_graftedprfloor, Masks=flatten(dispatch_25.ListB))  # -> Positive, Negative
split_15 = SplitTree(Data=null_4.NullFlags, Masks=flatten(dispatch_25.ListB))  # -> Positive, Negative
brep_above_ground_unsorted = Brep(split_14.Negative)
brep_under_terrain_unsorted = Brep(path_mapper_24)
merge_9 = Merge(Data1=brep_above_ground_unsorted, Data2=brep_under_terrain_unsorted)
merge_10 = Merge(Data1=split_15.Negative, Data2=dispatch_24.ListB)
dispatch_26 = Dispatch(List=merge_9, DispatchPattern=merge_10)  # -> ListA, ListB

# ----
split_16 = SplitTree(Data=dispatch_26.ListA, Masks=flatten("{*;*;0}"))  # -> Positive, Negative
split_17 = SplitTree(Data=dispatch_26.ListB, Masks=flatten("{*;*;0}"))  # -> Positive, Negative
brep_11 = Brep(split_16.Positive)
brep_12 = Brep(split_17.Positive)
debrep_9 = DeconstructBrep(Brep=brep_11)  # -> Faces, Edges, Vertices
debrep_10 = DeconstructBrep(Brep=brep_12)  # -> Faces, Edges, Vertices
evalsrf_11 = EvaluateSurface(Surface=reparameterize(debrep_9.Faces), Point="0.5,0.5")  # -> Point, Normal, UDirection, VDirection, Frame
evalsrf_12 = EvaluateSurface(Surface=reparameterize(debrep_10.Faces), Point="0.5,0.5")  # -> Point, Normal, UDirection, VDirection, Frame
Z_15 = UnitZ(Factor=1)
Z_16 = UnitZ(Factor=1)
dprod_11 = DotProduct(VectorA=evalsrf_12.Normal, VectorB=Z_15, Unitize=False)
dprod_12 = DotProduct(VectorA=evalsrf_11.Normal, VectorB=Z_16, Unitize=False)
int_2 = Integer(dprod_11)
int_3 = Integer(dprod_12)
equals_7 = Equality(FirstNumber=int_2, SecondNumber="-1")  # -> Equality, Inequality
equals_8 = Equality(FirstNumber=int_3, SecondNumber="-1")  # -> Equality, Inequality
dispatch_27 = Dispatch(List=debrep_10.Faces, DispatchPattern=equals_7.Equality)  # -> simplify(ListA), ListB
dispatch_28 = Dispatch(List=debrep_9.Faces, DispatchPattern=equals_8.Equality)  # -> ListA, ListB
prune = PruneTree(Tree=dispatch_28.ListA, Minimum=1, Maximum=0)  # -> simplify(Tree)
prune_2 = PruneTree(Tree=dispatch_27.ListA, Minimum=1, Maximum=0)  # -> simplify(Tree)

srf_basement_slab = Surface(prune)
srf_gf_slab = Surface(prune_2)

# ---- group: ALTERNATIVE GF/BASEMENT SLAB BASIS CALCULATION
sort_surfaces_by_program = SortSurfacesByProgram(srf_input=srf_basement_slab, brep_stacked_groupings=brep_stack_groupings)  # -> breps_with_affected_geometry_2, txt_preview_swatch_2, int_program_areas_pr_brep_grouping_2, txt_program_unique_2, txt_program_srfs_2, int_program_areas_pr_brep_floor_2
area_13 = Area(Geometry=srf_basement_slab)  # -> Area, Centroid
ma = MassAddition(Input=area_13.Area)  # -> Result, PartialResults
sort_surfaces_by_program_2 = SortSurfacesByProgram(srf_input=srf_gf_slab, brep_stacked_groupings=brep_stack_groupings)  # -> breps_with_affected_geometry_2, txt_preview_swatch_2, int_program_areas_pr_brep_grouping_2, txt_program_unique_2, txt_program_srfs_2, int_program_areas_pr_brep_floor_2
replace_7 = ReplaceItems(List=repeat, Item=ma.Result, Indices=0, Wrap=False)
nullrep = ReplaceNulls(Items=replace_7, Replacements=0)  # -> simplify(Items), Count
clean = CleanTree(RemoveNulls=True, RemoveInvalid=True, RemoveEmpty=True, Tree=nullrep.Items)

# ----
dem_repath_12 = Python3Script(T=simplify(srf_gf_slab))  # -> out, R, Rewritten; inputs T: tree; same code as dem_repath
dem_repath_13 = Python3Script(T=simplify(srf_basement_slab))  # -> out, R, Rewritten; inputs T: tree; same code as dem_repath
split_18 = SplitTree(Data=dem_repath_13.R, Masks=flatten(dem_repath_13.Rewritten))  # -> Positive, Negative
split_19 = SplitTree(Data=dem_repath_12.R, Masks=flatten(dem_repath_12.Rewritten))  # -> Positive, Negative

# ---- group: PREVIEW BASEMENT GROUND FLOOR SLABS
swatch_2 = ColourSwatch(SwatchColor=RGB(89, 42, 0))
preview_9 = CustomPreview(Geometry=split_18.Negative, Material=swatch_2)

# ---- group: PREVIEW GROUND FLOOR SLABS
swatch_3 = ColourSwatch(SwatchColor=RGB(128, 60, 0))
preview_10 = CustomPreview(Geometry=split_19.Negative, Material=swatch_3)

# ---- group: FIND BOTTOM SLABS AND SORT INTO GF SLABS AND OVERHANGS
equalst_6 = EqualityWithinTolerance(FirstNumber=dprod_2, SecondNumber="-1", Tolerance=equality_tolerance_for_z_prod_calculatio)  # -> Equality, Inequality
dispatch_29 = Dispatch(List=srf_roofs_terrain_slabs_overhangs, DispatchPattern=equalst_6.Equality)  # -> ListA, ListB
dispatch_30 = Dispatch(List=evalsrf_2.Point, DispatchPattern=equalst_6.Equality)  # -> ListA, ListB
srf_neg_z_normal = Surface(dispatch_29.ListA)
Z_17 = UnitZ(Factor=1)
neg_2 = Negative(Value=Z_17)
area_14 = Area(Geometry=srf_neg_z_normal)  # -> Area, Centroid
project_6 = ProjectPoint(Point=area_14.Centroid, Direction=neg_2, Geometry=brep_terrain)  # -> Point, Index
project_7 = ProjectPoint(Point=area_14.Centroid, Direction=Z_17, Geometry=brep_terrain)  # -> Point, Index
pt_projected = Point([project_6.Point, project_7.Point])
null_7 = NullItem(Item=pt_projected)  # -> NullFlags, InvalidFlags, Description
dispatch_31 = Dispatch(List=pt_projected, DispatchPattern=null_7.NullFlags)  # -> ListA, ListB
pdecon_4 = Deconstruct(Point=area_14.Centroid)  # -> XComponent, YComponent, ZComponent
pdecon_5 = Deconstruct(Point=dispatch_31.ListB)  # -> XComponent, YComponent, ZComponent
subtraction_2 = Subtraction(A=pdecon_4.ZComponent, B=pdecon_5.ZComponent)
larger_10 = LargerThan(FirstNumber=subtraction_2, SecondNumber=tolerance_overhang_above_terrain)  # -> LargerThan, OrEqualTo
dispatch_32 = Dispatch(List=subtraction_2, DispatchPattern=larger_10.LargerThan)  # -> ListA, ListB
neg_3 = Negative(Value=tolerance_overhang_above_terrain)
dispatch_33 = Dispatch(List=srf_neg_z_normal, DispatchPattern=larger_10.LargerThan)  # -> ListA, ListB
smaller_2 = SmallerThan(FirstNumber=dispatch_32.ListB, SecondNumber=neg_3)  # -> SmallerThan, OrEqualTo

# ---- group: OVERHANG INCLUDED...
dispatch_34 = Dispatch(List=dispatch_33.ListB, DispatchPattern=smaller_2.SmallerThan)  # -> ListA, ListB
prune_3 = PruneTree(Tree=dispatch_34.ListB, Minimum=1, Maximum=0)

# ---- group: FIND BOTTOM SLABS AND SORT INTO GF SLABS AND OVERHANGS (continued)
prune_4 = PruneTree(Tree=dispatch_34.ListA, Minimum=1, Maximum=0)

# ----
# ROOFS AND OVERHANGS
# B. SORTED GEOMETRY
# OBS! TAGTERRASSER REGNES SOM TAG
# OBS! MANSARDTAGE REGNES SOM TAG
srf_pitched_roofs = Surface(simplify([dispatch_14.ListA, srf_roofs_additional]))
srf_flat_roofs = Surface(simplify(dispatch_15.ListA))
srf_overhangs = Surface(dispatch_33.ListA)
srf_combined_roofs_overhangs = Surface([srf_pitched_roofs, srf_flat_roofs, srf_overhangs])

# ---- group: CALCULATE ROOF ANGLE
evalsrf_13 = EvaluateSurface(Surface=reparameterize(srf_combined_roofs_overhangs), Point="0.5,0.5")  # -> Point, Normal, UDirection, VDirection, Frame
Z_18 = UnitZ(Factor=1)
angle = Angle(VectorA=evalsrf_13.Normal, VectorB=Z_18)  # -> Angle, Reflex
deg = Degrees(Radians=angle.Angle)
roundf_5 = RoundToFactor(NumberX=deg, Factor=".1", RoundType=0)  # -> Rounded, Difference, MultiplierR, MultiplierX
txt_2 = Text(roundf_5.Rounded)
area_15 = Area(Geometry=srf_combined_roofs_overhangs)  # -> Area, Centroid
mindex_3 = MemberIndex(Set=txt_2, Member="180")  # -> Index, Count
ma_2 = MassAddition(Input=area_15.Area)  # -> Result, PartialResults
replace_8 = ReplaceItems(List=roundf_5.Rounded, Item="0", Indices=mindex_3.Index, Wrap=False)  # -> simplify(List)
division = Division(A=area_15.Area, B=ma_2.Result)
num = Number(replace_8)
wav = WeightedAverage(Input=num, Weights=division)
roundf_6 = RoundToFactor(NumberX=wav, Factor=".1", RoundType=0)  # -> Rounded, Difference, MultiplierR, MultiplierX

# ----
dem_repath_14 = Python3Script(T=simplify(srf_combined_roofs_overhangs))  # -> out, R, Rewritten; inputs T: tree; same code as dem_repath
split_20 = SplitTree(Data=dem_repath_14.R, Masks=flatten(dem_repath_14.Rewritten))  # -> Positive, Negative

# ---- group: PREVIEW ROOFS
# SORTED GEOMETRY PREVIEW
swatch_4 = ColourSwatch(SwatchColor=RGB(89, 36, 36))
preview_11 = CustomPreview(Geometry=split_20.Negative, Material=swatch_4)

# ----
# VOLUMES - ABOVE/BELOW GROUND
# B. SORTED GEOMETRY
brep_under_terrain_pr_opgang_pr_etage = Brep(dispatch_26.ListA)
brep_over_terrain_pr_opgang_pr_etage = Brep(dispatch_26.ListB)

# ---- group: CALCULATE VOLUMES BELOW TERRAIN
volume_6 = Volume(Geometry=brep_under_terrain_pr_opgang_pr_etage)  # -> Volume, Centroid
ma_3 = MassAddition(Input=volume_6.Volume)  # -> Result, PartialResults
nullrep_2 = ReplaceNulls(Items=ma_3.Result, Replacements=0)  # -> Items, Count
path_mapper_25 = PathMapper(nullrep_2.Items, source=["{A;B;C;D}", "{A;B;C}", "{A;B}"], target=["{A;B}", "{A;B}", "{A;B}"])
ma_4 = MassAddition(Input=path_mapper_25)  # -> Result, PartialResults

# ---- group: CALCULATE AVERAGE FLOOR HEIGHT ABOVE TERRAIN
debrep_11 = DeconstructBrep(Brep=brep_over_terrain_pr_opgang_pr_etage)  # -> Faces, Edges, Vertices
pdecon_6 = Deconstruct(Point=simplify(debrep_11.Vertices))  # -> XComponent, YComponent, ZComponent
sort_4 = SortList(Keys=pdecon_6.ZComponent)  # -> Keys, ValuesA
item_21 = ListItem(List=sort_4.Keys, Index=0, Wrap=True)  # -> Item1, Item
subtraction_3 = Subtraction(A=item_21.Item1, B=item_21.Item)  # -> simplify(Result)
path_mapper_26 = PathMapper(subtraction_3, source=["{A;B;C;D}", "{A;B;C}", "{A;B}"], target=["{A;B}", "{A;B}", "{A;B}"])
avr_3 = Average(Input=path_mapper_26)
nullrep_3 = ReplaceNulls(Items=avr_3, Replacements="0")  # -> Items, Count
roundf_7 = RoundToFactor(NumberX=nullrep_3.Items, Factor="0.1", RoundType=0)  # -> Rounded, Difference, MultiplierR, MultiplierX

# ---- group: CALCULATE AVERAGE FLOOR HEIGHT BELOW TERRAIN
debrep_12 = DeconstructBrep(Brep=brep_under_terrain_pr_opgang_pr_etage)  # -> Faces, Edges, Vertices
pdecon_7 = Deconstruct(Point=simplify(debrep_12.Vertices))  # -> XComponent, YComponent, ZComponent
sort_5 = SortList(Keys=pdecon_7.ZComponent)  # -> Keys, ValuesA
item_22 = ListItem(List=sort_5.Keys, Index=0, Wrap=True)  # -> Item1, Item
subtraction_4 = Subtraction(A=item_22.Item1, B=item_22.Item)  # -> simplify(Result)
path_mapper_27 = PathMapper(subtraction_4, source=["{A;B;C;D}", "{A;B;C}", "{A;B}"], target=["{A;B}", "{A;B}", "{A;B}"])
avr_4 = Average(Input=path_mapper_27)
nullrep_4 = ReplaceNulls(Items=avr_4, Replacements=0)  # -> Items, Count
roundf_8 = RoundToFactor(NumberX=nullrep_4.Items, Factor="0.1", RoundType=0)  # -> Rounded, Difference, MultiplierR, MultiplierX

# ---- group: CALCULATE NUMBER OF FLOORS BELOW TERRAIN
equals_9 = Equality(FirstNumber=nullrep_2.Items, SecondNumber="0")  # -> Equality, Inequality
int_4 = Integer(equals_9.Inequality)
nullrep_5 = ReplaceNulls(Items=subtraction_4, Replacements=0)  # -> Items, Count
lng_16 = ListLength(List=nullrep_5.Items)
path_mapper_28 = PathMapper(int_4, source=["{A;B;C;D}", "{A;B;C}", "{A;B}"], target=["{A;B}", "{A;B}", "{A;B}"])
ma_5 = MassAddition(Input=path_mapper_28)  # -> Result, PartialResults

# ----
# FACADES AND WALLS
srf_inner_walls_fire_section = Brep(graftbydata)
srf_ext_walls_basement = Surface(path_mapper_7)
# B. SORTED GEOMETRY
srf_ext_walls_facade = Surface(path_mapper_8)
# C. CALCULATE QUANTITIES
sort_surfaces_by_program_3 = SortSurfacesByProgram(srf_input=srf_ext_walls_facade, brep_stacked_groupings=brep_stack_groupings)  # -> breps_with_affected_geometry_2, txt_preview_swatch_2, int_program_areas_pr_brep_grouping_2, txt_program_unique_2, txt_program_srfs_2, int_program_areas_pr_brep_floor_2
sort_surfaces_by_program_4 = SortSurfacesByProgram(srf_input=srf_ext_walls_basement, brep_stacked_groupings=brep_stack_groupings)  # -> breps_with_affected_geometry_2, txt_preview_swatch_2, int_program_areas_pr_brep_grouping_2, txt_program_unique_2, txt_program_srfs_2, int_program_areas_pr_brep_floor_2
basement_ext_wall_area = Integer(sort_surfaces_by_program_4.int_program_areas_pr_brep_floor_2)
# D. QUANTITIES
typology_facade_area = Integer(sort_surfaces_by_program_3.int_program_areas_pr_brep_floor_2)

# ---- group: CALCULATE AREA INTERNAL FIRE WALLS
lng_17 = ListLength(List=brep_stack_groupings)
dup_3 = DuplicateData(Data="0", Number=lng_17, Order=True)  # -> simplify(graft(Data))
area_16 = Area(Geometry=srf_inner_walls_fire_section)  # -> expr("x/2", Area), Centroid
merge_11 = Merge(Data1=area_16.Area, Data2=dup_3)
ma_6 = MassAddition(Input=merge_11)  # -> Result, PartialResults
path_mapper_29 = PathMapper(ma_6.Result, source=["{A;B;C}", "{A;B}"], target=["{A;B}", "{A;B}"])

# ----
areainternalfirewalls = Integer(path_mapper_29)

# ----
# QA COMPELTE
dem_repath_15 = Python3Script(T=simplify(typology_facade_area))  # -> out, R; inputs T: tree; same code as dem_repath_2
# QA COMPELTE
dem_repath_16 = Python3Script(T=simplify(areainternalfirewalls))  # -> out, R; inputs T: tree; same code as dem_repath_2
# QA COMPELTE
dem_repath_17 = Python3Script(T=simplify(basement_ext_wall_area))  # -> out, R; inputs T: tree; same code as dem_repath_2
dem_repath_18 = Python3Script(T=simplify(srf_ext_walls_facade))  # -> out, R, Rewritten; inputs T: tree; same code as dem_repath
dem_repath_19 = Python3Script(T=simplify(sort_surfaces_by_program_3.txt_preview_swatch_2))  # -> out, R, Rewritten; inputs T: tree; same code as dem_repath
split_21 = SplitTree(Data=dem_repath_19.R, Masks=flatten(dem_repath_19.Rewritten))  # -> Positive, Negative
split_22 = SplitTree(Data=dem_repath_18.R, Masks=flatten(dem_repath_18.Rewritten))  # -> Positive, Negative

# ---- group: PREVIEW FACADES
panel_25 = Panel(" (35)")
concat_14 = Concatenate(FragmentA=split_21.Negative, FragmentB=panel_25)
preview_12 = CustomPreview(Geometry=split_22.Negative, Material=concat_14)

# ----
# SLABS
srf_basementgroundfloor_gfa = Surface(prune)
crv_foundation_outline = Curve(join_3)
srf_groundfloor_gfa = Surface(prune_2)

area_17 = Area(Geometry=srf_groundfloor_gfa)  # -> graft(Area), Centroid
area_18 = Area(Geometry=srf_basementgroundfloor_gfa)  # -> graft(Area), Centroid
graft = GraftTree(Tree=repeat, IncludeEmptyLists=True, IncludeNullItems=True)
ma_7 = MassAddition(Input=[area_17.Area, graft])  # -> Result, PartialResults
ma_8 = MassAddition(Input=[area_18.Area, graft])  # -> Result, PartialResults
path_mapper_30 = PathMapper(ma_7.Result, source=["{A;B;C}", "{A;B}"], target=["{A;B}", "{A;B}"])
path_mapper_31 = PathMapper(ma_8.Result, source=["{A;B;C}", "{A;B}"], target=["{A;B}", "{A;B}"])

len = Length(Curve=crv_foundation_outline)
replace_9 = ReplaceItems(List=repeat, Item=len, Indices=0, Wrap=False)  # -> simplify(List)

lengthboundingfoundation = Number(replace_9)
basement_gf_slab = Integer(path_mapper_31)
gf_slab_area = Integer(path_mapper_30)

# ----
# QA COMPELTE
dem_repath_20 = Python3Script(T=simplify(gf_slab_area))  # -> out, R; inputs T: tree; same code as dem_repath_2
# QA COMPELTE
dem_repath_21 = Python3Script(T=simplify(lengthboundingfoundation))  # -> out, R; inputs T: tree; same code as dem_repath_2
# QA COMPELTE
dem_repath_22 = Python3Script(T=simplify(basement_gf_slab))  # -> out, R; inputs T: tree; same code as dem_repath_2

# ---- group: GFA CALCULATION BASIS NEEDS TO BE DOUBLE CHECKED
srf_total_gfa_slabs = Surface(simplify(dispatch_13.ListA))
# B. SORTED GEOMETRY
srf_floor_slabs = Surface([dispatch_9.ListA, srf_floor_slabs_additional])
# C. CALCULATE QUANTITIES
sort_surfaces_by_program_5 = SortSurfacesByProgram(srf_input=srf_floor_slabs, brep_stacked_groupings=brep_stack_groupings)  # -> breps_with_affected_geometry_2, txt_preview_swatch_2, int_program_areas_pr_brep_grouping_2, txt_program_unique_2, txt_program_srfs_2, int_program_areas_pr_brep_floor_2
# D. QUANTITIES
typology_gfa = Integer(sort_surfaces_by_program_5.int_program_areas_pr_brep_grouping_2)

area_19 = Area(Geometry=srf_total_gfa_slabs)  # -> Area, Centroid
path_mapper_32 = PathMapper(area_19.Area, source=["{A;B;C}", "{A;B}"], target=["{A;B}", "{A;B}"])
ma_9 = MassAddition(Input=path_mapper_32)  # -> Result, PartialResults
int_srf_areas = Integer(path_mapper_32)

# ---- group: GFA CALCULATION BASIS NEEDS TO BE DOUBLE CHECKED / CALCULATE HEATED AREA
lng_18 = ListLength(List=int_srf_areas)
equals_10 = Equality(FirstNumber=energy_supply, SecondNumber="2")  # -> Equality, Inequality
dup_4 = DuplicateData(Data=0, Number=lng_18, Order=True)  # -> simplify(graft(Data))
dispatch_35 = Dispatch(List=int_srf_areas, DispatchPattern=equals_10.Equality)  # -> ListA, graft(ListB)
merge_12 = Merge(Data1=dispatch_35.ListB, Data2=dup_4)
ma_10 = MassAddition(Input=merge_12)  # -> Result, PartialResults
path_mapper_33 = PathMapper(ma_10.Result, source=["{A;B;C}", "{A;B}"], target=["{A;B}", "{A;B}"])

# ---- group: GFA CALCULATION BASIS NEEDS TO BE DOUBLE CHECKED (continued)
int_programs_pr_grouping_pr_floor = Text(simplify(int_srf_areas))
int_total_areas_pr_brep_grouping = Integer(ma_9.Result)

# ----
# @PIL
# Samlet areal alle etager inkl. kælder.
# QA COMPELTE
dup_5 = DuplicateData(Data=int_total_areas_pr_brep_grouping, Number=lng_14, Order=True)  # -> simplify(Data)
dem_repath_23 = Python3Script(T=simplify(dup_5))  # -> out, R; inputs T: tree; same code as dem_repath_2
dem_repath_24 = Python3Script(T=simplify(int_programs_pr_grouping_pr_floor))  # -> out, R; inputs T: tree
# ---------- dem_repath_24: Python ----------
"""
Grasshopper (Rhino 8) Python 3 script

Repath rule:
- If first path index A > 99: map to (A-100)
- Rewrite second index B so it continues after the current max B in the target (A-100) branch.

Outputs:
  R : DataTree (repathed)
  Rewritten : list of strings (the NEW paths that were created, e.g. "{2;14}", "{2;15}")
"""

import Grasshopper as gh
from Grasshopper.Kernel.Data import GH_Path

# --- output ---
R = gh.DataTree[object]()
Rewritten = []  # list of new paths (strings), in creation order

def path_to_str(p):
    return "{" + ";".join(str(p[i]) for i in range(p.Length)) + "}"

# --- collect current max B per "normal" A (A <= 99) ---
max_b = {}  # {A: maxB}
for p in T.Paths:
    if p.Length < 2:
        continue
    A, B = p[0], p[1]
    if A <= 99:
        max_b[A] = max(B, max_b.get(A, -1))

# --- add all "normal" branches unchanged ---
for p in T.Paths:
    if p.Length < 2:
        # passthrough for odd paths
        R.AddRange(list(T.Branch(p)), p)
        continue

    A = p[0]
    if A <= 99:
        R.AddRange(list(T.Branch(p)), p)

# --- repath "high-A" branches ---
# Group high paths by targetA, and sort by original B for predictable numbering
high_by_target = {}  # {targetA: [(origB, path), ...]}
for p in T.Paths:
    if p.Length < 2:
        continue
    A, B = p[0], p[1]
    if A > 99:
        targetA = A - 100
        high_by_target.setdefault(targetA, []).append((B, p))

for targetA, entries in high_by_target.items():
    entries.sort(key=lambda x: x[0])  # sort by original B

    next_b = max_b.get(targetA, -1) + 1
    for _, p in entries:
        new_path = GH_Path(targetA, next_b)
        R.AddRange(list(T.Branch(p)), new_path)
        Rewritten.append(path_to_str(new_path))
        next_b += 1
# ---------- end dem_repath_24 ----------
# QA COMPELTE
dem_repath_25 = Python3Script(T=simplify(path_mapper_33))  # -> out, R; inputs T: tree; same code as dem_repath_2
dem_repath_26 = Python3Script(T=simplify(srf_floor_slabs))  # -> out, R, Rewritten; inputs T: tree; same code as dem_repath
split_23 = SplitTree(Data=dem_repath_26.R, Masks=flatten(dem_repath_26.Rewritten))  # -> Positive, Negative

# ---- group: PREVIEW FLOOR SLABS
swatch_5 = ColourSwatch(SwatchColor=RGB(0, 153, 140))
preview_13 = CustomPreview(Geometry=split_23.Negative, Material=swatch_5)

# ---- group: CALCULATE VOLUME OF ROOF FLOORS
# C. CALCULATE QUANTITIES
sort_surfaces_by_program_6 = SortSurfacesByProgram(srf_input=srf_combined_roofs_overhangs, brep_stacked_groupings=brep_stack_groupings)  # -> breps_with_affected_geometry_2, txt_preview_swatch_2, int_program_areas_pr_brep_grouping_2, txt_program_unique_2, txt_program_srfs_2, int_program_areas_pr_brep_floor_2

# ---- group: CALCULATE VOLUME OF ROOF FLOORS / FURTHER DEVELOPMENT
brep_13 = Brep(sort_surfaces_by_program_6.breps_with_affected_geometry_2)
item_23 = ListItem(List=brep_13, Index=0, Wrap=True)

# ---- group: CALCULATE VOLUME OF ROOF FLOORS (continued)
volume_7 = Volume(Geometry=item_23)  # -> Volume, Centroid
round = Round(Number=volume_7.Volume)  # -> Nearest, Floor, Ceiling

# ----
roof_pitch_degrees_weighted_average = Number(roundf_6.Rounded)
# D. QUANTITIES
volume_roof_level = Integer(round.Nearest)
roof_level_gfa = Integer(sort_surfaces_by_program_6.int_program_areas_pr_brep_floor_2)

dup_6 = DuplicateData(Data=roof_pitch_degrees_weighted_average, Number=lng_14, Order=True)  # -> simplify(Data)
# @JAC/PIL
# Tager volumet af den øverste brep i en opgang
# 
# Udvikling: stepped volumed calc
# QA COMPELTE
dup_7 = DuplicateData(Data=volume_roof_level, Number=lng_14, Order=True)  # -> simplify(Data)
# QA COMPELTE
dem_repath_27 = Python3Script(T=simplify(roof_level_gfa))  # -> out, R; inputs T: tree; same code as dem_repath_2
dem_repath_28 = Python3Script(T=simplify(dup_7))  # -> out, R; inputs T: tree; same code as dem_repath_2
dem_repath_29 = Python3Script(T=simplify(dup_6))  # -> out, R; inputs T: tree; same code as dem_repath_2

lengthboundingfoundation_2 = Integer(dem_repath_21.R)
areagroundslabbasement = Integer(dem_repath_22.R)
areainternalfirewalls_2 = Integer(dem_repath_16.R)
areafacadebasement = Integer(dem_repath_17.R)
areagroundslab = Integer(dem_repath_20.R)
elevatormeters_2 = Number(dem_repath_9.R)
# FLOOR GEOMETRY
grossfloorarea = Number(dem_repath_24.R)
coremeters_2 = Number(dem_repath_7.R)
areaheated = Number(dem_repath_25.R)
stairmeters_2 = Number(dem_repath_8.R)
areafacade = Number(dem_repath_15.R)
arearoof = Number(dem_repath_27.R)

grossfloorarea_gfa = Panel(grossfloorarea)
areaheated_2 = Panel(areaheated)
areafacade_2 = Panel(areafacade)
# QA COMPELTE
arearoof_2 = Panel(arearoof)
areagroundslab_2 = Panel(areagroundslab)
lengthboundingfoundation_3 = Panel(lengthboundingfoundation_2)
areainternalfirewalls_3 = Panel(areainternalfirewalls_2)
coremeters_3 = Panel(coremeters_2)
stairmeters_3 = Panel(stairmeters_2)
elevatormeters_3 = Panel(elevatormeters_2)
areafacadebasement_2 = Panel(areafacadebasement)
areagroundslabbasement_2 = Panel(areagroundslabbasement)

merge_13 = Merge(Data1=graft(areagroundslabbasement))
panel_26 = Panel(merge_13)
ins_7 = InsertItems(List=merge_13, Item=match_2, Indices=0, Wrap=True)
join_6 = TextJoin(Text=areagroundslabbasement)
item_24 = ListItem(List=reverse(areagroundslabbasement), Index=0, Wrap=True)
format_3 = Format(Format="{0}: {1}", Culture=127, Data0=ins_3, Data1=ins_7)  # -> simplify(Text)
join_7 = TextJoin(Text=format_3)
format_4 = Format(Format=panel_15, Culture=127, Data0=match_3, Data1=join_6)  # -> simplify(Text)
panel_28 = Panel(item_24)
dot_4 = AnnotationDot(Location=area_11.Centroid, PrimaryText=graft(join_7))  # -> AnnotationDot, Location, PrimaryText, TextHeight
panel_29 = Panel(format_3)
dot_5 = AnnotationDot(Location=item_14, PrimaryText=format_4)  # -> AnnotationDot, Location, PrimaryText, TextHeight
group_2 = Group(Geometry=flatten(dot_4.AnnotationDot))
ma_11 = MassAddition(Input=grossfloorarea)  # -> Result, PartialResults
path_mapper_34 = PathMapper(grossfloorarea, source="{A;B}", target="{A}")
ma_12 = MassAddition(Input=path_mapper_34)  # -> Result, PartialResults

# ---- group: CALCULATE VOLUMES ABOVE TERRAIN
volume_8 = Volume(Geometry=brep_over_terrain_pr_opgang_pr_etage)  # -> Volume, Centroid

# ----
ma_13 = MassAddition(Input=volume_8.Volume)  # -> Result, PartialResults
# C. CALCULATE QUANTITIES
nullrep_6 = ReplaceNulls(Items=ma_13.Result, Replacements=0)  # -> Items, Count
numberoffloorsbelowground = Integer(ma_5.Result)
floorheightbasementaverage = Number(roundf_8.Rounded)
volume_below_ground = Number(ma_4.Result)
floorheightaverage = Number(roundf_7.Rounded)

# ---- group: CALCULATE NUMBER OF FLOORS ABOVE TERRAIN
equals_11 = Equality(FirstNumber=nullrep_6.Items, SecondNumber="0")  # -> Equality, Inequality
int_5 = Integer(equals_11.Inequality)
nullrep_7 = ReplaceNulls(Items=subtraction_3, Replacements=0)  # -> Items, Count
lng_19 = ListLength(List=nullrep_7.Items)
path_mapper_35 = PathMapper(int_5, source=["{A;B;C;D}", "{A;B;C}", "{A;B}"], target=["{A;B}", "{A;B}", "{A;B}"])
ma_14 = MassAddition(Input=path_mapper_35)  # -> Result, PartialResults

# ---- group: CALCULATE VOLUMES ABOVE TERRAIN (continued)
path_mapper_36 = PathMapper(nullrep_6.Items, source=["{A;B;C;D}", "{A;B;C}", "{A;B}"], target=["{A;B}", "{A;B}", "{A;B}"])
ma_15 = MassAddition(Input=path_mapper_36)  # -> Result, PartialResults

# ----
numberoffloorsaboveground = Integer(ma_14.Result)
# D. QUANTITIES
volume_above_ground = Number(ma_15.Result)

# ----
# @PIL
# Skæring ift. parterre
# QA COMPELTE
dup_8 = DuplicateData(Data=volume_above_ground, Number=lng_14, Order=True)  # -> simplify(Data)
dup_9 = DuplicateData(Data=floorheightaverage, Number=lng_14, Order=True)  # -> simplify(Data)
# QA COMPELTE
dup_10 = DuplicateData(Data=volume_below_ground, Number=lng_14, Order=True)  # -> simplify(Data)
dup_11 = DuplicateData(Data=floorheightbasementaverage, Number=lng_14, Order=True)  # -> simplify(Data)
# QA COMPELTE
dup_12 = DuplicateData(Data=numberoffloorsaboveground, Number=lng_14, Order=True)  # -> simplify(Data)
# QA COMPELTE
# @JAC
# Elevator override attribute implementeret.
# QA COMPELTE
dup_13 = DuplicateData(Data=numberoffloorsbelowground, Number=lng_14, Order=True)  # -> simplify(Data)
dem_repath_30 = Python3Script(T=simplify(dup_8))  # -> out, R; inputs T: tree; same code as dem_repath_2
dem_repath_31 = Python3Script(T=simplify(dup_10))  # -> out, R; inputs T: tree; same code as dem_repath_2
dem_repath_32 = Python3Script(T=simplify(dup_9))  # -> out, R; inputs T: tree; same code as dem_repath_2
dem_repath_33 = Python3Script(T=simplify(dup_11))  # -> out, R; inputs T: tree; same code as dem_repath_2
dem_repath_34 = Python3Script(T=simplify(dup_12))  # -> out, R; inputs T: tree; same code as dem_repath_2
dem_repath_35 = Python3Script(T=simplify(dup_13))  # -> out, R; inputs T: tree; same code as dem_repath_2

# ----
# BUILDING GEOMETRY
numberoffloorsaboveground_2 = Integer(dem_repath_34.R)
numberoffloorsbelowground_2 = Integer(dem_repath_35.R)
buildingvolumeaboveground = Integer(dem_repath_30.R)
floorheightbasementaverage_2 = Number(dem_repath_33.R)
buildingvolumebasement = Integer(dem_repath_31.R)
floorheightaverage_2 = Number(dem_repath_32.R)
numberofelevators_2 = Integer(dem_repath_10.R)
rooflevelvolume = Integer(dem_repath_28.R)
building_gfa = Integer(dem_repath_23.R)
roofangle = Number(dem_repath_29.R)

building_gfa_2 = Panel(building_gfa)
building_volume_above_ground = Panel(buildingvolumeaboveground)
roof_level_volume = Panel(rooflevelvolume)
building_volume_basement = Panel(buildingvolumebasement)
floor_height_average = Panel(floorheightaverage_2)
floor_height_basement_average = Panel(floorheightbasementaverage_2)
roof_angle = Panel(roofangle)
number_of_floors_above_ground = Panel(numberoffloorsaboveground_2)
number_of_floors_below_ground = Panel(numberoffloorsbelowground_2)
number_of_elevators = Panel(numberofelevators_2)

merge_14 = Merge(Data1=numberofelevators_2)
ins_8 = InsertItems(List=merge_14, Item=match_3, Indices=0, Wrap=True)
format_5 = Format(Format="{0}: {1}", Culture=127, Data0=ins_4, Data1=ins_8)  # -> simplify(Text)
panel_31 = Panel(ins_8)
join_8 = TextJoin(Text=format_5)
dot_6 = AnnotationDot(Location=item_13, PrimaryText=graft(join_8))  # -> AnnotationDot, Location, PrimaryText, TextHeight
group_3 = Group(Geometry=flatten(dot_6.AnnotationDot))
panel_32 = Panel(format_5)
lca_volume = CSharpScript(
    BuildingTypology=typology,
    Ambition=ambition_fractile,
    PreservationStrategy=preservation_strategy,
    StructuralMaterial=structural_material_2,
    OperationYear=build_year,
    EnergySupplyType=energy_supply,
    AreaGrossFloor=grossfloorarea,
    AreaHeated=areaheated,
    AreaFacade=areafacade,
    AreaRoof=arearoof,
    AreaGroundSlap=areagroundslab,
    LengthBoundingFoundation=lengthboundingfoundation_2,
    AreaInternalFireWalls=areainternalfirewalls_2,
    CoreMeters=coremeters_2,
    StairMeters=stairmeters_2,
    ElevatorMeters=elevatormeters_2,
    AreaFacadeBasement=areafacadebasement,
    AreaGroundSlapBasement=areagroundslabbasement,
    BuildingAreaGrossFloor=building_gfa,
    BuildingVolumeAboveGround=buildingvolumeaboveground,
    RoofLevelVolume=rooflevelvolume,
    BuildingVolumeBasement=buildingvolumebasement,
    FloorHeightAverage=floorheightaverage_2,
    FloorHeightBasementAverage=floorheightbasementaverage_2,
    RoofAngle=roofangle,
    NumberOfFloorsAboveGround=numberoffloorsaboveground_2,
    NumberOfFloorsBellowGround=numberoffloorsbelowground_2,
    NumberOfElevators=numberofelevators_2,
    ExcelHeaders_KQ=excelread_4.ColumnHeaderNames,
    ExcelData_KQ=excelread_4.ExcelData,
    ExcelHeaders_KE=excelread_5.ColumnHeaderNames,
    ExcelData_KE=excelread_5.ExcelData,
    ExcelHeaders_Preservation=excelread_7.ColumnHeaderNames,
    ExcelData_Preservation=excelread_7.ExcelData,
    ExcelHeaders_Energy=excelread_6.ColumnHeaderNames,
    ExcelData_Energy=excelread_6.ExcelData,
    ExcelHeaders_KQ_StructuralRegressionY=excelread_3.ColumnHeaderNames,
    ExcelData_KQ_StructuralRegressionY=excelread_3.ExcelData,
    ExcelHeaders_KQ_StructuralRegressionF=excelread_2.ColumnHeaderNames,
    ExcelData_KQ_StructuralRegressionF=excelread_2.ExcelData,
    ExcelHeaders_KE_Structural=excelread.ColumnHeaderNames,
    ExcelData_KE_Structural=excelread.ExcelData)  # -> GWP_Fractile_TOTAL, GWP_Fractile_ENVELOPE, GWP_Fractile_WINDOW, GWP_Fractile_INTERIOR, GWP_Fractile_STRUCTURE, GWP_Fractile_FOUNDATION, GWP_Fractile_TECHNICAL, GWP_Fractile_ENERGY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; inputs BuildingTypology: String, Ambition: Double, PreservationStrategy: Int32, StructuralMaterial: Int32, OperationYear: Int32, EnergySupplyType: Int32, FLOOR_GEOMETRY: Double, AreaGrossFloor: Double, AreaHeated: Double, AreaFacade: Double, AreaRoof: Double, AreaGroundSlap: Double, LengthBoundingFoundation: Double, AreaInternalFireWalls: Double, CoreMeters: Double, StairMeters: Double, ElevatorMeters: Double, AreaFacadeBasement: Double, AreaGroundSlapBasement: Double, BUILDING_GEOMETRY: Double, BuildingAreaGrossFloor: Double, BuildingVolumeAboveGround: Double, RoofLevelVolume: Double, BuildingVolumeBasement: Double, FloorHeightAverage: Double, FloorHeightBasementAverage: Double, RoofAngle: Double, NumberOfFloorsAboveGround: Int32, NumberOfFloorsBellowGround: Int32, NumberOfElevators: Double, EXCEL: Double, ExcelHeaders_KQ: list of String, ExcelData_KQ: tree of String, ExcelHeaders_KE: list of String, ExcelData_KE: tree of String, ExcelHeaders_Preservation: list of String, ExcelData_Preservation: tree of String, ExcelHeaders_Energy: list of String, ExcelData_Energy: tree of String, ExcelHeaders_KQ_StructuralRegressionY: list of String, ExcelData_KQ_StructuralRegressionY: tree of String, ExcelHeaders_KQ_StructuralRegressionF: list of String, ExcelData_KQ_StructuralRegressionF: tree of String, ExcelHeaders_KE_Structural: list of String, ExcelData_KE_Structural: tree of String
# ---------- lca_volume: C# ----------
//This script estimates the probabalistical Global Warming Potentials (GWP) in kgCO2-eqvivalent pr. m2 floor area pr. year.
//The script applies emission data from an excel data base based on life cycle assessment (LCA).
//The script is open source.
//Developed by Pil Brix Purup.

// Grasshopper Script Instance
#region Usings
using System;
using System.Linq;
using System.Collections;
using System.Collections.Generic;
using System.Drawing;

using Rhino;
using Rhino.Geometry;

using Grasshopper;
using Grasshopper.Kernel;
using Grasshopper.Kernel.Data;
using Grasshopper.Kernel.Types;
#endregion

public class Script_Instance : GH_ScriptInstance
{
    #region Notes
    /* 
      Members:
        RhinoDoc RhinoDocument
        GH_Document GrasshopperDocument
        IGH_Component Component
        int Iteration

      Methods (Virtual & overridable):
        Print(string text)
        Print(string format, params object[] args)
        Reflect(object obj)
        Reflect(object obj, string method_name)
    */
    #endregion

    private void RunScript(
		string BuildingTypology,
		double Ambition,
		int PreservationStrategy,
		int StructuralMaterial,
		int OperationYear,
		int EnergySupplyType,
		double _FLOOR_GEOMETRY_,
		double AreaGrossFloor,
		double AreaHeated,
		double AreaFacade,
		double AreaRoof,
		double AreaGroundSlap,
		double LengthBoundingFoundation,
		double AreaInternalFireWalls,
		double CoreMeters,
		double StairMeters,
		double ElevatorMeters,
		double AreaFacadeBasement,
		double AreaGroundSlapBasement,
		double _BUILDING_GEOMETRY_,
		double BuildingAreaGrossFloor,
		double BuildingVolumeAboveGround,
		double RoofLevelVolume,
		double BuildingVolumeBasement,
		double FloorHeightAverage,
		double FloorHeightBasementAverage,
		double RoofAngle,
		int NumberOfFloorsAboveGround,
		int NumberOfFloorsBellowGround,
		double NumberOfElevators,
		double _EXCEL_,
		List<string> ExcelHeaders_KQ,
		DataTree<string> ExcelData_KQ,
		List<string> ExcelHeaders_KE,
		DataTree<string> ExcelData_KE,
		List<string> ExcelHeaders_Preservation,
		DataTree<string> ExcelData_Preservation,
		List<string> ExcelHeaders_Energy,
		DataTree<string> ExcelData_Energy,
		List<string> ExcelHeaders_KQ_StructuralRegressionY,
		DataTree<string> ExcelData_KQ_StructuralRegressionY,
		List<string> ExcelHeaders_KQ_StructuralRegressionF,
		DataTree<string> ExcelData_KQ_StructuralRegressionF,
		List<string> ExcelHeaders_KE_Structural,
		DataTree<string> ExcelData_KE_Structural,
		ref object GWP_Fractile_TOTAL,
		ref object GWP_Fractile_ENVELOPE,
		ref object GWP_Fractile_WINDOW,
		ref object GWP_Fractile_INTERIOR,
		ref object GWP_Fractile_STRUCTURE,
		ref object GWP_Fractile_FOUNDATION,
		ref object GWP_Fractile_TECHNICAL,
		ref object GWP_Fractile_ENERGY,
		ref object GWP_Fractile_Fractile_CONSTRUCTION_A5,
		ref object GWP_Fractile_DEMOLITION_C1,
		ref object GWP_Fractile_TOTAL_pr_m2Year,
		ref object GWP_Fractile_ENVELOPE_pr_m2Year,
		ref object GWP_Fractile_WINDOW_pr_m2Year,
		ref object GWP_Fractile_INTERIOR_pr_m2Year,
		ref object GWP_Fractile_STRUCTURE_pr_m2Year,
		ref object GWP_Fractile_FOUNDATION_pr_m2Year,
		ref object GWP_Fractile_TECHNICAL_pr_m2Year,
		ref object GWP_Fractile_ENERGY_pr_m2Year,
		ref object GWP_Fractile_Fractile_CONSTRUCTION_A5_pr_m2Year,
		ref object GWP_Fractile_DEMOLITION_C1_pr_m2Year,
		ref object Total_Quantity_Estimation_List,
		ref object Replaced_Quantity_Estimation_List)
		//ref object test)
        
    
    {
        double RoofInsolationThickness =0.4;
        double SlapThickness = 0.2;
        
        
        string Preservation="NewBuild";
        if(PreservationStrategy==0){Preservation="NewBuild";}
        else if(PreservationStrategy==1){Preservation="Transformation";}
        else if(PreservationStrategy==2){Preservation="Renonvation";}
        else if(PreservationStrategy==3){Preservation="Refurbished";}
        else if(PreservationStrategy==4){Preservation="Preserved";}
        else if(PreservationStrategy==5){Preservation="Demolished";}
        else if(PreservationStrategy==null){Preservation="NewBuild";}

        string StrucStrategy="All";
        if(StructuralMaterial==0){StrucStrategy="All";}
        else if(StructuralMaterial==1){StrucStrategy="ConcreteBearingWalls";}
        else if(StructuralMaterial==2){StrucStrategy="ConcreteBeamsColumns";}
        else if(StructuralMaterial==3){StrucStrategy="Hybrid";}
        else if(StructuralMaterial==4){StrucStrategy="WoodBearingWalls";}
        else if(StructuralMaterial==5){StrucStrategy="WoodBEamsColumns";}
        

         
         if(AreaGrossFloor==null){AreaGrossFloor=0;}
         if(BuildingAreaGrossFloor==null){BuildingAreaGrossFloor=AreaGrossFloor;}
		 if(AreaHeated==null){AreaHeated=0;}
		 if(AreaFacade==null){AreaFacade=0;}
         if(AreaRoof==null){AreaRoof=0;}
		 if(AreaGroundSlap==null){AreaGroundSlap=0;}
         if(LengthBoundingFoundation==null){LengthBoundingFoundation=0;}
		 if(AreaInternalFireWalls==null){AreaInternalFireWalls=0;}
		 if(BuildingVolumeAboveGround==null){BuildingVolumeAboveGround=0;}
		 if(RoofLevelVolume==null){RoofLevelVolume=0;}
		 if(FloorHeightAverage==null){FloorHeightAverage=0;}
		 if(RoofAngle==null){RoofAngle=0;}
		 if(NumberOfFloorsAboveGround==null){NumberOfFloorsAboveGround=0;}
		 if(CoreMeters==null){CoreMeters=0;}
		 if(StairMeters==null){StairMeters=0;}
		 if(ElevatorMeters==null){ElevatorMeters=0;}
		 if(NumberOfElevators==null){NumberOfElevators=0;}
		 if(AreaFacadeBasement==null){AreaFacadeBasement=0;}
		 if(AreaGroundSlapBasement==null){AreaGroundSlapBasement=0;}
		 if(BuildingVolumeBasement==null){BuildingVolumeBasement=0;}
		 if(FloorHeightBasementAverage==null){FloorHeightBasementAverage=0;}
		 if(NumberOfFloorsBellowGround==null){NumberOfFloorsBellowGround=0;}
         if(Ambition==null){Ambition=0.5;}
         if(Ambition<=0){Ambition=0.01;}
         if(Ambition>=1){Ambition=0.99;}
         if(OperationYear==null){OperationYear=2027;}
         if(EnergySupplyType==null){EnergySupplyType=0;}//District heating
         if(BuildingTypology==null){BuildingTypology="Etagebolig";} //Multi storey residential

         //Translate typologies to english if Danish:
         //Defalut values in Danish:
        if(BuildingTypology=="Enfamiliehus"){BuildingTypology="SingleFamilyHouse";}
        if(BuildingTypology=="Rækkehus"){BuildingTypology="TerracedHouse";}
        if(BuildingTypology=="Etagebolig"){BuildingTypology="MultiStoreyResidential";}
        if(BuildingTypology=="Kontor"){BuildingTypology="Office";}
        if(BuildingTypology=="Undervisning"){BuildingTypology="Education";}
        if(BuildingTypology=="Daginstitution"){BuildingTypology="Daycare";}
        if(BuildingTypology=="Butik"){BuildingTypology="Shopping";}
        if(BuildingTypology=="Parkering"){BuildingTypology="Parking";}
        if(BuildingTypology=="Industri"){BuildingTypology="Industrial";}
        if(BuildingTypology=="Transport"){BuildingTypology="Transport";}
        if(BuildingTypology=="Hotel"){BuildingTypology="Hotel";}
        if(BuildingTypology=="Sundhedshuse"){BuildingTypology="Hospital";}
        
         //if(NumberOfFloorsAboveGround>0){RoofLevelVolume=AreaRoof*(RoofInsolationThickness+FloorHeightAverage-RoofInsolationThickness/NumberOfFloorsAboveGround);}

        
        //_____SORT EXCEL DATA:______________________________
        //Quantity Keys:
        List<string> data_Typology=ExcelData_KQ.Branch(ExcelHeaders_KQ.IndexOf("Typology")).Skip(2).ToList(); 
        List<double> dataMean_WWR=ExcelData_KQ.Branch(ExcelHeaders_KQ.IndexOf("KQ_WWR_MEAN")).Skip(2).Select(double.Parse).ToList();
        List<double> dataSD_WWR=ExcelData_KQ.Branch(ExcelHeaders_KQ.IndexOf("KQ_WWR_SD")).Skip(2).Select(double.Parse).ToList();
        List<double> dataMean_NettoBrutto=ExcelData_KQ.Branch(ExcelHeaders_KQ.IndexOf("KQ_NettoBRutto_MEAN")).Skip(2).Select(double.Parse).ToList();
        List<double> dataSD_NettoBrutto=ExcelData_KQ.Branch(ExcelHeaders_KQ.IndexOf("KQ_NettoBRutto_SD")).Skip(2).Select(double.Parse).ToList();
        List<double> dataMean_InnerWall_A=ExcelData_KQ.Branch(ExcelHeaders_KQ.IndexOf("KQ_InnerWall_MEAN")).Skip(2).Select(double.Parse).ToList();
        List<double> dataSD_InnerWall_A=ExcelData_KQ.Branch(ExcelHeaders_KQ.IndexOf("KQ_InnerWall_SD")).Skip(2).Select(double.Parse).ToList();
        List<double> dataMean_CoreWall_A=ExcelData_KQ.Branch(ExcelHeaders_KQ.IndexOf("KQ_CoreWall_MEAN")).Skip(2).Select(double.Parse).ToList();
        List<double> dataSD_CoreWall_A=ExcelData_KQ.Branch(ExcelHeaders_KQ.IndexOf("KQ_CoreWall_SD")).Skip(2).Select(double.Parse).ToList();
        List<double> dataMean_Heating=ExcelData_KQ.Branch(ExcelHeaders_KQ.IndexOf("KQ_Heating_MEAN")).Skip(2).Select(double.Parse).ToList();
        List<double> dataSD_Heating=ExcelData_KQ.Branch(ExcelHeaders_KQ.IndexOf("KQ_Heating_SD")).Skip(2).Select(double.Parse).ToList();
        List<double> dataMean_EL=ExcelData_KQ.Branch(ExcelHeaders_KQ.IndexOf("KQ_Electricity_MEAN")).Skip(2).Select(double.Parse).ToList();
        List<double> dataSD_EL=ExcelData_KQ.Branch(ExcelHeaders_KQ.IndexOf("KQ_Electricity_SD")).Skip(2).Select(double.Parse).ToList();
        List<double> dataMean_ELA5=ExcelData_KQ.Branch(ExcelHeaders_KQ.IndexOf("KQ_ElectricityA5_MEAN")).Skip(2).Select(double.Parse).ToList();
        List<double> dataSD_ELA5=ExcelData_KQ.Branch(ExcelHeaders_KQ.IndexOf("KQ_ElectricityA5_SD")).Skip(2).Select(double.Parse).ToList();
        List<double> dataMean_DieselA5=ExcelData_KQ.Branch(ExcelHeaders_KQ.IndexOf("KQ_DieselA5_MEAN")).Skip(2).Select(double.Parse).ToList();
        List<double> dataSD_DieselA5=ExcelData_KQ.Branch(ExcelHeaders_KQ.IndexOf("KQ_DieselA5_SD")).Skip(2).Select(double.Parse).ToList();

        List<string> data_Typology_RegressionF=ExcelData_KQ_StructuralRegressionF.Branch(ExcelHeaders_KQ_StructuralRegressionF.IndexOf("Typology")).Skip(1).ToList();
        List<string> data_StructuralMaterial_RegressionF=ExcelData_KQ_StructuralRegressionF.Branch(ExcelHeaders_KQ_StructuralRegressionF.IndexOf("LoadBearingSystem")).Skip(1).ToList();
        List<double> data_NumberOfFloors_RegressionF=ExcelData_KQ_StructuralRegressionF.Branch(ExcelHeaders_KQ_StructuralRegressionF.IndexOf("NumberOfFloors")).Skip(1).Select(double.Parse).ToList();
        List<double> data_Slaps_RegressionF=ExcelData_KQ_StructuralRegressionF.Branch(ExcelHeaders_KQ_StructuralRegressionF.IndexOf("Slaps")).Skip(1).Select(double.Parse).ToList();
        List<double> data_Beams_RegressionF=ExcelData_KQ_StructuralRegressionF.Branch(ExcelHeaders_KQ_StructuralRegressionF.IndexOf("Beams")).Skip(1).Select(double.Parse).ToList();
        List<double> data_Vertical_RegressionF=ExcelData_KQ_StructuralRegressionF.Branch(ExcelHeaders_KQ_StructuralRegressionF.IndexOf("Vertical")).Skip(1).Select(double.Parse).ToList();
        List<double> data_PointFoundation_RegressionF=ExcelData_KQ_StructuralRegressionF.Branch(ExcelHeaders_KQ_StructuralRegressionF.IndexOf("PointFoundation")).Skip(1).Select(double.Parse).ToList();
        List<string> data_TypologyBasement_RegressionF=ExcelData_KQ_StructuralRegressionF.Branch(ExcelHeaders_KQ_StructuralRegressionF.IndexOf("TypologyBasement")).Skip(1).ToList();
        List<string> data_StructuralMaterialBasement_RegressionF=ExcelData_KQ_StructuralRegressionF.Branch(ExcelHeaders_KQ_StructuralRegressionF.IndexOf("LoadBearingSystemBasement")).Skip(1).ToList();
        List<double> data_NumberOfFloorsBasement_RegressionF=ExcelData_KQ_StructuralRegressionF.Branch(ExcelHeaders_KQ_StructuralRegressionF.IndexOf("NumberOfBasementFloors")).Skip(1).Select(double.Parse).ToList();
        List<double> data_SlapsBasement_RegressionF=ExcelData_KQ_StructuralRegressionF.Branch(ExcelHeaders_KQ_StructuralRegressionF.IndexOf("SlapsBasement")).Skip(1).Select(double.Parse).ToList();
        List<double> data_BeamsBasement_RegressionF=ExcelData_KQ_StructuralRegressionF.Branch(ExcelHeaders_KQ_StructuralRegressionF.IndexOf("BeamsBasement")).Skip(1).Select(double.Parse).ToList();
        List<double> data_VerticalBasement_RegressionF=ExcelData_KQ_StructuralRegressionF.Branch(ExcelHeaders_KQ_StructuralRegressionF.IndexOf("VerticalBasement")).Skip(1).Select(double.Parse).ToList();
        List<double> data_PointFoundationBasement_RegressionF=ExcelData_KQ_StructuralRegressionF.Branch(ExcelHeaders_KQ_StructuralRegressionF.IndexOf("PointFoundationBasement")).Skip(1).Select(double.Parse).ToList();

        List<string> data_Typology_RegressionY=ExcelData_KQ_StructuralRegressionY.Branch(ExcelHeaders_KQ_StructuralRegressionY.IndexOf("Typology")).ToList();
        List<string> data_StructuralMaterial_RegressionY=ExcelData_KQ_StructuralRegressionY.Branch(ExcelHeaders_KQ_StructuralRegressionY.IndexOf("LoadBearingSystem")).ToList();
        List<double> data_Slaps_a_RegressionY=ExcelData_KQ_StructuralRegressionY.Branch(ExcelHeaders_KQ_StructuralRegressionY.IndexOf("Slaps_a")).Select(double.Parse).ToList();
        List<double> data_Beams_a_RegressionY=ExcelData_KQ_StructuralRegressionY.Branch(ExcelHeaders_KQ_StructuralRegressionY.IndexOf("Beams_a")).Select(double.Parse).ToList();
        List<double> data_Vertical_a_RegressionY=ExcelData_KQ_StructuralRegressionY.Branch(ExcelHeaders_KQ_StructuralRegressionY.IndexOf("Vertical_a")).Select(double.Parse).ToList();
        List<double> data_Vertical_b_RegressionY=ExcelData_KQ_StructuralRegressionY.Branch(ExcelHeaders_KQ_StructuralRegressionY.IndexOf("Vertical_b")).Select(double.Parse).ToList();
        List<double> data_Vertical_c_RegressionY=ExcelData_KQ_StructuralRegressionY.Branch(ExcelHeaders_KQ_StructuralRegressionY.IndexOf("Vertical_c")).Select(double.Parse).ToList();
        List<double> data_Foundation_a_RegressionY=ExcelData_KQ_StructuralRegressionY.Branch(ExcelHeaders_KQ_StructuralRegressionY.IndexOf("Foundation_a")).Select(double.Parse).ToList();
        List<double> data_Foundation_b_RegressionY=ExcelData_KQ_StructuralRegressionY.Branch(ExcelHeaders_KQ_StructuralRegressionY.IndexOf("Foundation_b")).Select(double.Parse).ToList();
        List<double> data_Foundation_c_RegressionY=ExcelData_KQ_StructuralRegressionY.Branch(ExcelHeaders_KQ_StructuralRegressionY.IndexOf("Foundation_c")).Select(double.Parse).ToList();

        List<double> data_SlapsRoof_a_RegressionY=ExcelData_KQ_StructuralRegressionY.Branch(ExcelHeaders_KQ_StructuralRegressionY.IndexOf("SlapsRoof_a")).Select(double.Parse).ToList();
        List<double> data_SlapsRoof_b_RegressionY=ExcelData_KQ_StructuralRegressionY.Branch(ExcelHeaders_KQ_StructuralRegressionY.IndexOf("SlapsRoof_b")).Select(double.Parse).ToList();
        List<double> data_BeamsRoof_a_RegressionY=ExcelData_KQ_StructuralRegressionY.Branch(ExcelHeaders_KQ_StructuralRegressionY.IndexOf("BeamsRoof_a")).Select(double.Parse).ToList();
        List<double> data_BeamsRoof_b_RegressionY=ExcelData_KQ_StructuralRegressionY.Branch(ExcelHeaders_KQ_StructuralRegressionY.IndexOf("BeamsRoof_b")).Select(double.Parse).ToList();
        List<double> data_BeamsRoof_c_RegressionY=ExcelData_KQ_StructuralRegressionY.Branch(ExcelHeaders_KQ_StructuralRegressionY.IndexOf("BeamsRoof_c")).Select(double.Parse).ToList();
        List<double> data_VerticalRoof_a_RegressionY=ExcelData_KQ_StructuralRegressionY.Branch(ExcelHeaders_KQ_StructuralRegressionY.IndexOf("VerticalRoof_a")).Select(double.Parse).ToList();
        List<double> data_VerticalRoof_b_RegressionY=ExcelData_KQ_StructuralRegressionY.Branch(ExcelHeaders_KQ_StructuralRegressionY.IndexOf("VerticalRoof_b")).Select(double.Parse).ToList();
        List<double> data_VerticalRoof_c_RegressionY=ExcelData_KQ_StructuralRegressionY.Branch(ExcelHeaders_KQ_StructuralRegressionY.IndexOf("VerticalRoof_c")).Select(double.Parse).ToList();
        List<double> data_FoundationRoof_a_RegressionY=ExcelData_KQ_StructuralRegressionY.Branch(ExcelHeaders_KQ_StructuralRegressionY.IndexOf("FoundationRoof_a")).Select(double.Parse).ToList();
        List<double> data_FoundationRoof_b_RegressionY=ExcelData_KQ_StructuralRegressionY.Branch(ExcelHeaders_KQ_StructuralRegressionY.IndexOf("FoundationRoof_b")).Select(double.Parse).ToList();
        List<double> data_FoundationRoof_c_RegressionY=ExcelData_KQ_StructuralRegressionY.Branch(ExcelHeaders_KQ_StructuralRegressionY.IndexOf("FoundationRoof_c")).Select(double.Parse).ToList();

        List<double> data_SlapsBasement_a_RegressionY=ExcelData_KQ_StructuralRegressionY.Branch(ExcelHeaders_KQ_StructuralRegressionY.IndexOf("SlapsBasement_a")).Select(double.Parse).ToList();
        List<double> data_BeamsBasement_a_RegressionY=ExcelData_KQ_StructuralRegressionY.Branch(ExcelHeaders_KQ_StructuralRegressionY.IndexOf("BeamsBasement_a")).Select(double.Parse).ToList();
        List<double> data_VerticalBasement_a_RegressionY=ExcelData_KQ_StructuralRegressionY.Branch(ExcelHeaders_KQ_StructuralRegressionY.IndexOf("VerticalBasement_a")).Select(double.Parse).ToList();
        List<double> data_VerticalBasement_b_RegressionY=ExcelData_KQ_StructuralRegressionY.Branch(ExcelHeaders_KQ_StructuralRegressionY.IndexOf("VerticalBasement_b")).Select(double.Parse).ToList();
        List<double> data_FoundationBasement_a_RegressionY=ExcelData_KQ_StructuralRegressionY.Branch(ExcelHeaders_KQ_StructuralRegressionY.IndexOf("FoundationBasement_a")).Select(double.Parse).ToList();
        List<double> data_FoundationBasement_b_RegressionY=ExcelData_KQ_StructuralRegressionY.Branch(ExcelHeaders_KQ_StructuralRegressionY.IndexOf("FoundationBasement_b")).Select(double.Parse).ToList();
   

        double f1_beams =0;
        double f2_beams  =0;
        double f3_beams  =0;
        double f4_beams  =0;
        double f5_beams  =0;      

        double f1_Slaps =0;
        double f2_Slaps  =0;
        double f3_Slaps  =0;
        double f4_Slaps  =0;
        double f5_Slaps=0;        
        
        double f1_Vertical =0;
        double f2_Vertical=0;
        double f3_Vertical=0;
        double f4_Vertical =0;
        double f5_Vertical =0;

        double f1_PointFoundation =0;
        double f2_PointFoundation =0;
        double f3_PointFoundation =0;
        double f4_PointFoundation =0;
        double f5_PointFoundation =0;

        double f1_beamsBasement =0;
        double f2_beamsBasement  =0;
        double f3_beamsBasement  =0;
        double f4_beamsBasement  =0;
        double f5_beamsBasement  =0;      

        double f1_SlapsBasement  =0;
        double f2_SlapsBasement  =0;
        double f3_SlapsBasement  =0;
        double f4_SlapsBasement  =0;
        double f5_SlapsBasement  =0;        
        
        double f1_VerticalBasement =0;
        double f2_VerticalBasement =0;
        double f3_VerticalBasement =0;
        double f4_VerticalBasement =0;
        double f5_VerticalBasement =0;

        double f1_PointFoundationBasement  =0;
        double f2_PointFoundationBasement  =0;
        double f3_PointFoundationBasement  =0;
        double f4_PointFoundationBasement  =0;
        double f5_PointFoundationBasement  =0;

        double y1_beams =0;
        double y2_beams =0;
        double y3_beams =0;
        double y4_beams =0;
        double y5_beams =0;

        double y1_Slaps =0;
        double y2_Slaps =0;
        double y3_Slaps =0;
        double y4_Slaps =0;
        double y5_Slaps =0;

        double y1_Vertical =0;
        double y2_Vertical =0;
        double y3_Vertical =0;
        double y4_Vertical =0;
        double y5_Vertical =0;
        
        double y1_PointFoundation =0;
        double y2_PointFoundation =0;
        double y3_PointFoundation =0;
        double y4_PointFoundation =0;
        double y5_PointFoundation =0;

        double y1_beams_Roof =0;
        double y2_beams_Roof =0;
        double y3_beams_Roof =0;
        double y4_beams_Roof =0;
        double y5_beams_Roof =0;

        double y1_Slaps_Roof =0;
        double y2_Slaps_Roof =0;
        double y3_Slaps_Roof =0;
        double y4_Slaps_Roof =0;
        double y5_Slaps_Roof =0;
        
        double y1_Vertical_Roof =0;
        double y2_Vertical_Roof =0;
        double y3_Vertical_Roof =0;
        double y4_Vertical_Roof =0;
        double y5_Vertical_Roof =0;
         
        double y1_PointFoundationRoof =0;
        double y2_PointFoundationRoof =0;
        double y3_PointFoundationRoof =0;
        double y4_PointFoundationRoof =0;
        double y5_PointFoundationRoof =0;
        
        double y1_beamsBasement =0;
        double y2_beamsBasement =0;
        double y3_beamsBasement =0;
        double y4_beamsBasement =0;
        double y5_beamsBasement =0;
       
        double y1_SlapsBasement =0;
        double y2_SlapsBasement =0;
        double y3_SlapsBasement =0;
        double y4_SlapsBasement =0;
        double y5_SlapsBasement =0;       
       
        double y1_VerticalBasement =0;
        double y2_VerticalBasement =0;
        double y3_VerticalBasement =0;
        double y4_VerticalBasement =0;
        double y5_VerticalBasement =0;
                
        double y1_PointFoundationBasement =0;
        double y2_PointFoundationBasement =0;
        double y3_PointFoundationBasement =0;
        double y4_PointFoundationBasement =0;
        double y5_PointFoundationBasement =0;
        
        
        
if(NumberOfFloorsAboveGround>0)
      {        
         y1_beams = 1/(FloorHeightAverage-RoofInsolationThickness/NumberOfFloorsAboveGround)*data_Beams_a_RegressionY[data_Typology_RegressionY.IndexOf(BuildingTypology)];
         y2_beams = 1/(FloorHeightAverage-RoofInsolationThickness/NumberOfFloorsAboveGround)*data_Beams_a_RegressionY[data_Typology_RegressionY.IndexOf(BuildingTypology)+1];   
         y3_beams = 1/(FloorHeightAverage-RoofInsolationThickness/NumberOfFloorsAboveGround)*data_Beams_a_RegressionY[data_Typology_RegressionY.IndexOf(BuildingTypology)+2];   
         y4_beams = 1/(FloorHeightAverage-RoofInsolationThickness/NumberOfFloorsAboveGround)*data_Beams_a_RegressionY[data_Typology_RegressionY.IndexOf(BuildingTypology)+3];       
         y5_beams = 1/(FloorHeightAverage-RoofInsolationThickness/NumberOfFloorsAboveGround)*data_Beams_a_RegressionY[data_Typology_RegressionY.IndexOf(BuildingTypology)+4];  

         y1_Slaps = 1/(FloorHeightAverage-RoofInsolationThickness/NumberOfFloorsAboveGround)*data_Slaps_a_RegressionY[data_Typology_RegressionY.IndexOf(BuildingTypology)];
         y2_Slaps = 1/(FloorHeightAverage-RoofInsolationThickness/NumberOfFloorsAboveGround)*data_Slaps_a_RegressionY[data_Typology_RegressionY.IndexOf(BuildingTypology)+1];   
         y3_Slaps = 1/(FloorHeightAverage-RoofInsolationThickness/NumberOfFloorsAboveGround)*data_Slaps_a_RegressionY[data_Typology_RegressionY.IndexOf(BuildingTypology)+2];   
         y4_Slaps = 1/(FloorHeightAverage-RoofInsolationThickness/NumberOfFloorsAboveGround)*data_Slaps_a_RegressionY[data_Typology_RegressionY.IndexOf(BuildingTypology)+3];       
         y5_Slaps = 1/(FloorHeightAverage-RoofInsolationThickness/NumberOfFloorsAboveGround)*data_Slaps_a_RegressionY[data_Typology_RegressionY.IndexOf(BuildingTypology)+4];  

         y1_Vertical = Math.Pow((FloorHeightAverage-RoofInsolationThickness/NumberOfFloorsAboveGround),2)*data_Vertical_a_RegressionY[data_Typology_RegressionY.IndexOf(BuildingTypology)]+data_Vertical_b_RegressionY[data_Typology_RegressionY.IndexOf(BuildingTypology)]*(FloorHeightAverage-RoofInsolationThickness/NumberOfFloorsAboveGround)+data_Vertical_c_RegressionY[data_Typology_RegressionY.IndexOf(BuildingTypology)];
         y2_Vertical = Math.Pow((FloorHeightAverage-RoofInsolationThickness/NumberOfFloorsAboveGround),2)*data_Vertical_a_RegressionY[data_Typology_RegressionY.IndexOf(BuildingTypology)+1]+data_Vertical_b_RegressionY[data_Typology_RegressionY.IndexOf(BuildingTypology)+1]*(FloorHeightAverage-RoofInsolationThickness/NumberOfFloorsAboveGround)+data_Vertical_c_RegressionY[data_Typology_RegressionY.IndexOf(BuildingTypology)+1];;   
         y3_Vertical = Math.Pow((FloorHeightAverage-RoofInsolationThickness/NumberOfFloorsAboveGround),2)*data_Vertical_a_RegressionY[data_Typology_RegressionY.IndexOf(BuildingTypology)+2]+data_Vertical_b_RegressionY[data_Typology_RegressionY.IndexOf(BuildingTypology)+2]*(FloorHeightAverage-RoofInsolationThickness/NumberOfFloorsAboveGround)+data_Vertical_c_RegressionY[data_Typology_RegressionY.IndexOf(BuildingTypology)+2];;   
         y4_Vertical = Math.Pow((FloorHeightAverage-RoofInsolationThickness/NumberOfFloorsAboveGround),2)*data_Vertical_a_RegressionY[data_Typology_RegressionY.IndexOf(BuildingTypology)+3]+data_Vertical_b_RegressionY[data_Typology_RegressionY.IndexOf(BuildingTypology)+3]*(FloorHeightAverage-RoofInsolationThickness/NumberOfFloorsAboveGround)+data_Vertical_c_RegressionY[data_Typology_RegressionY.IndexOf(BuildingTypology)+3];;       
         y5_Vertical = Math.Pow((FloorHeightAverage-RoofInsolationThickness/NumberOfFloorsAboveGround),2)*data_Vertical_a_RegressionY[data_Typology_RegressionY.IndexOf(BuildingTypology)+4]+data_Vertical_b_RegressionY[data_Typology_RegressionY.IndexOf(BuildingTypology)+4]*(FloorHeightAverage-RoofInsolationThickness/NumberOfFloorsAboveGround)+data_Vertical_c_RegressionY[data_Typology_RegressionY.IndexOf(BuildingTypology)+4];;  

         y1_PointFoundation = Math.Pow((FloorHeightAverage-RoofInsolationThickness/NumberOfFloorsAboveGround),2)*data_Foundation_a_RegressionY[data_Typology_RegressionY.IndexOf(BuildingTypology)]+data_Foundation_b_RegressionY[data_Typology_RegressionY.IndexOf(BuildingTypology)]*(FloorHeightAverage-RoofInsolationThickness/NumberOfFloorsAboveGround)+data_Foundation_c_RegressionY[data_Typology_RegressionY.IndexOf(BuildingTypology)];
         y2_PointFoundation = Math.Pow((FloorHeightAverage-RoofInsolationThickness/NumberOfFloorsAboveGround),2)*data_Foundation_a_RegressionY[data_Typology_RegressionY.IndexOf(BuildingTypology)+1]+data_Foundation_b_RegressionY[data_Typology_RegressionY.IndexOf(BuildingTypology)+1]*(FloorHeightAverage-RoofInsolationThickness/NumberOfFloorsAboveGround)+data_Foundation_c_RegressionY[data_Typology_RegressionY.IndexOf(BuildingTypology)+1];;   
         y3_PointFoundation = Math.Pow((FloorHeightAverage-RoofInsolationThickness/NumberOfFloorsAboveGround),2)*data_Foundation_a_RegressionY[data_Typology_RegressionY.IndexOf(BuildingTypology)+2]+data_Foundation_b_RegressionY[data_Typology_RegressionY.IndexOf(BuildingTypology)+2]*(FloorHeightAverage-RoofInsolationThickness/NumberOfFloorsAboveGround)+data_Foundation_c_RegressionY[data_Typology_RegressionY.IndexOf(BuildingTypology)+2];;   
         y4_PointFoundation = Math.Pow((FloorHeightAverage-RoofInsolationThickness/NumberOfFloorsAboveGround),2)*data_Foundation_a_RegressionY[data_Typology_RegressionY.IndexOf(BuildingTypology)+3]+data_Foundation_b_RegressionY[data_Typology_RegressionY.IndexOf(BuildingTypology)+3]*(FloorHeightAverage-RoofInsolationThickness/NumberOfFloorsAboveGround)+data_Foundation_c_RegressionY[data_Typology_RegressionY.IndexOf(BuildingTypology)+3];;       
         y5_PointFoundation = Math.Pow((FloorHeightAverage-RoofInsolationThickness/NumberOfFloorsAboveGround),2)*data_Foundation_a_RegressionY[data_Typology_RegressionY.IndexOf(BuildingTypology)+4]+data_Foundation_b_RegressionY[data_Typology_RegressionY.IndexOf(BuildingTypology)+4]*(FloorHeightAverage-RoofInsolationThickness/NumberOfFloorsAboveGround)+data_Foundation_c_RegressionY[data_Typology_RegressionY.IndexOf(BuildingTypology)+4];;  

         y1_beams_Roof = data_BeamsRoof_a_RegressionY[data_Typology_RegressionY.IndexOf(BuildingTypology)]*Math.Pow(RoofAngle,2)+data_BeamsRoof_b_RegressionY[data_Typology_RegressionY.IndexOf(BuildingTypology)]*RoofAngle+data_BeamsRoof_c_RegressionY[data_Typology_RegressionY.IndexOf(BuildingTypology)];
         y2_beams_Roof = data_BeamsRoof_a_RegressionY[data_Typology_RegressionY.IndexOf(BuildingTypology)+1]*Math.Pow(RoofAngle,2)+data_BeamsRoof_b_RegressionY[data_Typology_RegressionY.IndexOf(BuildingTypology)+1]*RoofAngle+data_BeamsRoof_c_RegressionY[data_Typology_RegressionY.IndexOf(BuildingTypology)+1];
         y3_beams_Roof =data_BeamsRoof_a_RegressionY[data_Typology_RegressionY.IndexOf(BuildingTypology)+2]*Math.Pow(RoofAngle,2)+data_BeamsRoof_b_RegressionY[data_Typology_RegressionY.IndexOf(BuildingTypology)+2]*RoofAngle+data_BeamsRoof_c_RegressionY[data_Typology_RegressionY.IndexOf(BuildingTypology)+2];
         y4_beams_Roof = data_BeamsRoof_a_RegressionY[data_Typology_RegressionY.IndexOf(BuildingTypology)+3]*Math.Pow(RoofAngle,2)+data_BeamsRoof_b_RegressionY[data_Typology_RegressionY.IndexOf(BuildingTypology)+3]*RoofAngle+data_BeamsRoof_c_RegressionY[data_Typology_RegressionY.IndexOf(BuildingTypology)+3];    
         y5_beams_Roof = data_BeamsRoof_a_RegressionY[data_Typology_RegressionY.IndexOf(BuildingTypology)+4]*Math.Pow(RoofAngle,2)+data_BeamsRoof_b_RegressionY[data_Typology_RegressionY.IndexOf(BuildingTypology)+4]*RoofAngle+data_BeamsRoof_c_RegressionY[data_Typology_RegressionY.IndexOf(BuildingTypology)+4];

         y1_Slaps_Roof = data_SlapsRoof_a_RegressionY[data_Typology_RegressionY.IndexOf(BuildingTypology)]*RoofAngle+data_SlapsRoof_b_RegressionY[data_Typology_RegressionY.IndexOf(BuildingTypology)];
         y2_Slaps_Roof = data_SlapsRoof_a_RegressionY[data_Typology_RegressionY.IndexOf(BuildingTypology)+1]*RoofAngle+data_SlapsRoof_b_RegressionY[data_Typology_RegressionY.IndexOf(BuildingTypology)+1];
         y3_Slaps_Roof = data_SlapsRoof_a_RegressionY[data_Typology_RegressionY.IndexOf(BuildingTypology)+2]*RoofAngle+data_SlapsRoof_b_RegressionY[data_Typology_RegressionY.IndexOf(BuildingTypology)+2];
         y4_Slaps_Roof = data_SlapsRoof_a_RegressionY[data_Typology_RegressionY.IndexOf(BuildingTypology)+3]*RoofAngle+data_SlapsRoof_b_RegressionY[data_Typology_RegressionY.IndexOf(BuildingTypology)+3];  
         y5_Slaps_Roof = data_SlapsRoof_a_RegressionY[data_Typology_RegressionY.IndexOf(BuildingTypology)+4]*RoofAngle+data_SlapsRoof_b_RegressionY[data_Typology_RegressionY.IndexOf(BuildingTypology)+4];

         y1_Vertical_Roof = data_VerticalRoof_a_RegressionY[data_Typology_RegressionY.IndexOf(BuildingTypology)+0]*Math.Pow(RoofAngle,2)+data_VerticalRoof_b_RegressionY[data_Typology_RegressionY.IndexOf(BuildingTypology)+0]*RoofAngle+data_VerticalRoof_c_RegressionY[data_Typology_RegressionY.IndexOf(BuildingTypology)+0];
         y2_Vertical_Roof = data_VerticalRoof_a_RegressionY[data_Typology_RegressionY.IndexOf(BuildingTypology)+1]*Math.Pow(RoofAngle,2)+data_VerticalRoof_b_RegressionY[data_Typology_RegressionY.IndexOf(BuildingTypology)+1]*RoofAngle+data_VerticalRoof_c_RegressionY[data_Typology_RegressionY.IndexOf(BuildingTypology)+1];
         y3_Vertical_Roof = data_VerticalRoof_a_RegressionY[data_Typology_RegressionY.IndexOf(BuildingTypology)+2]*Math.Pow(RoofAngle,2)+data_VerticalRoof_b_RegressionY[data_Typology_RegressionY.IndexOf(BuildingTypology)+2]*RoofAngle+data_VerticalRoof_c_RegressionY[data_Typology_RegressionY.IndexOf(BuildingTypology)+2];
         y4_Vertical_Roof = data_VerticalRoof_a_RegressionY[data_Typology_RegressionY.IndexOf(BuildingTypology)+3]*Math.Pow(RoofAngle,2)+data_VerticalRoof_b_RegressionY[data_Typology_RegressionY.IndexOf(BuildingTypology)+3]*RoofAngle+data_VerticalRoof_c_RegressionY[data_Typology_RegressionY.IndexOf(BuildingTypology)+3];
         y5_Vertical_Roof = data_VerticalRoof_a_RegressionY[data_Typology_RegressionY.IndexOf(BuildingTypology)+4]*Math.Pow(RoofAngle,2)+data_VerticalRoof_b_RegressionY[data_Typology_RegressionY.IndexOf(BuildingTypology)+4]*RoofAngle+data_VerticalRoof_c_RegressionY[data_Typology_RegressionY.IndexOf(BuildingTypology)+4];
        
        y1_PointFoundationRoof = Math.Pow(RoofAngle,2)*data_FoundationRoof_a_RegressionY[data_Typology_RegressionY.IndexOf(BuildingTypology)+0]+data_FoundationRoof_b_RegressionY[data_Typology_RegressionY.IndexOf(BuildingTypology)+0]*RoofAngle+data_FoundationRoof_c_RegressionY[data_Typology_RegressionY.IndexOf(BuildingTypology)];
         y2_PointFoundationRoof = Math.Pow(RoofAngle,2)*data_FoundationRoof_a_RegressionY[data_Typology_RegressionY.IndexOf(BuildingTypology)+1]+data_FoundationRoof_b_RegressionY[data_Typology_RegressionY.IndexOf(BuildingTypology)+1]*RoofAngle+data_FoundationRoof_c_RegressionY[data_Typology_RegressionY.IndexOf(BuildingTypology)+1];;   
         y3_PointFoundationRoof = Math.Pow(RoofAngle,2)*data_FoundationRoof_a_RegressionY[data_Typology_RegressionY.IndexOf(BuildingTypology)+2]+data_FoundationRoof_b_RegressionY[data_Typology_RegressionY.IndexOf(BuildingTypology)+2]*RoofAngle+data_FoundationRoof_c_RegressionY[data_Typology_RegressionY.IndexOf(BuildingTypology)+2];;   
         y4_PointFoundationRoof = Math.Pow(RoofAngle,2)*data_FoundationRoof_a_RegressionY[data_Typology_RegressionY.IndexOf(BuildingTypology)+3]+data_FoundationRoof_b_RegressionY[data_Typology_RegressionY.IndexOf(BuildingTypology)+3]*RoofAngle+data_FoundationRoof_c_RegressionY[data_Typology_RegressionY.IndexOf(BuildingTypology)+3];;       
         y5_PointFoundationRoof = Math.Pow(RoofAngle,2)*data_FoundationRoof_a_RegressionY[data_Typology_RegressionY.IndexOf(BuildingTypology)+4]+data_FoundationRoof_b_RegressionY[data_Typology_RegressionY.IndexOf(BuildingTypology)+4]*RoofAngle+data_FoundationRoof_c_RegressionY[data_Typology_RegressionY.IndexOf(BuildingTypology)+4];;  

         f1_beams = data_Beams_RegressionF[data_Typology_RegressionF.IndexOf(BuildingTypology)+NumberOfFloorsAboveGround-1+30*0];
         f2_beams = data_Beams_RegressionF[data_Typology_RegressionF.IndexOf(BuildingTypology)+NumberOfFloorsAboveGround-1+30*1];
         f3_beams = data_Beams_RegressionF[data_Typology_RegressionF.IndexOf(BuildingTypology)+NumberOfFloorsAboveGround-1+30*2]; 
         f4_beams = data_Beams_RegressionF[data_Typology_RegressionF.IndexOf(BuildingTypology)+NumberOfFloorsAboveGround-1+30*3];
         f5_beams = data_Beams_RegressionF[data_Typology_RegressionF.IndexOf(BuildingTypology)+NumberOfFloorsAboveGround-1+30*4];

         f1_Slaps = data_Slaps_RegressionF[data_Typology_RegressionF.IndexOf(BuildingTypology)+NumberOfFloorsAboveGround-1+30*0];
         f2_Slaps = data_Slaps_RegressionF[data_Typology_RegressionF.IndexOf(BuildingTypology)+NumberOfFloorsAboveGround-1+30*1];
         f3_Slaps = data_Slaps_RegressionF[data_Typology_RegressionF.IndexOf(BuildingTypology)+NumberOfFloorsAboveGround-1+30*2]; 
         f4_Slaps = data_Slaps_RegressionF[data_Typology_RegressionF.IndexOf(BuildingTypology)+NumberOfFloorsAboveGround-1+30*3];
         f5_Slaps = data_Slaps_RegressionF[data_Typology_RegressionF.IndexOf(BuildingTypology)+NumberOfFloorsAboveGround-1+30*4];

         f1_Vertical = data_Vertical_RegressionF[data_Typology_RegressionF.IndexOf(BuildingTypology)+NumberOfFloorsAboveGround-1+30*0];
         f2_Vertical = data_Vertical_RegressionF[data_Typology_RegressionF.IndexOf(BuildingTypology)+NumberOfFloorsAboveGround-1+30*1];
         f3_Vertical = data_Vertical_RegressionF[data_Typology_RegressionF.IndexOf(BuildingTypology)+NumberOfFloorsAboveGround-1+30*2]; 
         f4_Vertical = data_Vertical_RegressionF[data_Typology_RegressionF.IndexOf(BuildingTypology)+NumberOfFloorsAboveGround-1+30*3];
         f5_Vertical = data_Vertical_RegressionF[data_Typology_RegressionF.IndexOf(BuildingTypology)+NumberOfFloorsAboveGround-1+30*4];

         f1_PointFoundation = data_PointFoundation_RegressionF[data_Typology_RegressionF.IndexOf(BuildingTypology)+NumberOfFloorsAboveGround-1+30*0];
         f2_PointFoundation = data_PointFoundation_RegressionF[data_Typology_RegressionF.IndexOf(BuildingTypology)+NumberOfFloorsAboveGround-1+30*1];
         f3_PointFoundation = data_PointFoundation_RegressionF[data_Typology_RegressionF.IndexOf(BuildingTypology)+NumberOfFloorsAboveGround-1+30*2];
         f4_PointFoundation = data_PointFoundation_RegressionF[data_Typology_RegressionF.IndexOf(BuildingTypology)+NumberOfFloorsAboveGround-1+30*3];
         f5_PointFoundation = data_PointFoundation_RegressionF[data_Typology_RegressionF.IndexOf(BuildingTypology)+NumberOfFloorsAboveGround-1+30*4];
    }

       
if(NumberOfFloorsBellowGround>0)
{
         y1_beamsBasement = 1/FloorHeightBasementAverage*data_BeamsBasement_a_RegressionY[data_Typology_RegressionY.IndexOf(BuildingTypology)];
         y2_beamsBasement = 1/FloorHeightBasementAverage*data_BeamsBasement_a_RegressionY[data_Typology_RegressionY.IndexOf(BuildingTypology)+1];   
         y3_beamsBasement = 1/FloorHeightBasementAverage*data_BeamsBasement_a_RegressionY[data_Typology_RegressionY.IndexOf(BuildingTypology)+2];   
         y4_beamsBasement = 1/FloorHeightBasementAverage*data_BeamsBasement_a_RegressionY[data_Typology_RegressionY.IndexOf(BuildingTypology)+3];       
         y5_beamsBasement = 1/FloorHeightBasementAverage*data_BeamsBasement_a_RegressionY[data_Typology_RegressionY.IndexOf(BuildingTypology)+4];  

         y1_SlapsBasement = 1/FloorHeightBasementAverage*data_SlapsBasement_a_RegressionY[data_Typology_RegressionY.IndexOf(BuildingTypology)];
         y2_SlapsBasement = 1/FloorHeightBasementAverage*data_SlapsBasement_a_RegressionY[data_Typology_RegressionY.IndexOf(BuildingTypology)+1];   
         y3_SlapsBasement = 1/FloorHeightBasementAverage*data_SlapsBasement_a_RegressionY[data_Typology_RegressionY.IndexOf(BuildingTypology)+2];   
         y4_SlapsBasement = 1/FloorHeightBasementAverage*data_SlapsBasement_a_RegressionY[data_Typology_RegressionY.IndexOf(BuildingTypology)+3];       
         y5_SlapsBasement = 1/FloorHeightBasementAverage*data_SlapsBasement_a_RegressionY[data_Typology_RegressionY.IndexOf(BuildingTypology)+4];  

         y1_VerticalBasement = Math.Pow(FloorHeightBasementAverage,1)*data_VerticalBasement_a_RegressionY[data_Typology_RegressionY.IndexOf(BuildingTypology)]+data_VerticalBasement_b_RegressionY[data_Typology_RegressionY.IndexOf(BuildingTypology)];
         y2_VerticalBasement = Math.Pow(FloorHeightBasementAverage,1)*data_VerticalBasement_a_RegressionY[data_Typology_RegressionY.IndexOf(BuildingTypology)+1]+data_VerticalBasement_b_RegressionY[data_Typology_RegressionY.IndexOf(BuildingTypology)+1];   
         y3_VerticalBasement = Math.Pow(FloorHeightBasementAverage,1)*data_VerticalBasement_a_RegressionY[data_Typology_RegressionY.IndexOf(BuildingTypology)+2]+data_VerticalBasement_b_RegressionY[data_Typology_RegressionY.IndexOf(BuildingTypology)+2];   
         y4_VerticalBasement = Math.Pow(FloorHeightBasementAverage,1)*data_VerticalBasement_a_RegressionY[data_Typology_RegressionY.IndexOf(BuildingTypology)+3]+data_VerticalBasement_b_RegressionY[data_Typology_RegressionY.IndexOf(BuildingTypology)+3];       
         y5_VerticalBasement = Math.Pow(FloorHeightBasementAverage,1)*data_VerticalBasement_a_RegressionY[data_Typology_RegressionY.IndexOf(BuildingTypology)+4]+data_VerticalBasement_b_RegressionY[data_Typology_RegressionY.IndexOf(BuildingTypology)+4];  

         y1_PointFoundationBasement = data_FoundationBasement_a_RegressionY[data_Typology_RegressionY.IndexOf(BuildingTypology)+0]*Math.Pow(FloorHeightBasementAverage,data_FoundationBasement_b_RegressionY[data_Typology_RegressionY.IndexOf(BuildingTypology)+0]);
         y2_PointFoundationBasement = data_FoundationBasement_a_RegressionY[data_Typology_RegressionY.IndexOf(BuildingTypology)+1]*Math.Pow(FloorHeightBasementAverage,data_FoundationBasement_b_RegressionY[data_Typology_RegressionY.IndexOf(BuildingTypology)+1]);
         y3_PointFoundationBasement = data_FoundationBasement_a_RegressionY[data_Typology_RegressionY.IndexOf(BuildingTypology)+2]*Math.Pow(FloorHeightBasementAverage,data_FoundationBasement_b_RegressionY[data_Typology_RegressionY.IndexOf(BuildingTypology)+2]);
         y4_PointFoundationBasement = data_FoundationBasement_a_RegressionY[data_Typology_RegressionY.IndexOf(BuildingTypology)+3]*Math.Pow(FloorHeightBasementAverage,data_FoundationBasement_b_RegressionY[data_Typology_RegressionY.IndexOf(BuildingTypology)+3]);
         y5_PointFoundationBasement = data_FoundationBasement_a_RegressionY[data_Typology_RegressionY.IndexOf(BuildingTypology)+4]*Math.Pow(FloorHeightBasementAverage,data_FoundationBasement_b_RegressionY[data_Typology_RegressionY.IndexOf(BuildingTypology)+4]);
        
         f1_beamsBasement = data_BeamsBasement_RegressionF[data_TypologyBasement_RegressionF.IndexOf(BuildingTypology)+NumberOfFloorsBellowGround-1+4*0];
         f2_beamsBasement = data_BeamsBasement_RegressionF[data_TypologyBasement_RegressionF.IndexOf(BuildingTypology)+NumberOfFloorsBellowGround-1+4*1];
         f3_beamsBasement = data_BeamsBasement_RegressionF[data_TypologyBasement_RegressionF.IndexOf(BuildingTypology)+NumberOfFloorsBellowGround-1+4*2]; 
         f4_beamsBasement = data_BeamsBasement_RegressionF[data_TypologyBasement_RegressionF.IndexOf(BuildingTypology)+NumberOfFloorsBellowGround-1+4*3];
         f5_beamsBasement = data_BeamsBasement_RegressionF[data_TypologyBasement_RegressionF.IndexOf(BuildingTypology)+NumberOfFloorsBellowGround-1+4*4];

         f1_SlapsBasement = data_SlapsBasement_RegressionF[data_TypologyBasement_RegressionF.IndexOf(BuildingTypology)+NumberOfFloorsBellowGround-1+4*0];
         f2_SlapsBasement = data_SlapsBasement_RegressionF[data_TypologyBasement_RegressionF.IndexOf(BuildingTypology)+NumberOfFloorsBellowGround-1+4*1];
         f3_SlapsBasement = data_SlapsBasement_RegressionF[data_TypologyBasement_RegressionF.IndexOf(BuildingTypology)+NumberOfFloorsBellowGround-1+4*2]; 
         f4_SlapsBasement = data_SlapsBasement_RegressionF[data_TypologyBasement_RegressionF.IndexOf(BuildingTypology)+NumberOfFloorsBellowGround-1+4*3];
         f5_SlapsBasement = data_SlapsBasement_RegressionF[data_TypologyBasement_RegressionF.IndexOf(BuildingTypology)+NumberOfFloorsBellowGround-1+4*4];

         f1_VerticalBasement = data_VerticalBasement_RegressionF[data_TypologyBasement_RegressionF.IndexOf(BuildingTypology)+NumberOfFloorsBellowGround-1+4*0];
         f2_VerticalBasement = data_VerticalBasement_RegressionF[data_TypologyBasement_RegressionF.IndexOf(BuildingTypology)+NumberOfFloorsBellowGround-1+4*1];
         f3_VerticalBasement = data_VerticalBasement_RegressionF[data_TypologyBasement_RegressionF.IndexOf(BuildingTypology)+NumberOfFloorsBellowGround-1+4*2]; 
         f4_VerticalBasement = data_VerticalBasement_RegressionF[data_TypologyBasement_RegressionF.IndexOf(BuildingTypology)+NumberOfFloorsBellowGround-1+4*3];
         f5_VerticalBasement = data_VerticalBasement_RegressionF[data_TypologyBasement_RegressionF.IndexOf(BuildingTypology)+NumberOfFloorsBellowGround-1+4*4];

         f1_PointFoundationBasement = data_PointFoundationBasement_RegressionF[data_TypologyBasement_RegressionF.IndexOf(BuildingTypology)+NumberOfFloorsBellowGround-1+4*0];
         f2_PointFoundationBasement = data_PointFoundationBasement_RegressionF[data_TypologyBasement_RegressionF.IndexOf(BuildingTypology)+NumberOfFloorsBellowGround-1+4*1];
         f3_PointFoundationBasement = data_PointFoundationBasement_RegressionF[data_TypologyBasement_RegressionF.IndexOf(BuildingTypology)+NumberOfFloorsBellowGround-1+4*2];
         f4_PointFoundationBasement = data_PointFoundationBasement_RegressionF[data_TypologyBasement_RegressionF.IndexOf(BuildingTypology)+NumberOfFloorsBellowGround-1+4*3];
         f5_PointFoundationBasement = data_PointFoundationBasement_RegressionF[data_TypologyBasement_RegressionF.IndexOf(BuildingTypology)+NumberOfFloorsBellowGround-1+4*4];
    }

    
        //Emission Keys:
        //data_Typology=ExcelData_KE.Branch(ExcelHeaders_KQ.IndexOf("Typologi")).Skip(2).ToList(); 
        List<double> dataMean_Window=ExcelData_KE.Branch(ExcelHeaders_KE.IndexOf("KE_Window_MEAN")).Skip(2).Select(double.Parse).ToList();
        List<double> dataSD_Window=ExcelData_KE.Branch(ExcelHeaders_KE.IndexOf("KE_Window_SD")).Skip(2).Select(double.Parse).ToList();
        List<double> dataMean_Facade=ExcelData_KE.Branch(ExcelHeaders_KE.IndexOf("KE_Facade_MEAN")).Skip(2).Select(double.Parse).ToList();
        List<double> dataSD_Facade=ExcelData_KE.Branch(ExcelHeaders_KE.IndexOf("KE_Facade_SD")).Skip(2).Select(double.Parse).ToList();
        List<double> dataMean_FacadeBasement=ExcelData_KE.Branch(ExcelHeaders_KE.IndexOf("KE_FacadeBasement_MEAN")).Skip(2).Select(double.Parse).ToList();
        List<double> dataSD_FacadeBasement=ExcelData_KE.Branch(ExcelHeaders_KE.IndexOf("KE_FacadeBasement_SD")).Skip(2).Select(double.Parse).ToList();
        List<double> dataMean_GroundSlap=ExcelData_KE.Branch(ExcelHeaders_KE.IndexOf("KE_GroundSlap_MEAN")).Skip(2).Select(double.Parse).ToList();
        List<double> dataSD_GroundSlap=ExcelData_KE.Branch(ExcelHeaders_KE.IndexOf("KE_GroundSlap_SD")).Skip(2).Select(double.Parse).ToList();
        List<double> dataMean_BasementGroundSlap=ExcelData_KE.Branch(ExcelHeaders_KE.IndexOf("KE_BasementGroundSlap_MEAN")).Skip(2).Select(double.Parse).ToList();
        List<double> dataSD_BasementGroundSlap=ExcelData_KE.Branch(ExcelHeaders_KE.IndexOf("KE_BasementGroundSlap_SD")).Skip(2).Select(double.Parse).ToList();
        List<double> dataMean_Roof=ExcelData_KE.Branch(ExcelHeaders_KE.IndexOf("KE_Roof_MEAN")).Skip(2).Select(double.Parse).ToList();
        List<double> dataSD_Roof=ExcelData_KE.Branch(ExcelHeaders_KE.IndexOf("KE_Roof_SD")).Skip(2).Select(double.Parse).ToList();
        List<double> dataMean_CoreWall=ExcelData_KE.Branch(ExcelHeaders_KE.IndexOf("KE_CoreWall_MEAN")).Skip(2).Select(double.Parse).ToList();
        List<double> dataSD_CoreWall=ExcelData_KE.Branch(ExcelHeaders_KE.IndexOf("KE_CoreWall_SD")).Skip(2).Select(double.Parse).ToList();
        List<double> dataMean_InnerWall=ExcelData_KE.Branch(ExcelHeaders_KE.IndexOf("KE_InnerWall_MEAN")).Skip(2).Select(double.Parse).ToList();
        List<double> dataSD_InnerWall=ExcelData_KE.Branch(ExcelHeaders_KE.IndexOf("KE_InnerWall_SD")).Skip(2).Select(double.Parse).ToList();
        List<double> dataMean_FireWall=ExcelData_KE.Branch(ExcelHeaders_KE.IndexOf("KE_FireWall_MEAN")).Skip(2).Select(double.Parse).ToList();
        List<double> dataSD_FireWall=ExcelData_KE.Branch(ExcelHeaders_KE.IndexOf("KE_FireWall_SD")).Skip(2).Select(double.Parse).ToList();
        List<double> dataMean_Floor=ExcelData_KE.Branch(ExcelHeaders_KE.IndexOf("KE_Floor_MEAN")).Skip(2).Select(double.Parse).ToList();
        List<double> dataSD_Floor=ExcelData_KE.Branch(ExcelHeaders_KE.IndexOf("KE_Floor_SD")).Skip(2).Select(double.Parse).ToList();
        List<double> dataMean_Ceiling=ExcelData_KE.Branch(ExcelHeaders_KE.IndexOf("KE_Ceiling_MEAN")).Skip(2).Select(double.Parse).ToList();
        List<double> dataSD_Ceiling=ExcelData_KE.Branch(ExcelHeaders_KE.IndexOf("KE_Ceiling_SD")).Skip(2).Select(double.Parse).ToList();
        List<double> dataMean_Utilities=ExcelData_KE.Branch(ExcelHeaders_KE.IndexOf("KE_Utilities_MEAN")).Skip(2).Select(double.Parse).ToList();
        List<double> dataSD_Utilities=ExcelData_KE.Branch(ExcelHeaders_KE.IndexOf("KE_Utilities_SD")).Skip(2).Select(double.Parse).ToList();
        List<double> dataMean_Stairs=ExcelData_KE.Branch(ExcelHeaders_KE.IndexOf("KE_Stairs_MEAN")).Skip(2).Select(double.Parse).ToList();
        List<double> dataSD_Stairs=ExcelData_KE.Branch(ExcelHeaders_KE.IndexOf("KE_Stairs_SD")).Skip(2).Select(double.Parse).ToList();
        List<double> dataMean_ElevatorMeter=ExcelData_KE.Branch(ExcelHeaders_KE.IndexOf("KE_ElevatorMeter_MEAN")).Skip(2).Select(double.Parse).ToList();
        List<double> dataSD_ElevatorMeter=ExcelData_KE.Branch(ExcelHeaders_KE.IndexOf("KE_ElevatorMeter_SD")).Skip(2).Select(double.Parse).ToList();
        List<double> dataMean_ElevatorCount=ExcelData_KE.Branch(ExcelHeaders_KE.IndexOf("KE_ElevatorCounts_MEAN")).Skip(2).Select(double.Parse).ToList();
        List<double> dataSD_ElevatorCount=ExcelData_KE.Branch(ExcelHeaders_KE.IndexOf("KE_ElevatorCounts_SD")).Skip(2).Select(double.Parse).ToList();

        List<string> data_StructuralMaterial_KE=ExcelData_KE_Structural.Branch(ExcelHeaders_KE_Structural.IndexOf("LoadBearingSystem")).Skip(1).ToList();
        List<double> data_LineFoundationLowTypology_KE=ExcelData_KE_Structural.Branch(ExcelHeaders_KE_Structural.IndexOf("LineFoundation_LowTypology")).Skip(1).Select(double.Parse).ToList();
        List<double> data_PointFoundationLowTypology_KE=ExcelData_KE_Structural.Branch(ExcelHeaders_KE_Structural.IndexOf("PointFoundation_LowTypology")).Skip(1).Select(double.Parse).ToList();
        List<double> data_SlapsLowTypology_KE=ExcelData_KE_Structural.Branch(ExcelHeaders_KE_Structural.IndexOf("Slaps_LowTypology")).Skip(1).Select(double.Parse).ToList();
        List<double> data_SlapBasementLowTypology_KE=ExcelData_KE_Structural.Branch(ExcelHeaders_KE_Structural.IndexOf("SlapsBasement_LowTypology")).Skip(1).Select(double.Parse).ToList();
        List<double> data_BeamsLowTypology_KE=ExcelData_KE_Structural.Branch(ExcelHeaders_KE_Structural.IndexOf("Beams_LowTypology")).Skip(1).Select(double.Parse).ToList();
        List<double> data_BeamsBasementLowTypology_KE=ExcelData_KE_Structural.Branch(ExcelHeaders_KE_Structural.IndexOf("BeamsBasement_LowTypology")).Skip(1).Select(double.Parse).ToList();
        List<double> data_VerticalLowTypology_KE=ExcelData_KE_Structural.Branch(ExcelHeaders_KE_Structural.IndexOf("Vertical_LowTypology")).Skip(1).Select(double.Parse).ToList();
        List<double> data_VerticalBasementLowTypology_KE=ExcelData_KE_Structural.Branch(ExcelHeaders_KE_Structural.IndexOf("VerticalBasement_LowTypology")).Skip(1).Select(double.Parse).ToList();
        List<double> data_LineFoundation_KE=ExcelData_KE_Structural.Branch(ExcelHeaders_KE_Structural.IndexOf("LineFoundation")).Skip(1).Select(double.Parse).ToList();
        List<double> data_PointFoundation_KE=ExcelData_KE_Structural.Branch(ExcelHeaders_KE_Structural.IndexOf("PointFoundation")).Skip(1).Select(double.Parse).ToList();
        List<double> data_Slaps_KE=ExcelData_KE_Structural.Branch(ExcelHeaders_KE_Structural.IndexOf("Slaps")).Skip(1).Select(double.Parse).ToList();
        List<double> data_SlapBasement_KE=ExcelData_KE_Structural.Branch(ExcelHeaders_KE_Structural.IndexOf("SlapsBasement")).Skip(1).Select(double.Parse).ToList();
        List<double> data_Beams_KE=ExcelData_KE_Structural.Branch(ExcelHeaders_KE_Structural.IndexOf("Beams")).Skip(1).Select(double.Parse).ToList();
        List<double> data_BeamsBasement_KE=ExcelData_KE_Structural.Branch(ExcelHeaders_KE_Structural.IndexOf("BeamsBasement")).Skip(1).Select(double.Parse).ToList();
        List<double> data_Vertical_KE=ExcelData_KE_Structural.Branch(ExcelHeaders_KE_Structural.IndexOf("Vertical")).Skip(1).Select(double.Parse).ToList();
        List<double> data_VerticalBasement_KE=ExcelData_KE_Structural.Branch(ExcelHeaders_KE_Structural.IndexOf("VerticalBasement")).Skip(1).Select(double.Parse).ToList();
        List<double> data_DemolitionC1_KE=ExcelData_KE_Structural.Branch(ExcelHeaders_KE_Structural.IndexOf("DemolitionC1")).Skip(1).Select(double.Parse).ToList();
        
        //Preservation:
        List<string> data_Preservation=ExcelData_Preservation.Branch(ExcelHeaders_Preservation.IndexOf("ReplacementFactor")).Skip(2).ToList(); 
        List<double>dataMean_Foundation_P=ExcelData_Preservation.Branch(ExcelHeaders_Preservation.IndexOf("Foundation_MEAN")).Skip(2).Select(double.Parse).ToList();
        List<double>dataSD_Foundation_P=ExcelData_Preservation.Branch(ExcelHeaders_Preservation.IndexOf("Foundation_SD")).Skip(2).Select(double.Parse).ToList();
        List<double>dataMean_Structural_P=ExcelData_Preservation.Branch(ExcelHeaders_Preservation.IndexOf("Structural_MEAN")).Skip(2).Select(double.Parse).ToList();
        List<double>dataSD_Structural_P=ExcelData_Preservation.Branch(ExcelHeaders_Preservation.IndexOf("Structural_SD")).Skip(2).Select(double.Parse).ToList();
        List<double>dataMean_Envelope_P=ExcelData_Preservation.Branch(ExcelHeaders_Preservation.IndexOf("Envelope_MEAN")).Skip(2).Select(double.Parse).ToList();
        List<double>dataSD_Envelope_P=ExcelData_Preservation.Branch(ExcelHeaders_Preservation.IndexOf("Envelope_SD")).Skip(2).Select(double.Parse).ToList();
        List<double>dataMean_Window_P=ExcelData_Preservation.Branch(ExcelHeaders_Preservation.IndexOf("Window_MEAN")).Skip(2).Select(double.Parse).ToList();
        List<double>dataSD_Window_P=ExcelData_Preservation.Branch(ExcelHeaders_Preservation.IndexOf("Window_SD")).Skip(2).Select(double.Parse).ToList();
        List<double>dataMean_Interior_P=ExcelData_Preservation.Branch(ExcelHeaders_Preservation.IndexOf("Interior_MEAN")).Skip(2).Select(double.Parse).ToList();
        List<double>dataSD_Interior_P=ExcelData_Preservation.Branch(ExcelHeaders_Preservation.IndexOf("Interior_SD")).Skip(2).Select(double.Parse).ToList();
        List<double>dataMean_Technical_P=ExcelData_Preservation.Branch(ExcelHeaders_Preservation.IndexOf("Technical_MEAN")).Skip(2).Select(double.Parse).ToList();
        List<double>dataSD_Technical_P=ExcelData_Preservation.Branch(ExcelHeaders_Preservation.IndexOf("Technical_SD")).Skip(2).Select(double.Parse).ToList();
        List<double>dataMean_ConstructionA5_P=ExcelData_Preservation.Branch(ExcelHeaders_Preservation.IndexOf("ConstructionA5_MEAN")).Skip(2).Select(double.Parse).ToList();
        List<double>dataSD_ConstructionA5_P=ExcelData_Preservation.Branch(ExcelHeaders_Preservation.IndexOf("ConstructionA5_SD")).Skip(2).Select(double.Parse).ToList();
        List<double>dataMean_Energy_P=ExcelData_Preservation.Branch(ExcelHeaders_Preservation.IndexOf("Energy_MEAN")).Skip(2).Select(double.Parse).ToList();
        List<double>dataSD_Energy_P=ExcelData_Preservation.Branch(ExcelHeaders_Preservation.IndexOf("Energy_SD")).Skip(2).Select(double.Parse).ToList();
        List<double>dataMean_Demolition_P=ExcelData_Preservation.Branch(ExcelHeaders_Preservation.IndexOf("Demolition_MEAN")).Skip(2).Select(double.Parse).ToList();
        List<double>dataSD_Demolition_P=ExcelData_Preservation.Branch(ExcelHeaders_Preservation.IndexOf("Demolition_SD")).Skip(2).Select(double.Parse).ToList();
        
        //Energy Emission:
        List<double> data_Year=ExcelData_Energy.Branch(ExcelHeaders_Energy.IndexOf("year")).Skip(2).Select(double.Parse).ToList(); 
        List<double>data_Heating_KE=ExcelData_Energy.Branch(ExcelHeaders_Energy.IndexOf("DisctrictHeating")).Skip(2).Select(double.Parse).ToList();
        List<double>data_EL_KE=ExcelData_Energy.Branch(ExcelHeaders_Energy.IndexOf("El")).Skip(2).Select(double.Parse).ToList();
        List<double>data_Gass_KE=ExcelData_Energy.Branch(ExcelHeaders_Energy.IndexOf("Gas")).Skip(2).Select(double.Parse).ToList();
        List<double>data_Diesel_KE=ExcelData_Energy.Branch(ExcelHeaders_Energy.IndexOf("Diesel")).Skip(2).Select(double.Parse).ToList();
        
        //________________QUANTITIES:___________________________________
       
          

        //Mean and Standard Deviation of Key quantities:
        double WWR_Mean = dataMean_WWR[data_Typology.IndexOf(BuildingTypology)]; 
        double WWR_SD = dataSD_WWR[data_Typology.IndexOf(BuildingTypology)];              
        double NettoBrutto_Mean = dataMean_NettoBrutto[data_Typology.IndexOf(BuildingTypology)]; 
        double NettoBrutto_SD = dataSD_NettoBrutto[data_Typology.IndexOf(BuildingTypology)]; 
        double InnerWall_Q_Mean = dataMean_InnerWall_A[data_Typology.IndexOf(BuildingTypology)]; 
        double InnerWall_Q_SD = dataSD_InnerWall_A[data_Typology.IndexOf(BuildingTypology)]; 
        double CoreWall_Q_Mean = dataMean_CoreWall_A[data_Typology.IndexOf(BuildingTypology)]; 
        double CoreWall_Q_SD = dataSD_CoreWall_A[data_Typology.IndexOf(BuildingTypology)]; 
        double Heating_Q_Mean = dataMean_Heating[data_Typology.IndexOf(BuildingTypology)]; 
        double Heating_Q_SD = dataSD_Heating[data_Typology.IndexOf(BuildingTypology)];
        double EL_Q_Mean = dataMean_EL[data_Typology.IndexOf(BuildingTypology)]; 
        double EL_Q_SD = dataSD_EL[data_Typology.IndexOf(BuildingTypology)];  
        double ELA5_Q_Mean = dataMean_ELA5[data_Typology.IndexOf(BuildingTypology)]; 
        double ELA5_Q_SD = dataSD_ELA5[data_Typology.IndexOf(BuildingTypology)];  
        double DieselA5_Q_Mean = dataMean_DieselA5[data_Typology.IndexOf(BuildingTypology)]; 
        double DieselA5_Q_SD = dataSD_DieselA5[data_Typology.IndexOf(BuildingTypology)];     
        
        
		
        //_ENVELOPE_,
		double FacadeArea_mean = AreaFacade*(1-WWR_Mean); 
        double FacadeArea_SD = AreaFacade*(WWR_SD);
		double RoofArea =AreaRoof;

        
		
        //_WINDOW_,
		double WindowArea_mean = AreaFacade*(WWR_Mean); 
        double WindowArea_SD = AreaFacade*(WWR_SD);  

        
        
        //_INTERIOR_,
        double AverageInnerWallHeight = ((FloorHeightAverage-RoofInsolationThickness/NumberOfFloorsAboveGround-SlapThickness)*NumberOfFloorsAboveGround+(FloorHeightBasementAverage-SlapThickness)*NumberOfFloorsBellowGround)/(NumberOfFloorsAboveGround+NumberOfFloorsBellowGround);
		
        double FloorCeilingArea_mean=AreaGrossFloor*NettoBrutto_Mean; 
		double FloorCeilingArea_SD=AreaGrossFloor*NettoBrutto_SD;
		double InnerWallArea_mean=FloorCeilingArea_mean*InnerWall_Q_Mean*AverageInnerWallHeight; 
		double InnerWallArea_SD=FloorCeilingArea_mean*InnerWall_Q_SD*AverageInnerWallHeight;
        double FireWallArea_mean=AreaInternalFireWalls;
		double FireWallArea_SD=0;
		double StairsMeter_mean=StairMeters;
		double StairsMeter_SD=0;

        
        //_TECHNICAL_,
		 double UtilitiesArea=AreaGrossFloor;
		 double ElevatorMeter=ElevatorMeters;
		 double ElevatorCount=NumberOfElevators/BuildingAreaGrossFloor*AreaGrossFloor;
		
        //_STRUCTURE_,
		double CoreWallArea_mean=CoreWall_Q_Mean*CoreMeters;
		double CoreWallArea_SD=CoreWall_Q_SD*CoreMeters;

        
        double Beams_ConcreteBearingWalls=0;
        double Beams_ConcreteBeamsColumns=0;
        double Beams_Hybrid=0;
        double Beams_WoodBearingWalls=0;
        double Beams_WoodBEamsColumns=0;

        double Vertical_ConcreteBearingWalls=0;
        double Vertical_ConcreteBeamsColumns=0;
        double Vertical_Hybrid=0;
        double Vertical_WoodBearingWalls=0;
        double Vertical_WoodBEamsColumns=0;

        double Slaps_ConcreteBearingWalls=0;
        double Slaps_ConcreteBeamsColumns=0;
        double Slaps_Hybrid=0;
        double Slaps_WoodBearingWalls=0;
        double Slaps_WoodBEamsColumns=0;

        if(BuildingTypology=="SingleFamilyHouse" || BuildingTypology=="TerracedHouse")
        {
         Beams_ConcreteBearingWalls=AreaGrossFloor; 
         Beams_ConcreteBeamsColumns=AreaGrossFloor; 
         Beams_Hybrid=AreaGrossFloor; 
         Beams_WoodBearingWalls=AreaGrossFloor; 
         Beams_WoodBEamsColumns=AreaGrossFloor; 

         Vertical_ConcreteBearingWalls=AreaGrossFloor; 
         Vertical_ConcreteBeamsColumns=AreaGrossFloor; 
         Vertical_Hybrid=AreaGrossFloor; 
         Vertical_WoodBearingWalls=AreaGrossFloor; 
         Vertical_WoodBEamsColumns=AreaGrossFloor; 

         Slaps_ConcreteBearingWalls=AreaGrossFloor; 
         Slaps_ConcreteBeamsColumns=AreaGrossFloor; 
         Slaps_Hybrid=AreaGrossFloor; 
         Slaps_WoodBearingWalls=AreaGrossFloor; 
         Slaps_WoodBEamsColumns=AreaGrossFloor; 
        }
        else
        {
         Beams_ConcreteBearingWalls=(BuildingVolumeAboveGround*(f1_beams*y1_beams+RoofLevelVolume/BuildingVolumeAboveGround*y1_beams_Roof))/BuildingAreaGrossFloor*AreaGrossFloor; 
         Beams_ConcreteBeamsColumns=(BuildingVolumeAboveGround*(f2_beams*y2_beams+RoofLevelVolume/BuildingVolumeAboveGround*y2_beams_Roof))/BuildingAreaGrossFloor*AreaGrossFloor; 
         Beams_Hybrid=(BuildingVolumeAboveGround*(f3_beams*y3_beams+RoofLevelVolume/BuildingVolumeAboveGround*y3_beams_Roof))/BuildingAreaGrossFloor*AreaGrossFloor; 
         Beams_WoodBearingWalls=(BuildingVolumeAboveGround*(f4_beams*y4_beams+RoofLevelVolume/BuildingVolumeAboveGround*y4_beams_Roof))/BuildingAreaGrossFloor*AreaGrossFloor; 
         Beams_WoodBEamsColumns=(BuildingVolumeAboveGround*(f5_beams*y5_beams+RoofLevelVolume/BuildingVolumeAboveGround*y5_beams_Roof))/BuildingAreaGrossFloor*AreaGrossFloor; 

         Slaps_ConcreteBearingWalls=(BuildingVolumeAboveGround*(f1_Slaps*y1_Slaps+RoofLevelVolume/BuildingVolumeAboveGround*y1_Slaps_Roof))/BuildingAreaGrossFloor*AreaGrossFloor; 
         Slaps_ConcreteBeamsColumns=(BuildingVolumeAboveGround*(f2_Slaps*y2_Slaps+RoofLevelVolume/BuildingVolumeAboveGround*y2_Slaps_Roof))/BuildingAreaGrossFloor*AreaGrossFloor; 
         Slaps_Hybrid=(BuildingVolumeAboveGround*(f3_Slaps*y3_Slaps+RoofLevelVolume/BuildingVolumeAboveGround*y3_Slaps_Roof))/BuildingAreaGrossFloor*AreaGrossFloor; 
         Slaps_WoodBearingWalls=(BuildingVolumeAboveGround*(f4_Slaps*y4_Slaps+RoofLevelVolume/BuildingVolumeAboveGround*y4_Slaps_Roof))/BuildingAreaGrossFloor*AreaGrossFloor; 
         Slaps_WoodBEamsColumns=(BuildingVolumeAboveGround*(f5_Slaps*y5_Slaps+RoofLevelVolume/BuildingVolumeAboveGround*y5_Slaps_Roof))/BuildingAreaGrossFloor*AreaGrossFloor; 

         Vertical_ConcreteBearingWalls=(BuildingVolumeAboveGround*(f1_Vertical*y1_Vertical+RoofLevelVolume/BuildingVolumeAboveGround*y1_Vertical_Roof))/BuildingAreaGrossFloor*AreaGrossFloor; 
         Vertical_ConcreteBeamsColumns=(BuildingVolumeAboveGround*(f2_Slaps*y2_Slaps+RoofLevelVolume/BuildingVolumeAboveGround*y2_Vertical_Roof))/BuildingAreaGrossFloor*AreaGrossFloor; 
         Vertical_Hybrid=(BuildingVolumeAboveGround*(f3_Vertical*y3_Vertical+RoofLevelVolume/BuildingVolumeAboveGround*y3_Vertical_Roof))/BuildingAreaGrossFloor*AreaGrossFloor; 
         Vertical_WoodBearingWalls=(BuildingVolumeAboveGround*(f4_Vertical*y4_Vertical+RoofLevelVolume/BuildingVolumeAboveGround*y4_Vertical_Roof))/BuildingAreaGrossFloor*AreaGrossFloor; 
         Vertical_WoodBEamsColumns=(BuildingVolumeAboveGround*(f5_Vertical*y5_Vertical+RoofLevelVolume/BuildingVolumeAboveGround*y5_Vertical_Roof))/BuildingAreaGrossFloor*AreaGrossFloor;          
        }

        List<double> Beams_List = new List<double>();
        Beams_List.Add(Beams_ConcreteBearingWalls); 
        Beams_List.Add(Beams_ConcreteBeamsColumns); 
        Beams_List.Add(Beams_Hybrid); 
        Beams_List.Add(Beams_WoodBearingWalls); 
        Beams_List.Add(Beams_WoodBEamsColumns); 

        

        List<double> Vertical_List = new List<double>();
        Vertical_List.Add(Vertical_ConcreteBearingWalls); 
        Vertical_List.Add(Vertical_ConcreteBeamsColumns); 
        Vertical_List.Add(Vertical_Hybrid); 
        Vertical_List.Add(Vertical_WoodBearingWalls); 
        Vertical_List.Add(Vertical_WoodBEamsColumns); 

        List<double> Slaps_List = new List<double>();
        Slaps_List.Add(Slaps_ConcreteBearingWalls); 
        Slaps_List.Add(Slaps_ConcreteBeamsColumns); 
        Slaps_List.Add(Slaps_Hybrid); 
        Slaps_List.Add(Slaps_WoodBearingWalls); 
        Slaps_List.Add(Slaps_WoodBEamsColumns); 
       

             
        //_Foundation_,
        double GroundSlap=AreaGroundSlap; 
		double BasementGroundSlap_mean=AreaGroundSlapBasement; 
		double BasementFacade_mean=AreaFacadeBasement; 
        double BoundingFoundation=LengthBoundingFoundation;        

        double SlapsBasement_ConcreteBearingWalls=0;
        double SlapsBasement_ConcreteBeamsColumns=0;
        double SlapsBasement_Hybrid=0;
        double SlapsBasement_WoodBearingWalls=0;
        double SlapsBasement_WoodBEamsColumns=0;

        double BeamsBasement_ConcreteBearingWalls=0;
        double BeamsBasement_ConcreteBeamsColumns=0;
        double BeamsBasement_Hybrid=0;
        double BeamsBasement_WoodBearingWalls=0;
        double BeamsBasement_WoodBEamsColumns=0;

        double VerticalBasement_ConcreteBearingWalls=0;
        double VerticalBasement_ConcreteBeamsColumns=0;
        double VerticalBasement_Hybrid=0;
        double VerticalBasement_WoodBearingWalls=0;
        double VerticalBasement_WoodBEamsColumns=0;
 
        double PointFoundation_ConcreteBearingWalls=0;
        double PointFoundation_ConcreteBeamsColumns=0;
        double PointFoundation_Hybrid=0;
        double PointFoundation_WoodBearingWalls=0;
        double PointFoundation_WoodBEamsColumns=0;

if(BuildingTypology=="SingleFamilyHouse" || BuildingTypology=="TerracedHouse")
        {
         SlapsBasement_ConcreteBearingWalls=AreaGrossFloor;
         SlapsBasement_ConcreteBeamsColumns=AreaGrossFloor;
         SlapsBasement_Hybrid=AreaGrossFloor;
         SlapsBasement_WoodBearingWalls=AreaGrossFloor;
         SlapsBasement_WoodBEamsColumns=AreaGrossFloor;

         BeamsBasement_ConcreteBearingWalls=AreaGrossFloor;
         BeamsBasement_ConcreteBeamsColumns=AreaGrossFloor;
         BeamsBasement_Hybrid=AreaGrossFloor;
         BeamsBasement_WoodBearingWalls=AreaGrossFloor;
         BeamsBasement_WoodBEamsColumns=AreaGrossFloor;

         VerticalBasement_ConcreteBearingWalls=AreaGrossFloor;
         VerticalBasement_ConcreteBeamsColumns=AreaGrossFloor;
         VerticalBasement_Hybrid=AreaGrossFloor;
         VerticalBasement_WoodBearingWalls=AreaGrossFloor;
         VerticalBasement_WoodBEamsColumns=AreaGrossFloor;         

         PointFoundation_ConcreteBearingWalls=AreaGrossFloor;
         PointFoundation_ConcreteBeamsColumns=AreaGrossFloor;
         PointFoundation_Hybrid=AreaGrossFloor;
         PointFoundation_WoodBearingWalls=AreaGrossFloor;
         PointFoundation_WoodBEamsColumns=AreaGrossFloor;
        }
        else
        {
         SlapsBasement_ConcreteBearingWalls=(BuildingVolumeBasement*f1_SlapsBasement*y1_SlapsBasement)/BuildingAreaGrossFloor*AreaGrossFloor;
         SlapsBasement_ConcreteBeamsColumns=(BuildingVolumeBasement*f2_SlapsBasement*y2_SlapsBasement)/BuildingAreaGrossFloor*AreaGrossFloor;
         SlapsBasement_Hybrid=(BuildingVolumeBasement*f3_SlapsBasement*y3_SlapsBasement)/BuildingAreaGrossFloor*AreaGrossFloor;
         SlapsBasement_WoodBearingWalls=(BuildingVolumeBasement*f4_SlapsBasement*y4_SlapsBasement)/BuildingAreaGrossFloor*AreaGrossFloor;
         SlapsBasement_WoodBEamsColumns=(BuildingVolumeBasement*f5_SlapsBasement*y5_SlapsBasement)/BuildingAreaGrossFloor*AreaGrossFloor;

         BeamsBasement_ConcreteBearingWalls=(BuildingVolumeBasement*f1_beamsBasement*y1_beamsBasement)/BuildingAreaGrossFloor*AreaGrossFloor;
         BeamsBasement_ConcreteBeamsColumns=(BuildingVolumeBasement*f2_beamsBasement*y2_beamsBasement)/BuildingAreaGrossFloor*AreaGrossFloor;
         BeamsBasement_Hybrid=(BuildingVolumeBasement*f3_beamsBasement*y3_beamsBasement)/BuildingAreaGrossFloor*AreaGrossFloor;
         BeamsBasement_WoodBearingWalls=(BuildingVolumeBasement*f4_beamsBasement*y4_beamsBasement)/BuildingAreaGrossFloor*AreaGrossFloor;
         BeamsBasement_WoodBEamsColumns=(BuildingVolumeBasement*f5_beamsBasement*y5_beamsBasement)/BuildingAreaGrossFloor*AreaGrossFloor;

         VerticalBasement_ConcreteBearingWalls=(BuildingVolumeBasement*f1_VerticalBasement*y1_VerticalBasement)/BuildingAreaGrossFloor*AreaGrossFloor;
         VerticalBasement_ConcreteBeamsColumns=(BuildingVolumeBasement*f2_VerticalBasement*y2_VerticalBasement)/BuildingAreaGrossFloor*AreaGrossFloor;
         VerticalBasement_Hybrid=(BuildingVolumeBasement*f3_VerticalBasement*y3_VerticalBasement)/BuildingAreaGrossFloor*AreaGrossFloor;
         VerticalBasement_WoodBearingWalls=(BuildingVolumeBasement*f4_VerticalBasement*y4_VerticalBasement)/BuildingAreaGrossFloor*AreaGrossFloor;
         VerticalBasement_WoodBEamsColumns=(BuildingVolumeBasement*f5_VerticalBasement*y5_VerticalBasement)/BuildingAreaGrossFloor*AreaGrossFloor;

         PointFoundation_ConcreteBearingWalls=((BuildingVolumeAboveGround+BuildingVolumeBasement)*(BuildingVolumeAboveGround/(BuildingVolumeAboveGround+BuildingVolumeBasement)*(f1_PointFoundation*y1_PointFoundation+RoofLevelVolume/BuildingVolumeAboveGround*y1_PointFoundationRoof)+f1_PointFoundationBasement*y1_PointFoundationBasement))/BuildingAreaGrossFloor*AreaGrossFloor;
         PointFoundation_ConcreteBeamsColumns=((BuildingVolumeAboveGround+BuildingVolumeBasement)*(BuildingVolumeAboveGround/(BuildingVolumeAboveGround+BuildingVolumeBasement)*(f2_PointFoundation*y2_PointFoundation+RoofLevelVolume/BuildingVolumeAboveGround*y2_PointFoundationRoof)+f2_PointFoundationBasement*y2_PointFoundationBasement))/BuildingAreaGrossFloor*AreaGrossFloor;
         PointFoundation_Hybrid=((BuildingVolumeAboveGround+BuildingVolumeBasement)*(BuildingVolumeAboveGround/(BuildingVolumeAboveGround+BuildingVolumeBasement)*(f3_PointFoundation*y3_PointFoundation+RoofLevelVolume/BuildingVolumeAboveGround*y3_PointFoundationRoof)+f3_PointFoundationBasement*y3_PointFoundationBasement))/BuildingAreaGrossFloor*AreaGrossFloor;
         PointFoundation_WoodBearingWalls=((BuildingVolumeAboveGround+BuildingVolumeBasement)*(BuildingVolumeAboveGround/(BuildingVolumeAboveGround+BuildingVolumeBasement)*(f4_PointFoundation*y4_PointFoundation+RoofLevelVolume/BuildingVolumeAboveGround*y4_PointFoundationRoof)+f4_PointFoundationBasement*y4_PointFoundationBasement))/BuildingAreaGrossFloor*AreaGrossFloor;
         PointFoundation_WoodBEamsColumns=((BuildingVolumeAboveGround+BuildingVolumeBasement)*(BuildingVolumeAboveGround/(BuildingVolumeAboveGround+BuildingVolumeBasement)*(f5_PointFoundation*y5_PointFoundation+RoofLevelVolume/BuildingVolumeAboveGround*y5_PointFoundationRoof)+f5_PointFoundationBasement*y5_PointFoundationBasement))/BuildingAreaGrossFloor*AreaGrossFloor;
        }

        List<double> BeamsBasement_List = new List<double>();
        BeamsBasement_List.Add(BeamsBasement_ConcreteBearingWalls); 
        BeamsBasement_List.Add(BeamsBasement_ConcreteBeamsColumns); 
        BeamsBasement_List.Add(BeamsBasement_Hybrid); 
        BeamsBasement_List.Add(BeamsBasement_WoodBearingWalls); 
        BeamsBasement_List.Add(BeamsBasement_WoodBEamsColumns); 

        List<double> VerticalBasement_List = new List<double>();
        VerticalBasement_List.Add(VerticalBasement_ConcreteBearingWalls); 
        VerticalBasement_List.Add(VerticalBasement_ConcreteBeamsColumns); 
        VerticalBasement_List.Add(VerticalBasement_Hybrid); 
        VerticalBasement_List.Add(VerticalBasement_WoodBearingWalls); 
        VerticalBasement_List.Add(VerticalBasement_WoodBEamsColumns); 

        List<double> SlapsBasement_List = new List<double>();
        SlapsBasement_List.Add(SlapsBasement_ConcreteBearingWalls); 
        SlapsBasement_List.Add(SlapsBasement_ConcreteBeamsColumns); 
        SlapsBasement_List.Add(SlapsBasement_Hybrid); 
        SlapsBasement_List.Add(SlapsBasement_WoodBearingWalls); 
        SlapsBasement_List.Add(SlapsBasement_WoodBEamsColumns); 

        List<double> PointFoundation_List = new List<double>();
        PointFoundation_List.Add(PointFoundation_ConcreteBearingWalls); 
        PointFoundation_List.Add(PointFoundation_ConcreteBeamsColumns); 
        PointFoundation_List.Add(PointFoundation_Hybrid); 
        PointFoundation_List.Add(PointFoundation_WoodBearingWalls); 
        PointFoundation_List.Add(PointFoundation_WoodBEamsColumns); 

       


        //_ENERGY_,
		 double HeatingKWHm2_mean=0;
         double HeatingKWHm2_SD=0;
         double ElKWHm2_mean=0;
         double ElKWHm2_SD=0;
         if (EnergySupplyType==0)//District heating
         {
            HeatingKWHm2_mean=Heating_Q_Mean/3; 
            HeatingKWHm2_SD=Heating_Q_SD/3;
            ElKWHm2_mean=EL_Q_Mean; 
            ElKWHm2_SD=EL_Q_SD;
         }
         else if(EnergySupplyType==1) //Electrical heating by heat pump
         {
            ElKWHm2_mean=EL_Q_Mean+Heating_Q_Mean/3.5;
            ElKWHm2_SD=SDsum(new List<double>{EL_Q_SD,Heating_Q_SD/3.5});
         }

         


         //_CONSTRUCTION A5_,
		 double ElectricityA5_mean=ELA5_Q_Mean*AreaGrossFloor;
         double ElectricityA5_SD=ELA5_Q_SD*AreaGrossFloor;
         double DieselA5_mean=DieselA5_Q_Mean*AreaGrossFloor;
         double DieselA5_SD=DieselA5_Q_SD*AreaGrossFloor;

         

        //___________________________EMISISSION________________________________
        //Mean and Standard Deviation of Key Emissions:
        //_ENVELOPE_
		 double FacadeGWP_mean = dataMean_Facade[data_Typology.IndexOf(BuildingTypology)]; 
		 double FacadeGWP_SD =dataSD_Facade[data_Typology.IndexOf(BuildingTypology)];  
		 double RoofGWP_mean = dataMean_Roof[data_Typology.IndexOf(BuildingTypology)]; 
		 double  RoofGWP_SD = dataSD_Roof[data_Typology.IndexOf(BuildingTypology)];  
		
        //_WINDOW_
		double  WindowGWP_mean = dataMean_Window[data_Typology.IndexOf(BuildingTypology)]; 
		double  WindowGWP_SD = dataSD_Window[data_Typology.IndexOf(BuildingTypology)];  
		
        //_INTERIOR_
		double  InnerWallGWP_mean = dataMean_InnerWall[data_Typology.IndexOf(BuildingTypology)]; 
		double  InnerWallGWP_SD=dataSD_InnerWall[data_Typology.IndexOf(BuildingTypology)];  
        double  FireWallGWP_mean = dataMean_FireWall[data_Typology.IndexOf(BuildingTypology)]; 
		double  FireWallGWP_SD=dataSD_FireWall[data_Typology.IndexOf(BuildingTypology)]; 
		double  FloorGWP_mean = dataMean_Floor[data_Typology.IndexOf(BuildingTypology)];  
		double  FloorGWP_SD =dataSD_Floor[data_Typology.IndexOf(BuildingTypology)];  
		double  CeilingGWP_mean = dataMean_Ceiling[data_Typology.IndexOf(BuildingTypology)]; 
		double  CeilingGWP_SD=dataSD_Ceiling[data_Typology.IndexOf(BuildingTypology)];  
		double  StairsGWP_mean = dataMean_Stairs[data_Typology.IndexOf(BuildingTypology)]; 
		double  StairsGWP_SD =dataSD_Stairs[data_Typology.IndexOf(BuildingTypology)];  
		
        // _TECHNICAL_,
		double UtilitiesGWP_mean=dataMean_Utilities[data_Typology.IndexOf(BuildingTypology)]; 
		double UtilitiesGWP_SD=dataSD_Utilities[data_Typology.IndexOf(BuildingTypology)];  
		double ElevatorMeterGWP_mean=dataMean_ElevatorMeter[data_Typology.IndexOf(BuildingTypology)]; 
		double ElevatorMeterGWP_SD=dataSD_ElevatorMeter[data_Typology.IndexOf(BuildingTypology)];  
		double ElevatorCountGWP_mean=dataMean_ElevatorCount[data_Typology.IndexOf(BuildingTypology)]; 
		double ElevatorCountGWP_SD=dataSD_ElevatorCount[data_Typology.IndexOf(BuildingTypology)];      
        
        // _ENERGY_,
        int LCA_Period =50;
		 //Average Annual Energy emmissions during the LCA period: 
        double HeatingGWP=data_Heating_KE.Skip(data_Year.IndexOf(OperationYear)).Take(LCA_Period).Average(); 
		double ELGWP=data_EL_KE.Skip(data_Year.IndexOf(OperationYear)).Take(LCA_Period).Average(); 
        double ELGWP_FirstYear=data_EL_KE.Skip(data_Year.IndexOf(OperationYear)).Take(1).Average();      
        double GassGWP=data_Gass_KE.Skip(data_Year.IndexOf(OperationYear)).Take(LCA_Period).Average(); 
        double GassGWP_FirstYear=data_Gass_KE.Skip(data_Year.IndexOf(OperationYear)).Take(1).Average(); 
        double DieselGWP=data_Diesel_KE.Skip(data_Year.IndexOf(OperationYear)).Take(LCA_Period).Average(); 
        double DieselGWP_FirstYear=data_Diesel_KE.Skip(data_Year.IndexOf(OperationYear)).Take(1).Average(); 
        

        //_STRUCTURE_,
	    double CoreWallGWP_mean=dataMean_CoreWall[data_Typology.IndexOf(BuildingTypology)]; 
		double CoreWallGWP_SD=dataSD_CoreWall[data_Typology.IndexOf(BuildingTypology)]; 
        
        double BeamsGWP_ConcreteBearingWalls=0;
        double BeamsGWP_ConcreteBeamsColumns=0;
        double BeamsGWP_Hybrid=0;
        double BeamsGWP_WoodBearingWalls=0;
        double BeamsGWP_WoodBEamsColumns=0;

        double VerticalGWP_ConcreteBearingWalls=0;
        double VerticalGWP_ConcreteBeamsColumns=0;
        double VerticalGWP_Hybrid=0;
        double VerticalGWP_WoodBearingWalls=0;
        double VerticalGWP_WoodBEamsColumns=0;

        double SlapsGWP_ConcreteBearingWalls=0;
        double SlapsGWP_ConcreteBeamsColumns=0;
        double SlapsGWP_Hybrid=0;
        double SlapsGWP_WoodBearingWalls=0;
        double SlapsGWP_WoodBEamsColumns=0;

        if(BuildingTypology=="EnfamSingleFamilyHouseiliehus" || BuildingTypology=="TerracedHouse")
        {
         BeamsGWP_ConcreteBearingWalls=data_BeamsLowTypology_KE[data_StructuralMaterial_KE.IndexOf("ConcreteBearingWalls")]; 
         BeamsGWP_ConcreteBeamsColumns=data_BeamsLowTypology_KE[data_StructuralMaterial_KE.IndexOf("ConcreteBeamsColumns")]; 
         BeamsGWP_Hybrid=data_BeamsLowTypology_KE[data_StructuralMaterial_KE.IndexOf("Hybrid")]; 
         BeamsGWP_WoodBearingWalls=data_BeamsLowTypology_KE[data_StructuralMaterial_KE.IndexOf("WoodBearingWalls")]; 
         BeamsGWP_WoodBEamsColumns=data_BeamsLowTypology_KE[data_StructuralMaterial_KE.IndexOf("WoodBEamsColumns")]; 

         VerticalGWP_ConcreteBearingWalls=data_VerticalLowTypology_KE[data_StructuralMaterial_KE.IndexOf("ConcreteBearingWalls")]; 
         VerticalGWP_ConcreteBeamsColumns=data_VerticalLowTypology_KE[data_StructuralMaterial_KE.IndexOf("ConcreteBeamsColumns")]; 
         VerticalGWP_Hybrid=data_VerticalLowTypology_KE[data_StructuralMaterial_KE.IndexOf("Hybrid")]; 
         VerticalGWP_WoodBearingWalls=data_VerticalLowTypology_KE[data_StructuralMaterial_KE.IndexOf("WoodBearingWalls")]; 
         VerticalGWP_WoodBEamsColumns=data_VerticalLowTypology_KE[data_StructuralMaterial_KE.IndexOf("WoodBEamsColumns")]; 

         SlapsGWP_ConcreteBearingWalls=data_SlapsLowTypology_KE[data_StructuralMaterial_KE.IndexOf("ConcreteBearingWalls")]; 
         SlapsGWP_ConcreteBeamsColumns=data_SlapsLowTypology_KE[data_StructuralMaterial_KE.IndexOf("ConcreteBeamsColumns")]; 
         SlapsGWP_Hybrid=data_SlapsLowTypology_KE[data_StructuralMaterial_KE.IndexOf("Hybrid")]; 
         SlapsGWP_WoodBearingWalls=data_SlapsLowTypology_KE[data_StructuralMaterial_KE.IndexOf("WoodBearingWalls")]; 
         SlapsGWP_WoodBEamsColumns=data_SlapsLowTypology_KE[data_StructuralMaterial_KE.IndexOf("WoodBEamsColumns")]; 	   
        }
        else
        {
         BeamsGWP_ConcreteBearingWalls=data_Beams_KE[data_StructuralMaterial_KE.IndexOf("ConcreteBearingWalls")]; 
         BeamsGWP_ConcreteBeamsColumns=data_Beams_KE[data_StructuralMaterial_KE.IndexOf("ConcreteBeamsColumns")]; 
         BeamsGWP_Hybrid=data_Beams_KE[data_StructuralMaterial_KE.IndexOf("Hybrid")]; 
         BeamsGWP_WoodBearingWalls=data_Beams_KE[data_StructuralMaterial_KE.IndexOf("WoodBearingWalls")]; 
         BeamsGWP_WoodBEamsColumns=data_Beams_KE[data_StructuralMaterial_KE.IndexOf("WoodBEamsColumns")]; 

         VerticalGWP_ConcreteBearingWalls=data_Vertical_KE[data_StructuralMaterial_KE.IndexOf("ConcreteBearingWalls")]; 
         VerticalGWP_ConcreteBeamsColumns=data_Vertical_KE[data_StructuralMaterial_KE.IndexOf("ConcreteBeamsColumns")]; 
         VerticalGWP_Hybrid=data_Vertical_KE[data_StructuralMaterial_KE.IndexOf("Hybrid")]; 
         VerticalGWP_WoodBearingWalls=data_Vertical_KE[data_StructuralMaterial_KE.IndexOf("WoodBearingWalls")]; 
         VerticalGWP_WoodBEamsColumns=data_Vertical_KE[data_StructuralMaterial_KE.IndexOf("WoodBEamsColumns")]; 

         SlapsGWP_ConcreteBearingWalls=data_Slaps_KE[data_StructuralMaterial_KE.IndexOf("ConcreteBearingWalls")]; 
         SlapsGWP_ConcreteBeamsColumns=data_Slaps_KE[data_StructuralMaterial_KE.IndexOf("ConcreteBeamsColumns")]; 
         SlapsGWP_Hybrid=data_Slaps_KE[data_StructuralMaterial_KE.IndexOf("Hybrid")]; 
         SlapsGWP_WoodBearingWalls=data_Slaps_KE[data_StructuralMaterial_KE.IndexOf("WoodBearingWalls")]; 
         SlapsGWP_WoodBEamsColumns=data_Slaps_KE[data_StructuralMaterial_KE.IndexOf("WoodBEamsColumns")]; 	      
        }

        List<double> BeamsGWP_List = new List<double>();
        BeamsGWP_List.Add(BeamsGWP_ConcreteBearingWalls); 
        BeamsGWP_List.Add(BeamsGWP_ConcreteBeamsColumns); 
        BeamsGWP_List.Add(BeamsGWP_Hybrid); 
        BeamsGWP_List.Add(BeamsGWP_WoodBearingWalls); 
        BeamsGWP_List.Add(BeamsGWP_WoodBEamsColumns); 

        List<double> VerticalGWP_List = new List<double>();
        VerticalGWP_List.Add(VerticalGWP_ConcreteBearingWalls); 
        VerticalGWP_List.Add(VerticalGWP_ConcreteBeamsColumns); 
        VerticalGWP_List.Add(VerticalGWP_Hybrid); 
        VerticalGWP_List.Add(VerticalGWP_WoodBearingWalls); 
        VerticalGWP_List.Add(VerticalGWP_WoodBEamsColumns); 

        List<double> SlapsGWP_List = new List<double>();
        SlapsGWP_List.Add(SlapsGWP_ConcreteBearingWalls); 
        SlapsGWP_List.Add(SlapsGWP_ConcreteBeamsColumns); 
        SlapsGWP_List.Add(SlapsGWP_Hybrid); 
        SlapsGWP_List.Add(SlapsGWP_WoodBearingWalls); 
        SlapsGWP_List.Add(SlapsGWP_WoodBEamsColumns); 

        //_FOUNDATION_,
		double GroundSlapGWP_mean=dataMean_GroundSlap[data_Typology.IndexOf(BuildingTypology)]; 
		double GroundSlapGWP_SD=dataSD_GroundSlap[data_Typology.IndexOf(BuildingTypology)]; 
		double BasementGroundSlapGWP_mean=dataMean_BasementGroundSlap[data_Typology.IndexOf(BuildingTypology)]; 
		double BasementGroundSlapGWP_SD=dataSD_BasementGroundSlap[data_Typology.IndexOf(BuildingTypology)]; 
		double BasementFacadeGWP_mean=dataMean_FacadeBasement[data_Typology.IndexOf(BuildingTypology)]; 
		double BasementFacadeGWP_SD=dataSD_FacadeBasement[data_Typology.IndexOf(BuildingTypology)]; 
   
        double SlapsBasementGWP_ConcreteBearingWalls=0;
        double SlapsBasementGWP_ConcreteBeamsColumns=0;
        double SlapsBasementGWP_Hybrid=0;
        double SlapsBasementGWP_WoodBearingWalls=0;
        double SlapsBasementGWP_WoodBEamsColumns=0;

        double BeamsBasementGWP_ConcreteBearingWalls=0;
        double BeamsBasementGWP_ConcreteBeamsColumns=0;
        double BeamsBasementGWP_Hybrid=0;
        double BeamsBasementGWP_WoodBearingWalls=0;
        double BeamsBasementGWP_WoodBEamsColumns=0;

        double VerticalBasementGWP_ConcreteBearingWalls=0;
        double VerticalBasementGWP_ConcreteBeamsColumns=0;
        double VerticalBasementGWP_Hybrid=0;
        double VerticalBasementGWP_WoodBearingWalls=0;
        double VerticalBasementGWP_WoodBEamsColumns=0;

        double BoundingFoundationGWP_ConcreteBearingWalls=0;
        double BoundingFoundationGWP_ConcreteBeamsColumns=0;
        double BoundingFoundationGWP_Hybrid=0;
        double BoundingFoundationGWP_WoodBearingWalls=0;
        double BoundingFoundationGWP_WoodBEamsColumns=0;

        double PointFoundationGWP_ConcreteBearingWalls=0;
        double PointFoundationGWP_ConcreteBeamsColumns=0;
        double PointFoundationGWP_Hybrid=0;
        double PointFoundationGWP_WoodBearingWalls=0;
        double PointFoundationGWP_WoodBEamsColumns=0;

        if(BuildingTypology=="SingleFamilyHouse" || BuildingTypology=="TerracedHouse")
        {
         SlapsBasementGWP_ConcreteBearingWalls=data_SlapBasementLowTypology_KE[data_StructuralMaterial_KE.IndexOf("ConcreteBearingWalls")]; 
         SlapsBasementGWP_ConcreteBeamsColumns=data_SlapBasementLowTypology_KE[data_StructuralMaterial_KE.IndexOf("ConcreteBeamsColumns")]; 
         SlapsBasementGWP_Hybrid=data_SlapBasementLowTypology_KE[data_StructuralMaterial_KE.IndexOf("Hybrid")]; 
         SlapsBasementGWP_WoodBearingWalls=data_SlapBasementLowTypology_KE[data_StructuralMaterial_KE.IndexOf("WoodBearingWalls")]; 
         SlapsBasementGWP_WoodBEamsColumns=data_SlapBasementLowTypology_KE[data_StructuralMaterial_KE.IndexOf("WoodBEamsColumns")];   

         BeamsBasementGWP_ConcreteBearingWalls=data_BeamsBasementLowTypology_KE[data_StructuralMaterial_KE.IndexOf("ConcreteBearingWalls")]; 
         BeamsBasementGWP_ConcreteBeamsColumns=data_BeamsBasementLowTypology_KE[data_StructuralMaterial_KE.IndexOf("ConcreteBeamsColumns")]; 
         BeamsBasementGWP_Hybrid=data_BeamsBasementLowTypology_KE[data_StructuralMaterial_KE.IndexOf("Hybrid")]; 
         BeamsBasementGWP_WoodBearingWalls=data_BeamsBasementLowTypology_KE[data_StructuralMaterial_KE.IndexOf("WoodBearingWalls")]; 
         BeamsBasementGWP_WoodBEamsColumns=data_BeamsBasementLowTypology_KE[data_StructuralMaterial_KE.IndexOf("WoodBEamsColumns")]; 

         VerticalBasementGWP_ConcreteBearingWalls=data_VerticalBasementLowTypology_KE[data_StructuralMaterial_KE.IndexOf("ConcreteBearingWalls")]; 
         VerticalBasementGWP_ConcreteBeamsColumns=data_VerticalBasementLowTypology_KE[data_StructuralMaterial_KE.IndexOf("ConcreteBeamsColumns")]; 
         VerticalBasementGWP_Hybrid=data_VerticalBasementLowTypology_KE[data_StructuralMaterial_KE.IndexOf("Hybrid")]; 
         VerticalBasementGWP_WoodBearingWalls=data_VerticalBasementLowTypology_KE[data_StructuralMaterial_KE.IndexOf("WoodBearingWalls")]; 
         VerticalBasementGWP_WoodBEamsColumns=data_VerticalBasementLowTypology_KE[data_StructuralMaterial_KE.IndexOf("WoodBEamsColumns")];  

         BoundingFoundationGWP_ConcreteBearingWalls=data_LineFoundationLowTypology_KE[data_StructuralMaterial_KE.IndexOf("ConcreteBearingWalls")]; 
         BoundingFoundationGWP_ConcreteBeamsColumns=data_LineFoundationLowTypology_KE[data_StructuralMaterial_KE.IndexOf("ConcreteBeamsColumns")]; 
         BoundingFoundationGWP_Hybrid=data_LineFoundationLowTypology_KE[data_StructuralMaterial_KE.IndexOf("Hybrid")]; 
         BoundingFoundationGWP_WoodBearingWalls=data_LineFoundationLowTypology_KE[data_StructuralMaterial_KE.IndexOf("WoodBearingWalls")]; 
         BoundingFoundationGWP_WoodBEamsColumns=data_LineFoundationLowTypology_KE[data_StructuralMaterial_KE.IndexOf("WoodBEamsColumns")]; 

         PointFoundationGWP_ConcreteBearingWalls=data_PointFoundationLowTypology_KE[data_StructuralMaterial_KE.IndexOf("ConcreteBearingWalls")]; 
         PointFoundationGWP_ConcreteBeamsColumns=data_PointFoundationLowTypology_KE[data_StructuralMaterial_KE.IndexOf("ConcreteBeamsColumns")]; 
         PointFoundationGWP_Hybrid=data_PointFoundationLowTypology_KE[data_StructuralMaterial_KE.IndexOf("Hybrid")]; 
         PointFoundationGWP_WoodBearingWalls=data_PointFoundationLowTypology_KE[data_StructuralMaterial_KE.IndexOf("WoodBearingWalls")]; 
         PointFoundationGWP_WoodBEamsColumns=data_PointFoundationLowTypology_KE[data_StructuralMaterial_KE.IndexOf("WoodBEamsColumns")];      
        }
        else
        {
         BeamsBasementGWP_ConcreteBearingWalls=data_BeamsBasement_KE[data_StructuralMaterial_KE.IndexOf("ConcreteBearingWalls")]; 
         BeamsBasementGWP_ConcreteBeamsColumns=data_BeamsBasement_KE[data_StructuralMaterial_KE.IndexOf("ConcreteBeamsColumns")]; 
         BeamsBasementGWP_Hybrid=data_BeamsBasement_KE[data_StructuralMaterial_KE.IndexOf("Hybrid")]; 
         BeamsBasementGWP_WoodBearingWalls=data_BeamsBasement_KE[data_StructuralMaterial_KE.IndexOf("WoodBearingWalls")]; 
         BeamsBasementGWP_WoodBEamsColumns=data_BeamsBasement_KE[data_StructuralMaterial_KE.IndexOf("WoodBEamsColumns")]; 

         VerticalBasementGWP_ConcreteBearingWalls=data_VerticalBasement_KE[data_StructuralMaterial_KE.IndexOf("ConcreteBearingWalls")]; 
         VerticalBasementGWP_ConcreteBeamsColumns=data_VerticalBasement_KE[data_StructuralMaterial_KE.IndexOf("ConcreteBeamsColumns")]; 
         VerticalBasementGWP_Hybrid=data_VerticalBasement_KE[data_StructuralMaterial_KE.IndexOf("Hybrid")]; 
         VerticalBasementGWP_WoodBearingWalls=data_VerticalBasement_KE[data_StructuralMaterial_KE.IndexOf("WoodBearingWalls")]; 
         VerticalBasementGWP_WoodBEamsColumns=data_VerticalBasement_KE[data_StructuralMaterial_KE.IndexOf("WoodBEamsColumns")]; 

         SlapsBasementGWP_ConcreteBearingWalls=data_SlapBasement_KE[data_StructuralMaterial_KE.IndexOf("ConcreteBearingWalls")]; 
         SlapsBasementGWP_ConcreteBeamsColumns=data_SlapBasement_KE[data_StructuralMaterial_KE.IndexOf("ConcreteBeamsColumns")]; 
         SlapsBasementGWP_Hybrid=data_SlapBasement_KE[data_StructuralMaterial_KE.IndexOf("Hybrid")]; 
         SlapsBasementGWP_WoodBearingWalls=data_SlapBasement_KE[data_StructuralMaterial_KE.IndexOf("WoodBearingWalls")]; 
         SlapsBasementGWP_WoodBEamsColumns=data_SlapBasement_KE[data_StructuralMaterial_KE.IndexOf("WoodBEamsColumns")]; 

         BoundingFoundationGWP_ConcreteBearingWalls=data_LineFoundation_KE[data_StructuralMaterial_KE.IndexOf("ConcreteBearingWalls")]; 
         BoundingFoundationGWP_ConcreteBeamsColumns=data_LineFoundation_KE[data_StructuralMaterial_KE.IndexOf("ConcreteBeamsColumns")]; 
         BoundingFoundationGWP_Hybrid=data_LineFoundation_KE[data_StructuralMaterial_KE.IndexOf("Hybrid")]; 
         BoundingFoundationGWP_WoodBearingWalls=data_LineFoundation_KE[data_StructuralMaterial_KE.IndexOf("WoodBearingWalls")]; 
         BoundingFoundationGWP_WoodBEamsColumns=data_LineFoundation_KE[data_StructuralMaterial_KE.IndexOf("WoodBEamsColumns")]; 

         PointFoundationGWP_ConcreteBearingWalls=data_PointFoundation_KE[data_StructuralMaterial_KE.IndexOf("ConcreteBearingWalls")]; 
         PointFoundationGWP_ConcreteBeamsColumns=data_PointFoundation_KE[data_StructuralMaterial_KE.IndexOf("ConcreteBeamsColumns")]; 
         PointFoundationGWP_Hybrid=data_PointFoundation_KE[data_StructuralMaterial_KE.IndexOf("Hybrid")]; 
         PointFoundationGWP_WoodBearingWalls=data_PointFoundation_KE[data_StructuralMaterial_KE.IndexOf("WoodBearingWalls")]; 
         PointFoundationGWP_WoodBEamsColumns=data_PointFoundation_KE[data_StructuralMaterial_KE.IndexOf("WoodBEamsColumns")]; 
        }

         List<double> BeamsBasementGWP_List = new List<double>();
        BeamsBasementGWP_List.Add(BeamsBasementGWP_ConcreteBearingWalls); 
        BeamsBasementGWP_List.Add(BeamsBasementGWP_ConcreteBeamsColumns); 
        BeamsBasementGWP_List.Add(BeamsBasementGWP_Hybrid); 
        BeamsBasementGWP_List.Add(BeamsBasementGWP_WoodBearingWalls); 
        BeamsBasementGWP_List.Add(BeamsBasementGWP_WoodBEamsColumns);

        List<double> VerticalBasementGWP_List = new List<double>();
        VerticalBasementGWP_List.Add(VerticalBasementGWP_ConcreteBearingWalls); 
        VerticalBasementGWP_List.Add(VerticalBasementGWP_ConcreteBeamsColumns); 
        VerticalBasementGWP_List.Add(VerticalBasementGWP_Hybrid); 
        VerticalBasementGWP_List.Add(VerticalBasementGWP_WoodBearingWalls); 
        VerticalBasementGWP_List.Add(VerticalBasementGWP_WoodBEamsColumns); 

        List<double> SlapsBasementGWP_List = new List<double>();
        SlapsBasementGWP_List.Add(SlapsBasementGWP_ConcreteBearingWalls); 
        SlapsBasementGWP_List.Add(SlapsBasementGWP_ConcreteBeamsColumns); 
        SlapsBasementGWP_List.Add(SlapsBasementGWP_Hybrid); 
        SlapsBasementGWP_List.Add(SlapsBasementGWP_WoodBearingWalls); 
        SlapsBasementGWP_List.Add(SlapsBasementGWP_WoodBEamsColumns); 

         List<double> BoundingFoundationGWP_List = new List<double>();
        BoundingFoundationGWP_List.Add(BoundingFoundationGWP_ConcreteBearingWalls); 
        BoundingFoundationGWP_List.Add(BoundingFoundationGWP_ConcreteBeamsColumns); 
        BoundingFoundationGWP_List.Add(BoundingFoundationGWP_Hybrid); 
        BoundingFoundationGWP_List.Add(BoundingFoundationGWP_WoodBearingWalls); 
        BoundingFoundationGWP_List.Add(BoundingFoundationGWP_WoodBEamsColumns);

         List<double> PointFoundationGWP_List = new List<double>();
        PointFoundationGWP_List.Add(PointFoundationGWP_ConcreteBearingWalls); 
        PointFoundationGWP_List.Add(PointFoundationGWP_ConcreteBeamsColumns); 
        PointFoundationGWP_List.Add(PointFoundationGWP_Hybrid); 
        PointFoundationGWP_List.Add(PointFoundationGWP_WoodBearingWalls); 
        PointFoundationGWP_List.Add(PointFoundationGWP_WoodBEamsColumns);

        //_Demolotion_C1_:        
        List<double> DemolitionGWP_List = new List<double>();
        DemolitionGWP_List.Add(data_DemolitionC1_KE[data_StructuralMaterial_KE.IndexOf("ConcreteBearingWalls")] ); 
        DemolitionGWP_List.Add(data_DemolitionC1_KE[data_StructuralMaterial_KE.IndexOf("ConcreteBeamsColumns")] ); 
        DemolitionGWP_List.Add(data_DemolitionC1_KE[data_StructuralMaterial_KE.IndexOf("Hybrid")] ); 
        DemolitionGWP_List.Add(data_DemolitionC1_KE[data_StructuralMaterial_KE.IndexOf("WoodBearingWalls")] ); 
        DemolitionGWP_List.Add(data_DemolitionC1_KE[data_StructuralMaterial_KE.IndexOf("WoodBEamsColumns")] );
        
                  
        //Emmissions - total GWP:
        //_ENVELOPE_,
		double GWP_Facade_mean=FacadeArea_mean*FacadeGWP_mean;
		double GWP_Facade_SD=SDproduct(FacadeArea_mean,FacadeGWP_mean,FacadeArea_SD,FacadeGWP_SD);
		double GWP_Roof_mean=RoofArea*RoofGWP_mean;
		double GWP_Roof_SD=RoofArea*RoofGWP_SD;
		
        // _WINDOW_,
		double GWP_Window_mean=WindowArea_mean*WindowGWP_mean;
		double GWP_Window_SD=SDproduct(WindowArea_mean,WindowGWP_mean,WindowArea_SD,WindowGWP_SD);
		
        // _INTERIOR_,
		double GWP_InnerWall_mean=InnerWallArea_mean*InnerWallGWP_mean;
		double GWP_InnerWall_SD=SDproduct(InnerWallArea_mean,InnerWallGWP_mean, InnerWallArea_SD, InnerWallGWP_SD);
        double GWP_FireWall_mean=FireWallArea_mean*FireWallGWP_mean;
		double GWP_FireWall_SD=SDproduct(FireWallArea_mean,FireWallGWP_mean, FireWallArea_SD, FireWallGWP_SD);
		double GWP_Floor_mean=FloorCeilingArea_mean*FloorGWP_mean;
		double GWP_Floor_SD=SDproduct(FloorCeilingArea_mean,FloorGWP_mean,FloorCeilingArea_SD,FloorGWP_SD);
		double GWP_Ceiling_mean=FloorCeilingArea_mean*CeilingGWP_mean;
		double GWP_Ceiling_SD=SDproduct(FloorCeilingArea_mean,CeilingGWP_mean,FloorCeilingArea_SD,CeilingGWP_SD);
		double GWP_Stairs_mean=StairsMeter_mean*StairsGWP_mean;
		double GWP_Stairs_SD=SDproduct(StairsMeter_mean,StairsGWP_mean,StairsMeter_SD,StairsGWP_SD);
		
        // _TECHNICAL_,
		double GWP_Utilities_mean=UtilitiesArea*UtilitiesGWP_mean;
		double GWP_Utilities_SD=UtilitiesArea*UtilitiesGWP_SD;
		double GWP_Elevator_mean=ElevatorCount*ElevatorCountGWP_mean+ElevatorMeter*ElevatorMeterGWP_mean;
		double GWP_Elevator_SD=SDsum(new List<double>{ElevatorCount*ElevatorCountGWP_SD,ElevatorMeter*ElevatorMeterGWP_SD});
		
        // _STRUCTURE_,
		double GWP_CoreWall_mean=CoreWallArea_mean*CoreWallGWP_mean;
		double GWP_CoreWall_SD=SDproduct(CoreWallArea_mean,CoreWallGWP_mean,CoreWallArea_SD,CoreWallGWP_SD);
		
        List<double> GWP_Beams_List=new List<double>();
        List<double> GWP_Vertical_List=new List<double>();
        List<double> GWP_Slaps_List=new List<double>();

        if(NumberOfFloorsAboveGround>0)
        {
        GWP_Beams_List.Add(Beams_ConcreteBearingWalls*BeamsGWP_ConcreteBearingWalls);
        GWP_Beams_List.Add(Beams_ConcreteBeamsColumns*BeamsGWP_ConcreteBeamsColumns);
        GWP_Beams_List.Add(Beams_Hybrid*BeamsGWP_Hybrid);
        GWP_Beams_List.Add(Beams_WoodBearingWalls*BeamsGWP_WoodBearingWalls);
        GWP_Beams_List.Add(Beams_WoodBEamsColumns*BeamsGWP_WoodBEamsColumns);
       
        GWP_Vertical_List.Add(Vertical_ConcreteBearingWalls*VerticalGWP_ConcreteBearingWalls);
        GWP_Vertical_List.Add(Vertical_ConcreteBeamsColumns*VerticalGWP_ConcreteBeamsColumns);
        GWP_Vertical_List.Add(Vertical_Hybrid*VerticalGWP_Hybrid);
        GWP_Vertical_List.Add(Vertical_WoodBearingWalls*VerticalGWP_WoodBearingWalls);
        GWP_Vertical_List.Add(Vertical_WoodBEamsColumns*VerticalGWP_WoodBEamsColumns);
        
        GWP_Slaps_List.Add(Slaps_ConcreteBearingWalls*SlapsGWP_ConcreteBearingWalls);
        GWP_Slaps_List.Add(Slaps_ConcreteBeamsColumns*SlapsGWP_ConcreteBeamsColumns);
        GWP_Slaps_List.Add(Slaps_Hybrid*SlapsGWP_Hybrid);
        GWP_Slaps_List.Add(Slaps_WoodBearingWalls*SlapsGWP_WoodBearingWalls);
        GWP_Slaps_List.Add(Slaps_WoodBEamsColumns*SlapsGWP_WoodBEamsColumns);
        }
        else
        {
        GWP_Beams_List=new double[5].ToList();
        GWP_Vertical_List=new double[5].ToList();
        GWP_Slaps_List=new double[5].ToList();
        }        

        double GWP_Beams_mean=0;
		double GWP_Beams_SD=0;
		double GWP_Vertical_mean=0;
		double GWP_Vertical_SD=0;
		double GWP_Slaps_mean=0;
		double GWP_Slaps_SD=0; 

        if (StrucStrategy=="All")
        {
         GWP_Beams_mean=(GWP_Beams_List[0]+GWP_Beams_List[1])/2;
		 GWP_Beams_SD=Math.Abs(GWP_Beams_List[0]-GWP_Beams_List[1])/4.6+0.1*GWP_Beams_mean;
		 GWP_Vertical_mean=(GWP_Vertical_List[0]+GWP_Vertical_List[1])/2;
		 GWP_Vertical_SD=Math.Abs(GWP_Vertical_List[0]-GWP_Vertical_List[1])/4.6+0.1*GWP_Vertical_mean;
		 GWP_Slaps_mean=(GWP_Slaps_List[0]+GWP_Slaps_List[1])/2;
		 GWP_Slaps_SD=Math.Abs(GWP_Slaps_List[0]-GWP_Slaps_List[1])/4.6+0.1*GWP_Slaps_mean;
        }
        else
        {
         GWP_Beams_mean=GWP_Beams_List[StructuralMaterial-1];
		 GWP_Beams_SD=GWP_Beams_List[StructuralMaterial-1]*0.1;
		 GWP_Vertical_mean=GWP_Vertical_List[StructuralMaterial-1];
		 GWP_Vertical_SD=GWP_Vertical_List[StructuralMaterial-1]*0.10;
		 GWP_Slaps_mean=GWP_Slaps_List[StructuralMaterial-1];
		 GWP_Slaps_SD=GWP_Slaps_List[StructuralMaterial-1]*0.1;
        }

       	
        // _FOUNDATION_,
		double GWP_GroundSlap_mean=AreaGroundSlap*GroundSlapGWP_mean;
		double GWP_GroundSlap_SD=AreaGroundSlap*GroundSlapGWP_SD;
		double GWP_BasementGroundSlap_mean=AreaGroundSlapBasement*BasementGroundSlapGWP_mean;
		double GWP_BasementGroundSlap_SD=AreaGroundSlapBasement*BasementGroundSlapGWP_SD;
		double GWP_BasementFacade_mean=AreaFacadeBasement*BasementFacadeGWP_mean;
		double GWP_BasementFacade_SD=AreaFacadeBasement*BasementFacadeGWP_SD;

		List<double> GWP_BeamsBasement_List=new List<double>();
        List<double> GWP_VerticalBasement_List=new List<double>();
        List<double> GWP_SlapsBasement_List=new List<double>();
        List<double> GWP_PointFoundation_List=new List<double>();

        if(NumberOfFloorsBellowGround>0)
        {
        GWP_BeamsBasement_List.Add(BeamsBasement_ConcreteBearingWalls*BeamsBasementGWP_ConcreteBearingWalls);
        GWP_BeamsBasement_List.Add(BeamsBasement_ConcreteBeamsColumns*BeamsBasementGWP_ConcreteBeamsColumns);
        GWP_BeamsBasement_List.Add(BeamsBasement_Hybrid*BeamsBasementGWP_Hybrid);
        GWP_BeamsBasement_List.Add(BeamsBasement_WoodBearingWalls*BeamsBasementGWP_WoodBearingWalls);
        GWP_BeamsBasement_List.Add(BeamsBasement_WoodBEamsColumns*BeamsBasementGWP_WoodBEamsColumns);
        
        GWP_VerticalBasement_List.Add(VerticalBasement_ConcreteBearingWalls*VerticalBasementGWP_ConcreteBearingWalls);
        GWP_VerticalBasement_List.Add(VerticalBasement_ConcreteBeamsColumns*VerticalBasementGWP_ConcreteBeamsColumns);
        GWP_VerticalBasement_List.Add(VerticalBasement_Hybrid*VerticalBasementGWP_Hybrid);
        GWP_VerticalBasement_List.Add(VerticalBasement_WoodBearingWalls*VerticalBasementGWP_WoodBearingWalls);
        GWP_VerticalBasement_List.Add(VerticalBasement_WoodBEamsColumns*VerticalBasementGWP_WoodBEamsColumns);
        
        GWP_SlapsBasement_List.Add(SlapsBasement_ConcreteBearingWalls*SlapsBasementGWP_ConcreteBearingWalls);
        GWP_SlapsBasement_List.Add(SlapsBasement_ConcreteBeamsColumns*SlapsBasementGWP_ConcreteBeamsColumns);
        GWP_SlapsBasement_List.Add(SlapsBasement_Hybrid*SlapsBasementGWP_Hybrid);
        GWP_SlapsBasement_List.Add(SlapsBasement_WoodBearingWalls*SlapsBasementGWP_WoodBearingWalls);
        GWP_SlapsBasement_List.Add(SlapsBasement_WoodBEamsColumns*SlapsBasementGWP_WoodBEamsColumns);
        
        GWP_PointFoundation_List.Add(PointFoundation_ConcreteBearingWalls*PointFoundationGWP_ConcreteBearingWalls);
        GWP_PointFoundation_List.Add(PointFoundation_ConcreteBeamsColumns*PointFoundationGWP_ConcreteBeamsColumns);
        GWP_PointFoundation_List.Add(PointFoundation_Hybrid*PointFoundationGWP_Hybrid);
        GWP_PointFoundation_List.Add(PointFoundation_WoodBearingWalls*PointFoundationGWP_WoodBearingWalls);
        GWP_PointFoundation_List.Add(PointFoundation_WoodBEamsColumns*PointFoundationGWP_WoodBEamsColumns);
        }
        else
        {
        GWP_BeamsBasement_List=new double[5].ToList();
        GWP_VerticalBasement_List=new double[5].ToList();
        GWP_SlapsBasement_List=new double[5].ToList();
        GWP_PointFoundation_List=new double[5].ToList();
        }               

        List<double> GWP_BoundingFoundation_List=new List<double>();
        GWP_BoundingFoundation_List.Add(BoundingFoundation*BoundingFoundationGWP_ConcreteBearingWalls);
        GWP_BoundingFoundation_List.Add(BoundingFoundation*BoundingFoundationGWP_ConcreteBeamsColumns);
        GWP_BoundingFoundation_List.Add(BoundingFoundation*BoundingFoundationGWP_Hybrid);
        GWP_BoundingFoundation_List.Add(BoundingFoundation*BoundingFoundationGWP_WoodBearingWalls);
        GWP_BoundingFoundation_List.Add(BoundingFoundation*BoundingFoundationGWP_WoodBEamsColumns);

        double GWP_BeamsBasement_mean=0;
        double GWP_BeamsBasement_SD=0;
        double GWP_VerticalBasement_mean=0;
		double GWP_VerticalBasement_SD=0;
		double GWP_SlapsBasement_mean=0;
		double GWP_SlapsBasement_SD=0;
		double GWP_BoundingFoundation_SD=0;
		double GWP_BoundingFoundation_mean=0;
		double GWP_PointFoundation_SD=0;
		double GWP_PointFoundation_mean=0;

        if (StrucStrategy=="All")
        {
        GWP_BeamsBasement_mean=(GWP_BeamsBasement_List[0]+GWP_BeamsBasement_List[1])/2;
        GWP_BeamsBasement_SD=Math.Abs(GWP_BeamsBasement_List[0]-GWP_BeamsBasement_List[1])/4.6+0.1*GWP_BeamsBasement_mean;
        GWP_VerticalBasement_mean=(GWP_VerticalBasement_List[0]+GWP_VerticalBasement_List[1])/2;
		GWP_VerticalBasement_SD=Math.Abs(GWP_VerticalBasement_List[0]-GWP_VerticalBasement_List[1])/4.6+0.1*GWP_VerticalBasement_mean;
		GWP_SlapsBasement_mean=(GWP_SlapsBasement_List[0]+GWP_SlapsBasement_List[1])/2;
		GWP_SlapsBasement_SD=Math.Abs(GWP_SlapsBasement_List[0]-GWP_SlapsBasement_List[1])/4.6+0.1*GWP_SlapsBasement_mean;
		GWP_BoundingFoundation_mean=(GWP_BoundingFoundation_List[0]+GWP_BoundingFoundation_List[1])/2;
        GWP_BoundingFoundation_SD=Math.Abs(GWP_BoundingFoundation_List[0]-GWP_BoundingFoundation_List[1])/4.6+0.1*GWP_BoundingFoundation_mean;
		GWP_PointFoundation_mean=(GWP_PointFoundation_List[0]+GWP_PointFoundation_List[1])/2;
        GWP_PointFoundation_SD=Math.Abs(GWP_PointFoundation_List[0]-GWP_PointFoundation_List[1])/4.6+0.1*GWP_PointFoundation_mean;
        }
        else
        {
         GWP_BeamsBasement_mean=GWP_BeamsBasement_List[StructuralMaterial-1];
		 GWP_BeamsBasement_SD=GWP_BeamsBasement_List[StructuralMaterial-1]*0.1;
		 GWP_VerticalBasement_mean=GWP_VerticalBasement_List[StructuralMaterial-1];
		 GWP_VerticalBasement_SD=GWP_VerticalBasement_List[StructuralMaterial-1]*0.1;
		 GWP_SlapsBasement_mean=GWP_SlapsBasement_List[StructuralMaterial-1];
		 GWP_SlapsBasement_SD=GWP_SlapsBasement_List[StructuralMaterial-1]*0.1;
         GWP_BoundingFoundation_mean=GWP_BoundingFoundation_List[StructuralMaterial-1];
         GWP_BoundingFoundation_SD=GWP_BoundingFoundation_List[StructuralMaterial-1]*0.1;
         GWP_PointFoundation_mean=GWP_PointFoundation_List[StructuralMaterial-1];
         GWP_PointFoundation_SD=GWP_PointFoundation_List[StructuralMaterial-1]*0.1;      
        }

       
		// _ENERGY_,
		double GWP_Heating_mean=HeatingKWHm2_mean*HeatingGWP*AreaHeated*50; 
		double GWP_Heating_SD=HeatingKWHm2_SD*HeatingGWP*AreaHeated*50;
		double GWP_El_mean=ElKWHm2_mean*ELGWP*AreaHeated*50; 
		double GWP_EL_SD=ElKWHm2_SD*ELGWP*AreaHeated*50;
		//_CONSTRUCTION_A5_,
		double GWP_El_A5_mean=ElectricityA5_mean*ELGWP_FirstYear;
		double GWP_El_A5_SD=ElectricityA5_SD*ELGWP_FirstYear;
		double GWP_Diesel_A5_mean=DieselA5_mean*DieselGWP_FirstYear;
		double GWP_Diesel_A5_SD=DieselA5_SD*DieselGWP_FirstYear; 
		//_DEMOLITION_,
		double GWP_Demolition_mean=0;
		double GWP_Demolision_SD=0;
 
        if (StrucStrategy=="All")
        {
        GWP_Demolition_mean=AreaGrossFloor* (DemolitionGWP_List[0]+DemolitionGWP_List[1])/2;
        GWP_Demolision_SD=(AreaGrossFloor*(Math.Abs(DemolitionGWP_List[0]-DemolitionGWP_List[1]))/4.6+0.1*GWP_Demolition_mean);       	
        }
        else
        {
         GWP_Demolition_mean=AreaGrossFloor*DemolitionGWP_List[StructuralMaterial-1];
		 GWP_Demolision_SD=(AreaGrossFloor*DemolitionGWP_List[StructuralMaterial-1])*0.1;		 
        }

       

        //_________________CLUSTER______________________________________
		double ENVELOPE=GWP_Facade_mean+GWP_Roof_mean;
		double  env_SD=SDsum(new List<double>{GWP_Facade_SD,GWP_Roof_SD});

		double  WINDOW=GWP_Window_mean;
		double  win_SD=GWP_Window_SD;

		double  INTERIOR=GWP_InnerWall_mean+GWP_FireWall_mean+GWP_Floor_mean+GWP_Ceiling_mean+GWP_Stairs_mean;
		double  int_SD=SDsum(new List<double>{GWP_InnerWall_SD, GWP_FireWall_SD,GWP_Floor_SD,GWP_Ceiling_SD,GWP_Ceiling_SD,GWP_Stairs_SD});

		double  STRUCTURE=GWP_CoreWall_mean+GWP_Beams_mean+GWP_Vertical_mean+GWP_Slaps_mean;
		double  str_SD=SDsum(new List<double>{GWP_CoreWall_SD,GWP_Beams_SD,GWP_Vertical_SD,GWP_Slaps_SD});

		double  FOUNDATION=GWP_GroundSlap_mean+GWP_BasementGroundSlap_mean+GWP_BasementFacade_mean+GWP_BeamsBasement_mean+GWP_VerticalBasement_mean+GWP_SlapsBasement_mean+GWP_BoundingFoundation_mean+GWP_PointFoundation_mean;
		double  fou_SD=SDsum(new List<double>{GWP_GroundSlap_SD,GWP_BasementGroundSlap_SD,GWP_BasementFacade_SD,GWP_BeamsBasement_SD, GWP_VerticalBasement_SD,GWP_SlapsBasement_SD,GWP_BoundingFoundation_SD,GWP_PointFoundation_SD});;

		double  TECHNICAL=GWP_Utilities_mean+GWP_Elevator_mean;
		double  tec_SD=SDsum(new List<double>{GWP_Utilities_SD,GWP_Elevator_SD});

        double  ENERGY=GWP_Heating_mean+GWP_El_mean;
		double  eng_SD=SDsum(new List<double>{GWP_EL_SD,GWP_Heating_SD});

		double  CONSTRUCTION_A5=GWP_El_A5_mean+GWP_Diesel_A5_mean;
		double  con_SD=SDsum(new List<double>{GWP_El_A5_SD,GWP_Diesel_A5_SD});

		double  DEMOLITION=GWP_Demolition_mean;
		double  dem_SD=GWP_Demolision_SD;
   

    //___________________Preservation__________________
    //REplacement factors (RF):
    double RF_EnvelopeM=dataMean_Envelope_P[data_Preservation.IndexOf(Preservation)];
    double RF_EnvelopeSD= dataSD_Envelope_P[data_Preservation.IndexOf(Preservation)];
    double RF_WindowM=dataMean_Window_P[data_Preservation.IndexOf(Preservation)]; 
    double RF_WindowSD= dataSD_Window_P[data_Preservation.IndexOf(Preservation)]; 
    double RF_InteriorM=dataMean_Interior_P[data_Preservation.IndexOf(Preservation)]; 
    double RF_InteriorSD= dataSD_Interior_P[data_Preservation.IndexOf(Preservation)]; 
    double RF_StructureM=dataMean_Structural_P[data_Preservation.IndexOf(Preservation)]; 
    double RF_StructureSD= dataSD_Structural_P[data_Preservation.IndexOf(Preservation)]; 
    double RF_FoundationM=dataMean_Foundation_P[data_Preservation.IndexOf(Preservation)]; 
    double RF_FoundationSD= dataSD_Foundation_P[data_Preservation.IndexOf(Preservation)]; 
    double RF_TechnicalM=dataMean_Technical_P[data_Preservation.IndexOf(Preservation)]; 
    double RF_TechnicalSD= dataSD_Technical_P[data_Preservation.IndexOf(Preservation)]; 
    double RF_EnergyM=dataMean_Energy_P[data_Preservation.IndexOf(Preservation)]; 
    double RF_EnergySD= dataSD_Energy_P[data_Preservation.IndexOf(Preservation)]; 
    double RF_ConstructionA5M=dataMean_ConstructionA5_P[data_Preservation.IndexOf(Preservation)]; 
    double RF_ConstructionA5SD= dataSD_ConstructionA5_P[data_Preservation.IndexOf(Preservation)]; 
    double RF_DemolitionM=dataMean_Demolition_P[data_Preservation.IndexOf(Preservation)]; 
    double RF_DemolitionSD= dataSD_Demolition_P[data_Preservation.IndexOf(Preservation)]; 
   
     //GWP with preservation strategy:
    double EnvelopeM=dataMean_Envelope_P[data_Preservation.IndexOf(Preservation)]*ENVELOPE;
    double EnvelopeSD= SDproduct(ENVELOPE, dataMean_Envelope_P[data_Preservation.IndexOf(Preservation)], env_SD, dataSD_Envelope_P[data_Preservation.IndexOf(Preservation)]);
    double WindowM=dataMean_Window_P[data_Preservation.IndexOf(Preservation)]*WINDOW; 
    double WindowSD= SDproduct(WINDOW, dataMean_Window_P[data_Preservation.IndexOf(Preservation)], win_SD, dataSD_Window_P[data_Preservation.IndexOf(Preservation)]);
    double InteriorM=dataMean_Interior_P[data_Preservation.IndexOf(Preservation)]*INTERIOR; 
    double InteriorSD= SDproduct(INTERIOR, dataMean_Interior_P[data_Preservation.IndexOf(Preservation)], int_SD, dataSD_Interior_P[data_Preservation.IndexOf(Preservation)]);
    double StructureM=dataMean_Structural_P[data_Preservation.IndexOf(Preservation)]*STRUCTURE; 
    double StructureSD= SDproduct(STRUCTURE, dataMean_Structural_P[data_Preservation.IndexOf(Preservation)], str_SD, dataSD_Structural_P[data_Preservation.IndexOf(Preservation)]);
    double FoundationM=dataMean_Foundation_P[data_Preservation.IndexOf(Preservation)]*FOUNDATION; 
    double FoundationSD= SDproduct(FOUNDATION, dataMean_Foundation_P[data_Preservation.IndexOf(Preservation)], fou_SD, dataSD_Foundation_P[data_Preservation.IndexOf(Preservation)]);
    double TechnicalM=dataMean_Technical_P[data_Preservation.IndexOf(Preservation)]*TECHNICAL; 
    double TechnicalSD= SDproduct(TECHNICAL, dataMean_Technical_P[data_Preservation.IndexOf(Preservation)], tec_SD, dataSD_Technical_P[data_Preservation.IndexOf(Preservation)]);
    double EnergyM=dataMean_Energy_P[data_Preservation.IndexOf(Preservation)]*ENERGY; 
    double EnergySD= SDproduct(ENERGY, dataMean_Energy_P[data_Preservation.IndexOf(Preservation)], eng_SD, dataSD_Energy_P[data_Preservation.IndexOf(Preservation)]);
    double ConstructionA5M=dataMean_ConstructionA5_P[data_Preservation.IndexOf(Preservation)]*CONSTRUCTION_A5; 
    double ConstructionA5SD= SDproduct(CONSTRUCTION_A5, dataMean_ConstructionA5_P[data_Preservation.IndexOf(Preservation)], con_SD, dataSD_ConstructionA5_P[data_Preservation.IndexOf(Preservation)]);
    double DemolitionM=dataMean_Demolition_P[data_Preservation.IndexOf(Preservation)]*DEMOLITION; 
    double DemolitionSD= SDproduct(DEMOLITION, dataMean_Demolition_P[data_Preservation.IndexOf(Preservation)], dem_SD, dataSD_Demolition_P[data_Preservation.IndexOf(Preservation)]);



    //____________________FRACTILE______________________
    // Fraktion (sandsynlighed)
        // Beregn z-score fra fraktionen afhængig af ambitionsniveauet
        double z = InverseNormal(Ambition); // Standardnormalfordeling: mean = 0, sd = 1

        //RESULT pr. m2 year:
          GWP_Fractile_TOTAL_pr_m2Year=(EnvelopeM+WindowM+InteriorM+StructureM+FoundationM+TechnicalM+EnergyM+ConstructionA5M+DemolitionM+z*(SDsum(new List<double>{EnvelopeSD,WindowSD,InteriorSD,StructureSD,FoundationSD,TechnicalSD,EnergySD,ConstructionA5SD,DemolitionSD}) ))/AreaGrossFloor/50;
          GWP_Fractile_ENVELOPE_pr_m2Year=(EnvelopeM+z*EnvelopeSD)/AreaGrossFloor/50;
		  GWP_Fractile_WINDOW_pr_m2Year=(WindowM+z*WindowSD)/AreaGrossFloor/50;
		  GWP_Fractile_INTERIOR_pr_m2Year=(InteriorM+z*InteriorSD)/AreaGrossFloor/50;
		  GWP_Fractile_STRUCTURE_pr_m2Year=(StructureM+z*StructureSD)/AreaGrossFloor/50;
		  GWP_Fractile_FOUNDATION_pr_m2Year=(FoundationM+z*FoundationSD)/AreaGrossFloor/50;
		  GWP_Fractile_TECHNICAL_pr_m2Year=(TechnicalM+z*TechnicalSD)/AreaGrossFloor/50;
          GWP_Fractile_ENERGY_pr_m2Year=(EnergyM+z*EnergySD)/AreaGrossFloor/50;
		  GWP_Fractile_Fractile_CONSTRUCTION_A5_pr_m2Year=(ConstructionA5M+z*ConstructionA5SD)/AreaGrossFloor/50;
		  GWP_Fractile_DEMOLITION_C1_pr_m2Year=(DemolitionM+z*DemolitionSD)/AreaGrossFloor/50;

          //RESULT total:
          GWP_Fractile_TOTAL=(EnvelopeM+WindowM+InteriorM+StructureM+FoundationM+TechnicalM+EnergyM+ConstructionA5M+DemolitionM+z*(SDsum(new List<double>{EnvelopeSD,WindowSD,InteriorSD,StructureSD,FoundationSD,TechnicalSD,EnergySD,ConstructionA5SD,DemolitionSD}) ));
          GWP_Fractile_ENVELOPE=(EnvelopeM+z*EnvelopeSD);
		  GWP_Fractile_WINDOW=(WindowM+z*WindowSD);
		  GWP_Fractile_INTERIOR=(InteriorM+z*InteriorSD);
		  GWP_Fractile_STRUCTURE=(StructureM+z*StructureSD);
		  GWP_Fractile_FOUNDATION=(FoundationM+z*FoundationSD);
		  GWP_Fractile_TECHNICAL=(TechnicalM+z*TechnicalSD);
          GWP_Fractile_ENERGY=(EnergyM+z*EnergySD);
		  GWP_Fractile_Fractile_CONSTRUCTION_A5=(ConstructionA5M+z*ConstructionA5SD);
		  GWP_Fractile_DEMOLITION_C1=(DemolitionM+z*DemolitionSD);

    //_____________________Control OUTPUTS_________________________________
          //Quantity estimation output (as new built):
            List<string> QuantityEstimation =new List<string>();
            QuantityEstimation.Add("BuildingPart Mean StandardDeviation Unit");

            QuantityEstimation.Add("FacadeArea "+FacadeArea_mean+" "+FacadeArea_SD+" m2");
            QuantityEstimation.Add("RoofArea "+RoofArea+" "+0+" m2");
            QuantityEstimation.Add("WindowArea "+WindowArea_mean+" "+WindowArea_SD+" m2");
            QuantityEstimation.Add("FloorArea "+FloorCeilingArea_mean+" "+FloorCeilingArea_SD+" m2");
            QuantityEstimation.Add("CeilingArea "+FloorCeilingArea_mean+" "+FloorCeilingArea_SD+" m2");
            QuantityEstimation.Add("InnerWallArea "+InnerWallArea_mean+" "+InnerWallArea_SD+" m2");
            QuantityEstimation.Add("FireWallArea "+FireWallArea_mean+" "+FireWallArea_SD+" m2");
		    QuantityEstimation.Add("CorerWallArea "+CoreWallArea_mean+" "+CoreWallArea_SD+" m2");
        if(BuildingTypology=="SingleFamilyHouse" || BuildingTypology=="TerracedHouse")
        {
            QuantityEstimation.Add("Beams "+Beams_List.Take(2).Average()+" "+(Math.Abs(Beams_List[0]-Beams_List[1])/4.6+Beams_List.Take(2).Average()*0.1)+" m2 floor area");
            QuantityEstimation.Add("Vertical "+Vertical_List.Take(2).Average()+" "+(Math.Abs(Vertical_List[0]-Vertical_List[1])/4.6+Vertical_List.Take(2).Average()*0.1)+" m2 floor area");
            QuantityEstimation.Add("Slaps "+Slaps_List.Take(2).Average()+" "+(Math.Abs(Slaps_List[0]-Slaps_List[1])/4.6+Slaps_List.Take(2).Average()*0.1)+" m2 floor area");
            QuantityEstimation.Add("BeamsBasement "+BeamsBasement_List.Take(2).Average()+" "+(Math.Abs(BeamsBasement_List[0]-BeamsBasement_List[1])/4.6+BeamsBasement_List.Take(2).Average()*0.1)+" m2 floor area");
            QuantityEstimation.Add("VerticalBasement "+VerticalBasement_List.Take(2).Average()+" "+(Math.Abs(VerticalBasement_List[0]-VerticalBasement_List[1])/4.6+VerticalBasement_List.Take(2).Average()*0.1)+" m2 floor area");
            QuantityEstimation.Add("SlapsBasement "+SlapsBasement_List.Take(2).Average()+" "+(Math.Abs(SlapsBasement_List[0]-SlapsBasement_List[1])/4.6+SlapsBasement_List.Take(2).Average()*0.1)+" m2 floor area");
            QuantityEstimation.Add("PointFoundation "+PointFoundation_List.Take(2).Average()+" "+(Math.Abs(PointFoundation_List[0]-PointFoundation_List[1])/4.6+PointFoundation_List.Take(2).Average()*0.1)+" m2 floor area");
         }
        else
        {
            QuantityEstimation.Add("Beams "+Beams_List.Take(2).Average()+" "+(Math.Abs(Beams_List[0]-Beams_List[1])/4.6+Beams_List.Take(2).Average()*0.1)+" kg");
            QuantityEstimation.Add("Vertical "+Vertical_List.Take(2).Average()+" "+(Math.Abs(Vertical_List[0]-Vertical_List[1])/4.6+Vertical_List.Take(2).Average()*0.1)+" kg");
            QuantityEstimation.Add("Slaps "+Slaps_List.Take(2).Average()+" "+(Math.Abs(Slaps_List[0]-Slaps_List[1])/4.6+Slaps_List.Take(2).Average()*0.1)+" kg");
            QuantityEstimation.Add("BeamsBasement "+BeamsBasement_List.Take(2).Average()+" "+(Math.Abs(BeamsBasement_List[0]-BeamsBasement_List[1])/4.6+BeamsBasement_List.Take(2).Average()*0.1)+" kg");
            QuantityEstimation.Add("VerticalBasement "+VerticalBasement_List.Take(2).Average()+" "+(Math.Abs(VerticalBasement_List[0]-VerticalBasement_List[1])/4.6+VerticalBasement_List.Take(2).Average()*0.1)+" kg");
            QuantityEstimation.Add("SlapsBasement "+SlapsBasement_List.Take(2).Average()+" "+(Math.Abs(SlapsBasement_List[0]-SlapsBasement_List[1])/4.6+SlapsBasement_List.Take(2).Average()*0.1)+" kg");
            QuantityEstimation.Add("PointFoundation "+PointFoundation_List.Take(2).Average()+" "+(Math.Abs(PointFoundation_List[0]-PointFoundation_List[1])/4.6+PointFoundation_List.Take(2).Average()*0.1)+" kg");
        }
            QuantityEstimation.Add("GroundSlap "+GroundSlap+" "+0+" m2");
            QuantityEstimation.Add("GroundSlapBasement "+BasementGroundSlap_mean+" "+0+" m2");
            QuantityEstimation.Add("FacadeBasement "+BasementFacade_mean+" "+0+" m2");
            QuantityEstimation.Add("BoundingFoundation "+BoundingFoundation+" "+0+" m");
            QuantityEstimation.Add("Heating "+HeatingKWHm2_mean+" "+HeatingKWHm2_SD+" kWh/year/m2");
            QuantityEstimation.Add("Electricity "+ElKWHm2_mean+" "+ElKWHm2_SD+" kWh/year/m2");
            QuantityEstimation.Add("A5_Electrcity "+ElectricityA5_mean+" "+ElectricityA5_SD+" kWh");
            QuantityEstimation.Add("A5_Diesel "+DieselA5_mean+" "+DieselA5_SD+" Liter");

          Total_Quantity_Estimation_List=QuantityEstimation; //OUTPUT

          //Quantity estimation output (with preservation strategy):
          List<string> QuantityEstimationReplaced =new List<string>();
          QuantityEstimationReplaced.Add("BuildingPart Replacementfactor StandardDeviation ReplacedBuildingPart StandardDeviation Unit");

          double RFM_Envelope=0;

            
            QuantityEstimationReplaced.Add("FacadeArea "+ RF_EnvelopeM +" "+RF_EnvelopeSD +" "+FacadeArea_mean*RF_EnvelopeM+" "+SDproduct(FacadeArea_mean, RF_EnvelopeM, FacadeArea_SD,RF_EnvelopeSD )+" m2");
            QuantityEstimationReplaced.Add("RoofArea "+ RF_EnvelopeM +" "+RF_EnvelopeSD +" "+RoofArea+" "+SDproduct(RoofArea, RF_EnvelopeM, 0,RF_EnvelopeSD )+" m2");
            QuantityEstimationReplaced.Add("WindowArea "+ RF_WindowM +" "+RF_WindowSD +" "+WindowArea_mean*RF_WindowM+" "+SDproduct(WindowArea_mean, RF_WindowM, WindowArea_SD,RF_WindowSD )+" m2");
            QuantityEstimationReplaced.Add("FloorArea "+ RF_InteriorM +" "+RF_InteriorSD +" "+FloorCeilingArea_mean*RF_InteriorM+" "+SDproduct(FloorCeilingArea_mean, RF_InteriorM, FloorCeilingArea_SD,RF_InteriorSD )+" m2");
            QuantityEstimationReplaced.Add("CeilingArea "+ RF_InteriorM +" "+RF_InteriorSD +" "+FloorCeilingArea_mean*RF_InteriorM+" "+SDproduct(FloorCeilingArea_mean, RF_InteriorM, FloorCeilingArea_SD,RF_InteriorSD )+" m2");
            QuantityEstimationReplaced.Add("InnerWallArea "+ RF_InteriorM +" "+RF_InteriorSD +" "+InnerWallArea_mean*RF_InteriorM+" "+SDproduct(InnerWallArea_mean, RF_InteriorM, InnerWallArea_SD,RF_InteriorSD )+" m2");
            QuantityEstimationReplaced.Add("FireWallArea "+ RF_InteriorM +" "+RF_InteriorSD +" "+FireWallArea_mean*RF_InteriorM+" "+SDproduct(FireWallArea_mean, RF_InteriorM, FireWallArea_SD,RF_InteriorSD )+" m2");
		    QuantityEstimationReplaced.Add("CorerWallArea "+ RF_StructureM +" "+RF_StructureSD+" "+CoreWallArea_mean*RF_StructureM+" "+SDproduct(CoreWallArea_mean, RF_StructureM, CoreWallArea_SD,RF_StructureSD)+" m2");
        if(BuildingTypology=="SingleFamilyHouse" || BuildingTypology=="TerracedHouse")
        {
            QuantityEstimationReplaced.Add("Beams "+ RF_StructureM +" "+RF_StructureSD +" "+Beams_List.Take(2).Average()*RF_StructureM+" "+SDproduct(Beams_List.Take(2).Average(), RF_StructureM, Beams_List.Take(2).Average()*0.1,RF_StructureSD)+" m2 floor area");
            QuantityEstimationReplaced.Add("Vertical "+ RF_StructureM +" "+RF_StructureSD +" "+Vertical_List.Take(2).Average()*RF_StructureM+" "+SDproduct(Vertical_List.Take(2).Average(), RF_StructureM, Vertical_List.Take(2).Average()*0.1,RF_StructureSD)+" m2 floor area");
            QuantityEstimationReplaced.Add("Slaps "+RF_StructureM +" "+RF_StructureSD +" "+Slaps_List.Take(2).Average()*RF_StructureM+" "+SDproduct(Slaps_List.Take(2).Average(), RF_StructureM, Slaps_List.Take(2).Average()*0.1,RF_StructureSD)+" m2 floor area");
            
            QuantityEstimationReplaced.Add("BeamsBasement "+ RF_FoundationM+" "+RF_FoundationSD +" "+BeamsBasement_List.Take(2).Average()*RF_FoundationM+" "+SDproduct(BeamsBasement_List.Take(2).Average(), RF_FoundationM, BeamsBasement_List.Take(2).Average()*0.1,RF_FoundationSD)+" m2 floor area");
            QuantityEstimationReplaced.Add("VerticalBasement "+ RF_FoundationM+" "+RF_FoundationSD +" "+VerticalBasement_List.Take(2).Average()*RF_FoundationM+" "+SDproduct(VerticalBasement_List.Take(2).Average(), RF_FoundationM, VerticalBasement_List.Take(2).Average()*0.1,RF_FoundationSD)+" m2 floor area");
            QuantityEstimationReplaced.Add("SlapsBasement "+ RF_FoundationM+" "+RF_FoundationSD +" "+SlapsBasement_List.Take(2).Average()*RF_FoundationM+" "+SDproduct(SlapsBasement_List.Take(2).Average(), RF_FoundationM, SlapsBasement_List.Take(2).Average()*0.1,RF_FoundationSD)+" m2 floor area");
            QuantityEstimationReplaced.Add("PointFoundation "+ RF_FoundationM+" "+RF_FoundationSD +" "+PointFoundation_List.Take(2).Average()*RF_FoundationM+" "+SDproduct(PointFoundation_List.Take(2).Average(), RF_FoundationM, PointFoundation_List.Take(2).Average()*0.1,RF_FoundationSD)+" m2 floor area");
        }
        else
        {
            QuantityEstimationReplaced.Add("Beams "+ RF_StructureM +" "+RF_StructureSD +" "+Beams_List.Take(2).Average()*RF_StructureM+" "+SDproduct(Beams_List.Take(2).Average(), RF_StructureM, Math.Abs(Beams_List[0]-Beams_List[1])/4.6+Beams_List.Take(2).Average()*0.1,RF_StructureSD)+" kg");
            QuantityEstimationReplaced.Add("Vertical "+ RF_StructureM +" "+RF_StructureSD +" "+Vertical_List.Take(2).Average()*RF_StructureM+" "+SDproduct(Vertical_List.Take(2).Average(), RF_StructureM, Math.Abs(Vertical_List[0]-Vertical_List[1])/4.6+Vertical_List.Take(2).Average()*0.1,RF_StructureSD)+" kg");
            QuantityEstimationReplaced.Add("Slaps "+ RF_StructureM +" "+RF_StructureSD +" "+Slaps_List.Take(2).Average()*RF_StructureM+" "+SDproduct(Slaps_List.Take(2).Average(), RF_StructureM, Math.Abs(Slaps_List[0]-Slaps_List[1])/4.6+Slaps_List.Take(2).Average()*0.1,RF_StructureSD)+" kg");
            
            QuantityEstimationReplaced.Add("BeamsBasement "+ RF_FoundationM+" "+RF_FoundationSD +" "+BeamsBasement_List.Take(2).Average()*RF_FoundationM+" "+SDproduct(BeamsBasement_List.Take(2).Average(), RF_FoundationM, Math.Abs(BeamsBasement_List[0]-BeamsBasement_List[1])/4.6+BeamsBasement_List.Take(2).Average()*0.1,RF_FoundationSD)+" kg");
            QuantityEstimationReplaced.Add("VerticalBasement "+ RF_FoundationM+" "+RF_FoundationSD +" "+VerticalBasement_List.Take(2).Average()*RF_FoundationM+" "+SDproduct(VerticalBasement_List.Take(2).Average(), RF_FoundationM, Math.Abs(VerticalBasement_List[0]-VerticalBasement_List[1])/4.6+VerticalBasement_List.Take(2).Average()*0.1, RF_FoundationSD)+" kg");
            QuantityEstimationReplaced.Add("SlapsBasement "+ RF_FoundationM+" "+RF_FoundationSD +" "+SlapsBasement_List.Take(2).Average()*RF_FoundationM+" "+SDproduct(SlapsBasement_List.Take(2).Average(), RF_FoundationM, (Math.Abs(SlapsBasement_List[0]-SlapsBasement_List[1])/4.6+SlapsBasement_List.Take(2).Average()*0.1),RF_FoundationSD)+" kg");
            QuantityEstimationReplaced.Add("PointFoundation "+ RF_FoundationM+" "+RF_FoundationSD +" "+PointFoundation_List.Take(2).Average()*RF_FoundationM+" "+SDproduct(PointFoundation_List.Take(2).Average(), RF_FoundationM, Math.Abs(PointFoundation_List[0]-PointFoundation_List[1])/4.6+PointFoundation_List.Take(2).Average()*0.1,RF_FoundationSD)+" kg");
        }
            QuantityEstimationReplaced.Add("GroundSlap "+ RF_FoundationM+" "+RF_FoundationSD +" "+GroundSlap*RF_FoundationM+" "+SDproduct(GroundSlap, RF_FoundationM, 0,RF_FoundationSD)+" m2");
            QuantityEstimationReplaced.Add("GroundSlapBasement "+ RF_FoundationM+" "+RF_FoundationSD +" "+BasementGroundSlap_mean*RF_FoundationM+" "+SDproduct(BasementGroundSlap_mean, RF_FoundationM, 0,RF_FoundationSD)+" m2");
            QuantityEstimationReplaced.Add("FacadeBasement "+ RF_FoundationM+" "+RF_FoundationSD +" "+BasementFacade_mean*RF_FoundationM+" "+SDproduct(BasementFacade_mean, RF_FoundationM, 0,RF_FoundationSD)+" m2");
            QuantityEstimationReplaced.Add("BoundingFoundation "+ RF_FoundationM+" "+RF_FoundationSD +" "+BoundingFoundation*RF_FoundationM+" "+SDproduct(BoundingFoundation, RF_FoundationM, 0,RF_FoundationSD)+" m");
            
            QuantityEstimationReplaced.Add("Heating "+ RF_EnergyM+" "+RF_EnergySD +" "+HeatingKWHm2_mean*RF_EnergyM+" "+SDproduct(HeatingKWHm2_mean, RF_EnergyM, HeatingKWHm2_SD,RF_EnergySD)+" kWh/year/m2");
            QuantityEstimationReplaced.Add("Electricity "+ RF_EnergyM+" "+RF_EnergySD +" "+ElKWHm2_mean*RF_EnergyM+" "+SDproduct(ElKWHm2_mean, RF_EnergyM, ElKWHm2_SD,RF_EnergySD)+" kWh/year/m2");
            QuantityEstimationReplaced.Add("A5_Electrcity "+ RF_ConstructionA5M+" "+RF_ConstructionA5SD +" "+ElectricityA5_mean*RF_ConstructionA5M+" "+SDproduct(ElectricityA5_mean, RF_ConstructionA5M, ElectricityA5_SD,RF_ConstructionA5SD)+" kWh");
            QuantityEstimationReplaced.Add("A5_Diesel "+ RF_ConstructionA5M+" "+RF_ConstructionA5SD +" "+DieselA5_mean*RF_ConstructionA5M+" "+SDproduct(DieselA5_mean, RF_ConstructionA5M, DieselA5_SD,RF_ConstructionA5SD)+" Liter");

          Replaced_Quantity_Estimation_List=QuantityEstimationReplaced; //OUTPUT


    }
    
    

    
    // My statisic functions:

        //Produkt of standarddeviation:
        double SDproduct(double Mean1, double Mean2, double SD1, double SD2)
        {
//      Beregn varians for produktet
        double varianceProduct = (Mean1 * Mean1) * (SD2 * SD2)
                               + (Mean2 * Mean2) * (SD1 * SD1)
                               + (SD1 * SD1) * (SD2 * SD2);

        double SD=Math.Sqrt(varianceProduct);
        return SD;    
        }
        
        //Sum of multiple Standard deviation:
        double SDsum(List<double> SD_list)
        {
//      Beregn summen af varianserne
        double vSUM=0; 
        foreach (var sd in SD_list)
        {
           vSUM+=sd*sd;           
        }        
        double SD=Math.Sqrt(vSUM);
        return SD;    
        }
        // Approksimation af inverse normalfordeling (Acklam's algoritme)
    public static double InverseNormal(double p)
    {
        if (p <= 0.0 || p >= 1.0)
            throw new ArgumentOutOfRangeException("Ambitions level hass to be between 0 and 1");

        // Coefficients for approximation
        double[] a = {
            -3.969683028665376e+01,
             2.209460984245205e+02,
            -2.759285104469687e+02,
             1.383577518672690e+02,
            -3.066479806614716e+01,
             2.506628277459239e+00
        };

        double[] b = {
            -5.447609879822406e+01,
             1.615858368580409e+02,
            -1.556989798598866e+02,
             6.680131188771972e+01,
            -1.328068155288572e+01
        };

        double[] c = {
            -7.784894002430293e-03,
            -3.223964580411365e-01,
            -2.400758277161838e+00,
            -2.549732539343734e+00,
             4.374664141464968e+00,
             2.938163982698783e+00
        };

        double[] d = {
             7.784695709041462e-03,
             3.224671290700398e-01,
             2.445134137142996e+00,
             3.754408661907416e+00
        };

        double q, r;
        if (p < 0.02425)
        {
            // Lower region
            q = Math.Sqrt(-2 * Math.Log(p));
            return (((((c[0]*q + c[1])*q + c[2])*q + c[3])*q + c[4])*q + c[5]) /
                   ((((d[0]*q + d[1])*q + d[2])*q + d[3])*q + 1);
        }
        else if (p > 1 - 0.02425)
        {
            // Upper region
            q = Math.Sqrt(-2 * Math.Log(1 - p));
            return -(((((c[0]*q + c[1])*q + c[2])*q + c[3])*q + c[4])*q + c[5]) /
                     ((((d[0]*q + d[1])*q + d[2])*q + d[3])*q + 1);
        }
        else
        {
            // Central region
            q = p - 0.5;
            r = q * q;
            return (((((a[0]*r + a[1])*r + a[2])*r + a[3])*r + a[4])*r + a[5]) * q /
                   (((((b[0]*r + b[1])*r + b[2])*r + b[3])*r + b[4])*r + 1);
        }
}
    }
# ---------- end lca_volume ----------
ma_16 = MassAddition(Input=lca_volume.GWP_Fractile_TOTAL)  # -> Result, PartialResults
path_mapper_37 = PathMapper(lca_volume.GWP_Fractile_TOTAL, source="{A;B}", target="{A}")
expression_2 = Expression(x=ma_16.Result, y=ma_11.Result, z=lca_consideration_period_year, Expression="(X/Y)/Z")
panel_33 = Panel(lca_volume.GWP_Fractile_TOTAL)
ma_17 = MassAddition(Input=path_mapper_37)  # -> Result, PartialResults
expression_3 = Expression(x=ma_17.Result, y=ma_12.Result, z=lca_consideration_period_year, Expression="(X/Y)/Z")
lca_result_pr_floor = Number(lca_volume.GWP_Fractile_TOTAL_pr_m2Year)
lca_result_pr_site_boundary = Number(expression_3)
lca_result_pr_grouping = Number(expression_2)
filter_3 = StreamFilter(
    Gate=preview_lca_estimate,
    Stream0=lca_result_pr_floor,
    Stream1=lca_result_pr_grouping,
    Stream2=lca_result_pr_site_boundary)
split_24 = SplitTree(Data=filter_3, Masks=flatten(dem_repath_11.Rewritten))  # -> Positive, Negative
gwp_values = Number(split_24.Negative)
expression_4 = Expression(x=gwp_values, Expression="Round(x,1)")
format_6 = Format(Format=panel_20, Culture=127, Data0=expression_4)
gwp_colour_scheme = GWP_COLOUR_SCHEME(l0=list_4, l1=list_5, t=gwp_values)

# ---- group: PREVIEW LCA RESULT DOTS
dot_7 = AnnotationDot(Location=pt_dots_preview, PrimaryText=format_6)  # -> AnnotationDot, Location, PrimaryText, TextHeight

# ---- group: GWP PR FLOOR
preview_14 = CustomPreview(Geometry=brep_9, Material=gwp_colour_scheme)

# ---- group: GWP PR GROUPING
preview_15 = CustomPreview(Geometry=brep_9, Material=gwp_colour_scheme)

# ---- group: GWP PR SITE BOUNDARY
preview_16 = CustomPreview(Geometry=path_mapper_23, Material=gwp_colour_scheme)

# ----
addition_7 = Addition(A=list_5, B=0.1)
rectangle = Rectangle(Plane=PlaneXY(0, 0, 0), XSize="1", YSize="1", Radius=0)  # -> Rectangle, Length

num_legend_divisions_2 = Number("10")

expression_5 = Expression(x=num_legend_bottom_value, y=num_legend_top_value, z=num_legend_divisions_2, Expression="(y-x)/(z-1)")
series_11 = Series(Start=list_4, Step=expression_5, Count=num_legend_divisions_2)
lng_20 = ListLength(List=series_11)
replace_10 = ReplaceItems(List=series_11, Item=addition_7, Indices=expr("x-1", lng_20), Wrap=False)
gwp_colour_scheme_2 = GWP_COLOUR_SCHEME(l0=list_4, l1=list_5, t=replace_10)
series_12 = Series(Start=0, Step="1", Count=num_legend_divisions_2)
Y_2 = UnitY(Factor=expr("x*-1", series_12))
move_4 = Move(Geometry=rectangle.Rectangle, Motion=Y_2)  # -> Geometry, Transform
crv = Curve(move_4.Geometry)
expression_6 = Expression(x=series_11, Expression="Round(x,1)")
mesh = Mesh(crv)
format_7 = Format(Format="{0:0.0} GWP", Culture=127, Data0=expression_6)
lng_21 = ListLength(List=format_7)  # -> expr("x-2", simplify(Length))
item_25 = ListItem(List=format_7, Index=0, Wrap=True)  # -> Item1, Item
dom = ConstructDomain(DomainStart=1, DomainEnd=lng_21)
concat_15 = Concatenate(FragmentA=">", FragmentB=item_25.Item1)
concat_16 = Concatenate(FragmentA="<", FragmentB=item_25.Item)
subset = SubList(List=format_7, Domain=dom, Wrap=True)  # -> List, Index
lng_22 = ListLength(List=subset.List)
merge_15 = Merge(Data1=concat_16, Data2=concat_15)  # -> flatten(Result)
merge_16 = Merge(Data1=lng_22, Data2=0)  # -> flatten(Result)
ins_9 = InsertItems(List=subset.List, Item=merge_15, Indices=merge_16, Wrap=True)

int_legend_divisions_2 = Integer(lng_20)
series_13 = Series(Start=int_legend_y_coordinate_start, Step=expr("x*1", size_scale), Count=int_legend_divisions_2)
int_legend_text_y_coordinates_2 = Integer(series_13)
move_5 = Move(Geometry=rectangle.Rectangle, Motion=Y)  # -> Geometry, Transform
crv_2 = Curve(move_5.Geometry)
concat_17 = Concatenate(FragmentA=int_legend_text_x_coordinate, FragmentB=",", FragmentC=int_legend_text_y_coordinates_2)
mesh_2 = Mesh(crv_2)

# ---- group: PREVIEW LCA RESULT LEGEND
texttoscreenunits = RenderTextToScreen(Text=ins_9, Location=reverse(concat_17), Size=num_legend_text_size, Color=RGB(0, 0, 0), m_scWithvp=False)
texttoscreentitle = RenderTextToScreen(Text=item_19, Location=reverse(concat_10), Size=num_title_text_size, Color=RGB(0, 0, 0), m_scWithvp=False)
meshtoscreen = RenderMeshToScreen(
    Mesh=mesh,
    Location=concat_13,
    ScaleFactor=size_scale,
    Color=reverse(gwp_colour_scheme_2),
    Depth=0.9,
    Fixed=True,
    m_scWithvp=False)

# ---- group: PREVIEW STRATEGY LEGEND
texttoscreenunits_2 = RenderTextToScreen(Text=filter_values, Location=reverse(concat_12), Size=num_legend_text_size, Color=RGB(0, 0, 0), m_scWithvp=False)
texttoscreentitle_2 = RenderTextToScreen(Text=item_18, Location=reverse(concat_10), Size=num_title_text_size, Color=RGB(0, 0, 0), m_scWithvp=False)
meshtoscreen_2 = RenderMeshToScreen(
    Mesh=mesh_2,
    Location=concat_11,
    ScaleFactor=size_scale,
    Color=reverse(filter_colors),
    Depth=0.9,
    Fixed=True,
    m_scWithvp=False)

# ==== cluster SortSurfacesByProgram
brep_stacked_groupings = ClusterInput()
srf_input = ClusterInput()
brep_stacked_groupings_2 = Brep(brep_stacked_groupings)
brep = Brep(brep_stacked_groupings_2)
listdexs = ListIndices(List=brep)
lng = ListLength(List=listdexs)
tstat = TreeStatistics(Tree=listdexs)  # -> Paths, Length, Count
dup = DuplicateData(Data=0, Number=lng, Order=True)  # -> simplify(graft(Data))
graft = GraftTree(Tree=listdexs, IncludeEmptyLists=True, IncludeNullItems=True)
panel = Panel(graft)
srf_input_2 = Brep(srf_input)
lng_2 = ListLength(List=brep)
panel_2 = Panel(dup)
tstat_2 = TreeStatistics(Tree=graft(brep))  # -> Paths, Length, Count
tstat_3 = TreeStatistics(Tree=brep_stacked_groupings_2)  # -> Paths, Length, Count
tstat_4 = TreeStatistics(Tree=brep)  # -> Paths, Length, Count
tstat_5 = TreeStatistics(Tree=srf_input_2)  # -> Paths, Length, Count
branch = TreeBranch(Tree=brep, Path=tstat_4.Paths, MaintainPaths=True)
branch_2 = TreeBranch(Tree=brep_stacked_groupings_2, Path=tstat_5.Paths, MaintainPaths=True)
panel_3 = Panel(tstat_3.Paths)
panel_4 = Panel(tstat_2.Paths)
tstat_6 = TreeStatistics()  # -> Paths, Length, Count
area = Area(Geometry=srf_input_2)  # -> Area, Centroid
area_2 = Area(Geometry=srf_input_2)  # -> Area, Centroid
Z = UnitZ(Factor=Slider(0, range=0..10))
move = Move(Geometry=area.Centroid, Motion=Z)  # -> Geometry, Transform
area_3 = Area(Geometry=srf_input_2)  # -> Area, Centroid
panel_5 = Panel(area_3.Area)
tstat_7 = TreeStatistics()  # -> Paths, Length, Count
item = ListItem(List=tstat_2.Paths, Index=Slider(5, range=0..100), Wrap=True)
panel_6 = Panel(item)
panel_7 = Panel(brep)

# ---- group: SORT FACADE AREA PR GROUPING
toggle = BooleanToggle(False)
evalsrf = EvaluateSurface(Surface=reparameterize(srf_input_2), Point="0.5,0.5")  # -> Point, Normal, UDirection, VDirection, Frame
rhatt = GetRhinoAttributes(Geometry=branch_2, fullpath=False)  # -> Name, Layer, Color, MaterialName, SourceFile
closestb = ClosestBrep(Breps=branch_2, Point=move.Geometry, strictClosestBrep=True)  # -> BrepIndex, ClosestPoint, ClosestNormal
item_2 = ListItem(List=rhatt.Layer, Index=closestb.BrepIndex, Wrap=True)
item_3 = ListItem(List=rhatt.Color, Index=closestb.BrepIndex, Wrap=True)
area_4 = Area(Geometry=srf_input_2)  # -> Area, Centroid
split = TextSplit(Text=item_2, Separators="::")
item_4 = ListItem(List=split, Index=-1, Wrap=True)  # -> simplify(Item)
round = Round(Number=area_4.Area)  # -> Nearest, Floor, Ceiling
path_mapper = PathMapper(item_4, source=["{a;b;c}", "{a;b}"], target=["{A;B}", "{A;B}"])

# ----
vec2pt = Vector2Pt(PointA=move.Geometry, PointB=closestb.ClosestPoint, Unitize=False)  # -> Vector, Length
vdis = VectorDisplay(Anchor=move.Geometry, Vector=vec2pt.Vector)
py3 = Python3Script(x=closestb.BrepIndex, S=toggle)  # -> out, U, I; inputs x: tree
# ---------- py3: Python ----------
"""GhPython (Rhino 8 / Python 3)
Unique values + per-item index mapping.

Inputs:
  x : Tree of numbers OR strings (Access=Tree)
  S : (optional) bool; True = sort uniques, False = keep encounter order

Outputs:
  U : Tree of unique values (per branch)
  I : Tree of per-item indices mapping to positions in U (per branch)

Author: ChatGPT
"""

from Grasshopper import DataTree
from Grasshopper.Kernel.Data import GH_Path

# Default S to True if not provided
try:
    SORT_VALUES = bool(S)
except NameError:
    SORT_VALUES = True

def _sort_key(v):
    # Robust sort: numbers first, then strings via str fallback
    return (0, v) if isinstance(v, (int, float)) else (1, str(v))

def _uniques_and_mapping(seq, sort_values=True):
    """
    Returns:
      uniques: list of unique values (sorted or encounter order)
      mapping_list: len(seq), each entry is index of seq[i]'s value in 'uniques'
    """
    # First-pass: record first occurrence order
    first_index = {}
    order = []
    for i, v in enumerate(seq):
        if v not in first_index:
            first_index[v] = i
            order.append(v)

    # Decide unique ordering
    if sort_values:
        try:
            uniques = sorted(order, key=_sort_key)
        except Exception:
            uniques = sorted(order, key=lambda x: str(x))
    else:
        uniques = order

    # Build value -> rank map (position in uniques)
    rank = {v: idx for idx, v in enumerate(uniques)}

    # Build full-length mapping list
    mapping_list = [rank[v] for v in seq]
    return uniques, mapping_list

# Prepare outputs
U = DataTree[object]()
I = DataTree[object]()

for path in x.Paths:
    branch = list(x.Branch(path))
    uniques, mapping = _uniques_and_mapping(branch, SORT_VALUES)

    # Populate outputs, preserving paths
    if uniques:
        U.AddRange(uniques, path)
    # Always add the full-length mapping, even if the branch is empty
    if mapping:
        I.AddRange(mapping, path)
# ---------- end py3 ----------
panel_8 = Panel(vec2pt.Vector)
item_5 = ListItem(List=branch_2, Index=py3.U, Wrap=True)
breps_with_affected_geometry = Brep(item_5)
txt_preview_swatch = Text(item_3)
breps_with_affected_geometry_2 = ClusterOutput(breps_with_affected_geometry)
txt_preview_swatch_2 = ClusterOutput(txt_preview_swatch)
txt_program_srfs = Text(simplify(path_mapper))
int_srf_areas = Integer(round.Nearest)
txt_program_srfs_2 = ClusterOutput(txt_program_srfs)
panel_9 = Panel(int_srf_areas)

# ---- group: SORT FACADE AREA PR GROUPING
toggle_2 = BooleanToggle(True)
evalsrf_2 = EvaluateSurface(Surface=reparameterize(srf_input_2), Point="0.5,0.5")  # -> Point, Normal, UDirection, VDirection, Frame
rhatt_2 = GetRhinoAttributes(Geometry=branch, fullpath=False)  # -> Name, Layer, Color, MaterialName, SourceFile
closestb_2 = ClosestBrep(Breps=branch, Point=move.Geometry, strictClosestBrep=True)  # -> BrepIndex, ClosestPoint, ClosestNormal
item_6 = ListItem(List=rhatt_2.Layer, Index=closestb_2.BrepIndex, Wrap=True)
area_5 = Area(Geometry=srf_input_2)  # -> Area, Centroid
item_7 = ListItem(List=rhatt_2.Color, Index=closestb_2.BrepIndex, Wrap=True)
split_2 = TextSplit(Text=item_6, Separators="::")
item_8 = ListItem(List=split_2, Index=-1, Wrap=True)  # -> simplify(Item)
round_2 = Round(Number=area_5.Area)  # -> Nearest, Floor, Ceiling
path_mapper_2 = PathMapper(item_8, source=["{a;b;c}", "{a;b}"], target=["{A;B}", "{A;B}"])

# ----
py3_2 = Python3Script(x=closestb_2.BrepIndex, S=Toggle(True))  # -> out, U, I; inputs x: tree; same code as py3
panel_10 = Panel(py3_2.U)
path = ConstructPath(Indices=py3_2.U)
graftbydata = GraftByData(InputData=py3_2.U, PathsToAssign=py3_2.U)
panel_11 = Panel(graftbydata)
panel_12 = Panel(closestb_2.BrepIndex)
py3_3 = Python3Script(x=closestb_2.BrepIndex, S=toggle_2)  # -> out, U, I; inputs x: tree; same code as py3
item_9 = ListItem(List=branch, Index=py3_3.U, Wrap=True)
breps_with_affected_geometry_3 = Brep(item_9)
graftbydata_2 = GraftByData(InputData=area_3.Area, PathsToAssign=panel_12)
ma = MassAddition(Input=graftbydata_2)  # -> Result, PartialResults
path_mapper_3 = PathMapper(ma.Result, source=["{a;b;c}", "{a;b}"], target=["{A;B}", "{A;B}"])
graftbydata_3 = GraftByData(InputData=path_mapper_3, PathsToAssign=py3_2.U)
merge = Merge(Data1=dup, Data2=graftbydata_3)
ma_2 = MassAddition(Input=merge)  # -> Result, PartialResults
panel_13 = Panel(graftbydata_3)
branch_3 = TreeBranch(Tree=graft(breps_with_affected_geometry_3), Path=item, MaintainPaths=True)
panel_14 = Panel(ma_2.Result)
txt_preview_swatch_3 = Text(item_7)
path_mapper_4 = PathMapper(ma_2.Result, source=["{a;b;c}", "{a;b}"], target=["{A;B}", "{A;B}"])
panel_15 = Panel(graftbydata_2)
panel_16 = Panel(ma.Result)
panel_17 = Panel(path_mapper_3)
txt_program_srfs_3 = Text(simplify(path_mapper_2))
int_srf_areas_2 = Integer(round_2.Nearest)
int_program_areas_pr_brep_floor = Integer(path_mapper_4)
int_program_areas_pr_brep_floor_2 = ClusterOutput(int_program_areas_pr_brep_floor)
panel_18 = Panel(int_program_areas_pr_brep_floor)

# ---- group: SORT FACADE AREA PR GROUPING (continued)
py3_4 = Python3Script(x=txt_program_srfs, S=toggle)  # -> out, U, I; inputs x: tree; same code as py3
lng_3 = ListLength(List=txt_program_srfs)

# ----
txt_program_unique = Text(simplify(py3_4.U))

# ---- group: SORT FACADE AREA PR GROUPING (continued)
lng_4 = ListLength(List=txt_program_unique)
graft_2 = GraftTree(Tree=txt_program_unique, IncludeEmptyLists=True, IncludeNullItems=True)
dup_2 = DuplicateData(Data=txt_program_srfs, Number=lng_4, Order=True)
dup_3 = DuplicateData(Data=int_srf_areas, Number=lng_4, Order=True)
partition = PartitionList(List=dup_3, Size=lng_3)  # -> simplify(Chunks)
partition_2 = PartitionList(List=dup_2, Size=lng_3)  # -> simplify(Chunks)
mindex = MemberIndex(Set=partition_2, Member=graft(txt_program_unique))  # -> simplify(Index), Count
item_10 = ListItem(List=partition, Index=simplify(mindex.Index), Wrap=True)  # -> simplify(Item)
ma_3 = MassAddition(Input=item_10)  # -> Result, PartialResults
path_mapper_5 = PathMapper(ma_3.Result, source=["{a;b;c}", "{a;b}"], target=["{A;B}", "{A;B}"])

# ----
txt_program_unique_2 = ClusterOutput(txt_program_unique)
panel_19 = Panel(txt_program_unique)
int_program_areas_pr_brep_grouping = Integer(path_mapper_5)
panel_20 = Panel(int_program_areas_pr_brep_grouping)
int_program_areas_pr_brep_grouping_2 = ClusterOutput(int_program_areas_pr_brep_grouping)

# ---- group: SORT FACADE AREA PR GROUPING (continued)
py3_5 = Python3Script(x=txt_program_srfs_3, S=toggle_2)  # -> out, U, I; inputs x: tree; same code as py3
lng_5 = ListLength(List=txt_program_srfs_3)

# ----
txt_program_unique_3 = Text(simplify(py3_5.U))

# ---- group: SORT FACADE AREA PR GROUPING (continued)
lng_6 = ListLength(List=txt_program_unique_3)
graft_3 = GraftTree(Tree=txt_program_unique_3, IncludeEmptyLists=True, IncludeNullItems=True)
dup_4 = DuplicateData(Data=txt_program_srfs_3, Number=lng_6, Order=True)
dup_5 = DuplicateData(Data=int_srf_areas_2, Number=lng_6, Order=True)
partition_3 = PartitionList(List=dup_5, Size=lng_5)  # -> simplify(Chunks)
partition_4 = PartitionList(List=dup_4, Size=lng_5)  # -> simplify(Chunks)
mindex_2 = MemberIndex(Set=partition_4, Member=graft(txt_program_unique_3))  # -> simplify(Index), Count
item_11 = ListItem(List=partition_3, Index=simplify(mindex_2.Index), Wrap=True)  # -> simplify(Item)
ma_4 = MassAddition(Input=item_11)  # -> Result, PartialResults
path_mapper_6 = PathMapper(ma_4.Result, source=["{a;b;c}", "{a;b}"], target=["{A;B}", "{A;B}"])

# ----
int_program_areas_pr_brep_grouping_3 = Integer(path_mapper_6)

# ==== cluster Area_calc_per_plot
brep = ClusterInput()
crv = ClusterInput()
int = ClusterInput()
pt = ClusterInput()
crv_2 = Curve(simplify(crv))
int_2 = Integer(int)
pt_2 = Point(pt)
brep_2 = Brep(brep)
project = Project(Geometry=pt_2, Plane=PlaneXY(0, 0, 0))  # -> Geometry, Transform
tstat = TreeStatistics(Tree=crv_2)  # -> Paths, Length, Count
incurves = PointInCurves(Point=simplify(flatten(project.Geometry)), Curves=simplify(flatten(crv_2)))  # -> simplify(Relationship), Index, Point
incurves_2 = PointInCurves(Point=project.Geometry, Curves=crv_2)  # -> simplify(Relationship), flatten(Index), Point
addition = Addition(A=tstat.Count, B=1)
addition_2 = Addition(A=incurves.Index, B=1)
series = Series(Start=0, Step=1, Count=addition)
sort_val = SortDuplicateValues(ValueList=incurves_2.Index)  # -> UniqueValues, Indices
item = ListItem(List=incurves_2.Index, Index=0, Wrap=True)
o_tree = EmptyStructure(Paths=series)
tree = CreateTree(Data=flatten(int_2), Path=addition_2)
tree_2 = CreateTree(Data=brep_2, Path=addition_2)
split = SplitTree(Data=o_tree, Masks=flatten("{0}"))  # -> Positive, Negative
equals = Equality(FirstNumber=sort_val.UniqueValues, SecondNumber=item)  # -> Equality, Inequality
dispatch = Dispatch(List=sort_val.UniqueValues, DispatchPattern=equals.Inequality)  # -> ListA, ListB
replace = ReplaceItems(List=incurves_2.Index, Item=dispatch.ListA, Indices=0, Wrap=False)
merge = Merge(Data1=tree_2, Data2=split.Negative)
merge_2 = Merge(Data1=tree, Data2=split.Negative)
viewer = ParamViewer(split.Negative)
dispatch_2 = Dispatch(List=flatten(int_2), DispatchPattern=replace)  # -> flatten(ListA), flatten(ListB)
dispatch_3 = Dispatch(List=brep_2, DispatchPattern=replace)  # -> flatten(ListA), flatten(ListB)
path_mapper = PathMapper(dispatch_2.ListB, source="{A}", target="{path_index + 1}")
path_mapper_2 = PathMapper(dispatch_3.ListB, source="{A}", target="{path_index + 1}")
viewer_2 = ParamViewer(tree_2)
int_3 = Integer([dispatch_2.ListA, path_mapper])
null = NullItem(Item=int_3)  # -> NullFlags, InvalidFlags, Description
lng = ListLength(List=int_3)
branch = TreeBranch(Tree=tree_2, Path=Slider(3, range=0..10), MaintainPaths=True)
int_4 = Integer(merge_2)
p_n_c = PickNChoose(Pattern=null.NullFlags, Stream0=int_3, Stream1=lng)
null_2 = NullItem(Item=int_4)  # -> NullFlags, InvalidFlags, Description
lng_2 = ListLength(List=int_4)
brep_3 = Brep([dispatch_3.ListA, path_mapper_2])
branch_2 = TreeBranch(Tree=brep_3, Path=Slider(0, range=0..1), MaintainPaths=True)
p_n_c_2 = PickNChoose(Pattern=null_2.NullFlags, Stream0=int_4, Stream1="0")
int_5 = Integer(p_n_c)
brep_4 = Brep(merge)
int_6 = Integer(p_n_c_2)
panel = Panel(path_mapper_2)
brep_5 = ClusterOutput(brep_4)
int_7 = ClusterOutput(int_6)

# ==== cluster Area_extraction_from_brep
brep = ClusterInput()
brep_2 = Brep(brep)
debrep = DeconstructBrep(Brep=brep_2)  # -> Faces, Edges, Vertices
evalsrf = EvaluateSurface(Surface=reparameterize(debrep.Faces), Point="0.5,0.5")  # -> Point, Normal, UDirection, VDirection, Frame
Z = UnitZ(Factor=1)
dprod = DotProduct(VectorA=evalsrf.Normal, VectorB=Z, Unitize=False)
round = Round(Number=dprod)  # -> Nearest, Floor, Ceiling
equals = Equality(FirstNumber=round.Nearest, SecondNumber="-1")  # -> Equality, Inequality
dispatch = Dispatch(List=debrep.Faces, DispatchPattern=equals.Equality)  # -> ListA, ListB
Z_2 = UnitZ(Factor="1.5")
srf = Surface(dispatch.ListA)
move = Move(Geometry=srf, Motion=Z_2)  # -> simplify(Geometry), Transform
bbx = BrepBrep(BrepA=simplify(graft(brep_2)), BrepB=move.Geometry)  # -> simplify(Curves), Points
simplify = SimplifyCurve(Curve=bbx.Curves)  # -> Curve, Simplified
lng = ListLength(List=brep_2)
boundary = BoundarySurfaces(Edges=simplify.Curve)
lng_2 = ListLength(List=flatten(boundary))
area = Area(Geometry=boundary)  # -> Area, Centroid
int = Integer(area.Area)
pt = Point(area.Centroid)
subtraction = Subtraction(A=lng, B=lng_2)
brep_3 = ClusterOutput(brep_2)
int_2 = ClusterOutput(int)
pt_2 = ClusterOutput(pt)
equals_2 = Equality(FirstNumber=subtraction, SecondNumber="0")  # -> Equality, Inequality
equality = ClusterOutput(equals_2.Equality)

# ==== cluster SortBooleansForPreview
L = ClusterInput()
T = ClusterInput()
P = ClusterInput()
lng = ListLength(List=L)
branch = TreeBranch(Tree=T, Path=P, MaintainPaths=True)
null = NullItem(Item=branch)  # -> NullFlags, reverse(InvalidFlags), Description
dup = DuplicateData(Data="0", Number=lng, Order=True)  # -> simplify(Data)
invbool = InvertBoolean(Boolean=null.InvalidFlags)  # -> Inverted, Number
tstat = TreeStatistics(Tree=branch)  # -> Paths, Length, Count
split = SplitTree(Data=dup, Masks=flatten(tstat.Paths))  # -> Positive, Negative
int = Integer(invbool.Inverted)
merge = Merge(Data1=int, Data2=split.Negative)
R = ClusterOutput(merge)

# ==== cluster GWP_COLOUR_SCHEME
l0 = ClusterInput()
l1 = ClusterInput()
t = ClusterInput()
gradient = Gradient(LowerLimit=l0, UpperLimit=l1, Parameter=t, stops=[0: RGB(0, 128, 0), 0.5: RGB(255, 255, 0), 1: RGB(255, 0, 0)])
C = ClusterOutput(gradient)

# ==== cluster Ambition_colour_scheme
t = ClusterInput()
gradient = Gradient(LowerLimit="0.0", UpperLimit="1.0", Parameter=t, stops=[0: RGB(0, 128, 0), 0.5: RGB(255, 255, 0), 1: RGB(255, 0, 0)])
C = ClusterOutput(gradient)

# ==== cluster Preservation_colour_scheme
t = ClusterInput()
gradient = Gradient(
    LowerLimit="0.0",
    UpperLimit="5.0",
    Parameter=t,
    stops=[0: RGB(255, 140, 0), 0.203: RGB(255, 255, 0), 0.403: RGB(173, 255, 47), 0.801: RGB(0, 100, 0)])
C = ClusterOutput(gradient)

# ==== cluster Strucutral_material_colour_scheme
t = ClusterInput()
gradient = Gradient(
    LowerLimit="0.0",
    UpperLimit="5.0",
    Parameter=t,
    stops=[0: RGB(255, 128, 255), 0.0989: RGB(255, 128, 255), 0.296: RGB(128, 128, 128), 0.503: RGB(192, 192, 192), 0.705: RGB(255, 218, 185), 0.905: RGB(222, 184, 135)])
C = ClusterOutput(gradient)

# ==== cluster Energy_supply_colour_scheme
t = ClusterInput()
gradient = Gradient(
    LowerLimit="0.0",
    UpperLimit="2.0",
    Parameter=t,
    stops=[0: RGB(255, 140, 0), 0.33: RGB(255, 140, 0), 0.661: RGB(255, 215, 0)])
panel = Panel(t)
C = ClusterOutput(gradient)
